# Grasshopper definition Beam_Optimization_with_charge_unfinished.gh (Grasshopper 1.0.7)

pt = Point(Point(10.32057484, 2.321145671, 0))
pt_2 = Point(Point(30.28046411, 2.767125539, 0))
rectangle = Rectangle(Plane=PlaneXY(0, 0, 0), XSize=Slider(144, range=0..500), YSize=Slider(6, range=0..500), Radius=0)  # -> Rectangle, Length
pcharge = PointCharge(Point=flatten(pt), Charge=Slider(-184.406, range=-500..500), Decay=Slider(0, range=0..500), Bounds=rectangle.Rectangle)
rectangle_2 = Rectangle(Plane=PlaneXY(0, 0, 0), XSize=Slider(144, range=0..500), YSize=Slider(6, range=0..500), Radius=0)  # -> Rectangle, Length
fspin = SpinForce(
    Plane=pt_2,
    Strength=Slider(-32.678, range=-100..500),
    Radius=Slider(10.841, range=0..500),
    Decay=Slider(0, range=0..500),
    Bounds=rectangle.Rectangle)
mergef = MergeFields(Fields=[pcharge, fspin])
divide = DivideCurve(Curve=rectangle_2.Rectangle, Count=Slider(25.798, range=0..500), Kinks=False)  # -> flatten(Points), Tangents, Parameters
fline = FieldLine(Field=mergef, Point=divide.Points, Steps=Slider(146.653, range=0..500), Accuracy=0.1, Method=3)
