# Grasshopper definition Beam_Optimization_with_triangles_Warren.gh (Grasshopper 1.0.7)

beam_height = Slider(6, range=0..500)
beam_length = Slider(144, range=0..500)
box_origin_y = Slider(0, range=0..500)
# Define Beam Rectangle
beam_origin_x = Slider(0, range=0..500)
opening_size = Slider(-0.584, range=-5..0)
corner_radius = Slider(1.036, range=0..5)
triangle_alignment = Slider(0.139, range=0..5)
y_offset = Slider(-0.194, range=-5..5)
addition = Addition(A=beam_origin_x, B=beam_length)
addition_2 = Addition(A=box_origin_y, B=beam_height)
pt = Point(Point(10.32057484, 2.321145671, 0))
# Flip Pattern Here
construct_point = ConstructPoint(XCoordinate=beam_origin_x, YCoordinate=box_origin_y, ZCoordinate=0)
construct_point_2 = ConstructPoint(XCoordinate=addition, YCoordinate=beam_origin_x, ZCoordinate=0)
construct_point_3 = ConstructPoint(XCoordinate=addition, YCoordinate=addition_2, ZCoordinate=0)
construct_point_4 = ConstructPoint(XCoordinate=beam_origin_x, YCoordinate=addition_2, ZCoordinate=0)
rectangle_3pt = Rectangle3Pt(PointA=construct_point_2, PointB=construct_point, PointC=construct_point_3)  # -> Rectangle, Length
division = Division(A=beam_length, B=Slider(6, range=0..500))
pt_2 = Point(Point(43.58985625, 2.860448369, 0))
divide = DivideCurve(Curve=rectangle_3pt.Rectangle, Count=division, Kinks=False)  # -> flatten(Points), Tangents, Parameters
division_2 = Division(A=division, B="2")
split_list = SplitList(List=divide.Points, Index=division_2)  # -> ListA, ListB
reverse_list = ReverseList(List=split_list.ListB)
list_length = ListLength(List=split_list.ListA)
subtraction = Subtraction(A=list_length, B="1")
series = Series(Start=0, Step=1, Count=subtraction)
addition_3 = Addition(A=series, B="1")
list_item = ListItem(List=reverse_list, Index=addition_3, Wrap=True)
list_item_2 = ListItem(List=reverse_list, Index=series, Wrap=True)
list_item_3 = ListItem(List=split_list.ListA, Index=addition_3, Wrap=True)
list_item_4 = ListItem(List=divide.Points, Index=series, Wrap=True)
corner_radius_2 = Slider(1.036, range=0..5)
unit_y = UnitY(Factor=triangle_alignment)
unit_y_2 = UnitY(Factor=y_offset)
_4point_surface = _4PointSurface(CornerA=list_item_4, CornerB=list_item_2, CornerC=list_item_3)
_4point_surface_2 = _4PointSurface(CornerA=list_item_2, CornerB=list_item_3, CornerC=list_item)
# Subdivide Top Triangles
# Find center then divide
panel = Panel("2")
list_item_5 = ListItem(List=_4point_surface_2, Index="0", Wrap=True)
divide_domain² = DivideDomain²(Domain=list_item_5, UCount="1", VCount=panel)
isotrim = Isotrim(Surface=list_item_5, Domain=divide_domain²)
offset_curve = OffsetCurve(Curve=_4point_surface, Distance=opening_size, Corners=1)
offset_curve_2 = OffsetCurve(Curve=_4point_surface_2, Distance=opening_size, Corners=1)
multiplication = Multiplication(A=unit_y, B="-1")
boundary_surfaces = BoundarySurfaces(Edges=rectangle_3pt.Rectangle)
list_item_6 = ListItem(List=isotrim, Index="0", Wrap=True)
fillet = Fillet(Curve=offset_curve, Radius=corner_radius)
fillet_2 = Fillet(Curve=offset_curve_2, Radius=corner_radius)
addition_4 = Addition(A=unit_y, B=unit_y_2)
addition_5 = Addition(A=multiplication, B=unit_y_2)
solid_difference = SolidDifference(BrepsA=list_item_5, BrepsB=list_item_6)
flip = Flip(Surface=boundary_surfaces)  # -> Surface, Result
move = Move(Geometry=fillet, Motion=addition_4)  # -> Geometry, Transform
move_2 = Move(Geometry=fillet_2, Motion=addition_5)  # -> Geometry, Transform
list_item_7 = ListItem(List=solid_difference, Index="0", Wrap=True)
boundary_surfaces_2 = BoundarySurfaces(Edges=flatten(move.Geometry))
boundary_surfaces_3 = BoundarySurfaces(Edges=flatten(move_2.Geometry))
solid_difference_2 = SolidDifference(BrepsA=flip.Surface, BrepsB=boundary_surfaces_2)
flip_2 = Flip(Surface=solid_difference_2)  # -> Surface, Result
solid_difference_3 = SolidDifference(BrepsA=flip_2.Surface, BrepsB=boundary_surfaces_3)
number_slider = Slider(1, range=-20..500)
surface = Surface(solid_difference_3)
area = Area(Geometry=surface)  # -> Area, Centroid
area_2 = Area(Geometry=rectangle_3pt.Rectangle)  # -> Area, Centroid
panel_2 = Panel(area_2.Area)
panel_3 = Panel(area.Area)
division_3 = Division(A=panel_3, B=panel_2)
panel_4 = Panel(division_3)
