# Grasshopper definition Beam_Optimization_with_triangles_X_brace.gh (Grasshopper 1.0.7)

beam_height = Slider(6, range=0..500)
beam_length = Slider(144, range=0..500)
box_origin_y = Slider(0, range=0..500)
# Define Beam Rectangle
beam_origin_x = Slider(0, range=0..500)
opening_size = Slider(-0.584, range=-5..0)
corner_radius = Slider(1.036, range=0..5)
triangle_alignment = Slider(0.139, range=0..5)
y_offset = Slider(-0.194, range=-5..5)
addition = Addition(A=beam_origin_x, B=beam_length)
addition_2 = Addition(A=box_origin_y, B=beam_height)
pt = Point(Point(10.32057484, 2.321145671, 0))
pt_2 = Point(Point(43.58985625, 2.860448369, 0))
construct_point = ConstructPoint(XCoordinate=beam_origin_x, YCoordinate=box_origin_y, ZCoordinate=0)
construct_point_2 = ConstructPoint(XCoordinate=addition, YCoordinate=beam_origin_x, ZCoordinate=0)
construct_point_3 = ConstructPoint(XCoordinate=addition, YCoordinate=addition_2, ZCoordinate=0)
construct_point_4 = ConstructPoint(XCoordinate=beam_origin_x, YCoordinate=addition_2, ZCoordinate=0)
rectangle_3pt = Rectangle3Pt(PointA=construct_point, PointB=construct_point_2, PointC=construct_point_3)  # -> Rectangle, Length
# Flip Pattern Here
rectangle_3pt_2 = Rectangle3Pt(PointA=construct_point_2, PointB=construct_point, PointC=construct_point_3)  # -> Rectangle, Length
division = Division(A=beam_length, B=Slider(6, range=0..500))
divide = DivideCurve(Curve=rectangle_3pt_2.Rectangle, Count=division, Kinks=False)  # -> flatten(Points), Tangents, Parameters
division_2 = Division(A=division, B="2")
split_list = SplitList(List=divide.Points, Index=division_2)  # -> ListA, ListB
division_3 = Division(A=beam_length, B=Slider(6, range=0..500))
divide_2 = DivideCurve(Curve=rectangle_3pt.Rectangle, Count=division_3, Kinks=False)  # -> flatten(Points), Tangents, Parameters
reverse_list = ReverseList(List=split_list.ListB)
list_length = ListLength(List=split_list.ListA)
division_4 = Division(A=division_3, B="2")
split_list_2 = SplitList(List=divide_2.Points, Index=division_4)  # -> ListA, ListB
subtraction = Subtraction(A=list_length, B="1")
reverse_list_2 = ReverseList(List=split_list_2.ListB)
list_length_2 = ListLength(List=split_list_2.ListA)
series = Series(Start=0, Step=1, Count=subtraction)
subtraction_2 = Subtraction(A=list_length_2, B="1")
addition_3 = Addition(A=series, B="1")
series_2 = Series(Start=0, Step=1, Count=subtraction_2)
list_item = ListItem(List=reverse_list, Index=addition_3, Wrap=True)
list_item_2 = ListItem(List=reverse_list, Index=series, Wrap=True)
list_item_3 = ListItem(List=split_list.ListA, Index=addition_3, Wrap=True)
list_item_4 = ListItem(List=divide.Points, Index=series, Wrap=True)
addition_4 = Addition(A=series_2, B="1")
unit_y = UnitY(Factor=triangle_alignment)
unit_y_2 = UnitY(Factor=y_offset)
_4point_surface = _4PointSurface(CornerA=list_item_4, CornerB=list_item_2, CornerC=list_item_3)
_4point_surface_2 = _4PointSurface(CornerA=list_item_2, CornerB=list_item_3, CornerC=list_item)
list_item_5 = ListItem(List=reverse_list_2, Index=addition_4, Wrap=True)
list_item_6 = ListItem(List=reverse_list_2, Index=series_2, Wrap=True)
list_item_7 = ListItem(List=split_list_2.ListA, Index=addition_4, Wrap=True)
list_item_8 = ListItem(List=divide_2.Points, Index=series_2, Wrap=True)
unit_y_3 = UnitY(Factor=triangle_alignment)
unit_y_4 = UnitY(Factor=y_offset)
_4point_surface_3 = _4PointSurface(CornerA=list_item_8, CornerB=list_item_6, CornerC=list_item_7)
_4point_surface_4 = _4PointSurface(CornerA=list_item_6, CornerB=list_item_7, CornerC=list_item_5)
solid_difference = SolidDifference(BrepsA=_4point_surface_2, BrepsB=_4point_surface_3)
offset_curve = OffsetCurve(Distance=opening_size, Corners=1)
solid_difference_2 = SolidDifference(BrepsA=_4point_surface_4, BrepsB=_4point_surface)
multiplication = Multiplication(A=unit_y, B="-1")
boundary_surfaces = BoundarySurfaces(Edges=rectangle_3pt_2.Rectangle)
solid_difference_3 = SolidDifference(BrepsA=rectangle_3pt_2.Rectangle, BrepsB=solid_difference)
fillet = Fillet(Curve=offset_curve, Radius=corner_radius)
addition_5 = Addition(A=unit_y, B=unit_y_2)
addition_6 = Addition(A=multiplication, B=unit_y_2)
solid_difference_4 = SolidDifference(BrepsA=solid_difference_3, BrepsB=solid_difference_2)
flip = Flip(Surface=boundary_surfaces)  # -> Surface, Result
move = Move(Geometry=fillet, Motion=addition_5)  # -> Geometry, Transform
boundary_surfaces_2 = BoundarySurfaces(Edges=solid_difference_3)
boundary_surfaces_3 = BoundarySurfaces(Edges=solid_difference_4)
boundary_surfaces_4 = BoundarySurfaces(Edges=rectangle_3pt_2.Rectangle)
boundary_surfaces_5 = BoundarySurfaces(Edges=flatten(move.Geometry))
solid_intersection = SolidIntersection(BrepsA=boundary_surfaces_2, BrepsB=boundary_surfaces_3)
solid_difference_5 = SolidDifference(BrepsA=flip.Surface, BrepsB=boundary_surfaces_5)
split_brep_multiple = SplitBrepMultiple(Brep=boundary_surfaces_4, Cutters=solid_intersection)
offset_curve_2 = OffsetCurve(Curve=split_brep_multiple, Distance=opening_size, Corners=1)
fillet_2 = Fillet(Curve=offset_curve_2, Radius=corner_radius)
move_2 = Move(Geometry=fillet_2, Motion=addition_6)  # -> Geometry, Transform
boundary_surfaces_6 = BoundarySurfaces(Edges=flatten(move_2.Geometry))
flip_2 = Flip(Surface=boundary_surfaces)  # -> Surface, Result
split_brep_multiple_2 = SplitBrepMultiple(Brep=boundary_surfaces, Cutters=simplify(graft(boundary_surfaces_6)))
split_brep = SplitBrep(Brep=boundary_surfaces, Cutter=flatten(boundary_surfaces_6))
solid_difference_6 = SolidDifference(BrepsA=boundary_surfaces, BrepsB=boundary_surfaces_6)
number_slider = Slider(1, range=-20..500)
surface = Surface(split_brep)
area = Area(Geometry=surface)  # -> Area, Centroid
area_2 = Area(Geometry=rectangle_3pt_2.Rectangle)  # -> Area, Centroid
trim_solid = TrimSolid(Shape=boundary_surfaces, Cutters=boundary_surfaces_6)
list_item_9 = ListItem(List=boundary_surfaces_6, Index="0", Wrap=True)
panel = Panel(area_2.Area)
panel_2 = Panel(area.Area)
division_5 = Division(A=panel_2, B=panel)
panel_3 = Panel(division_5)
