# Grasshopper definition Beam_Optimization_with_triangles_X_brace_to_Gcode_double_trace_shrinking.gh (Grasshopper 1.0.7)
# plug-ins: Silkworm

# 144 in = 3657.6 mm
beam_length_mm = Slider(3658, range=0..8000)
# 6 in = 152.4 mm
beam_height_mm = Slider(152, range=0..500)
# Remove the Center Diamond
# ** May need to adjust this based
# on the number of sections.
element_to_remove = Slider(10, range=0..100)
box_origin_y = Slider(0, range=0..500)
# X-Brace Beam
beam_origin_x = Slider(0, range=0..500)
# 6 in = 152.4 mm
solid_end_length = Slider(144, range=0..300)
# 0.171 in = 4.343 mm
corner_radius = Slider(4.343, range=0..5)
# Opening Offset (Half of the Bracing Width))
# -0.238 in = -6.045 mm
opening_offset = Slider(-10.5, range=-25..0)
# Even number of Sections leaves a
# Center Diamond to leave solid
number_of_sections = Slider(18, range=0..24)
# 0.5 in = 12.5 mm
solid_edge_width = Slider(10.9, range=0..90)
x_offset = Slider(0, range=-5..5)
y_offset = Slider(-5, range=-50..50)
# Adjust for Split between Diamond and
#  Triagle shapes for setting tracing direction.
# ** May need to adjust this based
# on the number of sections and Inner Rectangle.
panel = Panel("2")
addition = Addition(A=beam_origin_x, B=beam_length_mm)
addition_2 = Addition(A=box_origin_y, B=beam_height_mm)
# F0's and G92's are a problem we need to remove.
# We also need to be able to turn off extrusion
unit_y = UnitY(Factor=solid_edge_width)
unit_x = UnitX(Factor=solid_end_length)
construct_point = ConstructPoint(XCoordinate=beam_origin_x, YCoordinate=box_origin_y, ZCoordinate=0)
construct_point_2 = ConstructPoint(XCoordinate=addition, YCoordinate=beam_origin_x, ZCoordinate=0)
construct_point_3 = ConstructPoint(XCoordinate=addition, YCoordinate=addition_2, ZCoordinate=0)
construct_point_4 = ConstructPoint(XCoordinate=beam_origin_x, YCoordinate=addition_2, ZCoordinate=0)
# Center Height
division = Division(A=beam_height_mm, B="2")
construct_point_5 = ConstructPoint(XCoordinate=addition, YCoordinate=division, ZCoordinate=0)
construct_point_6 = ConstructPoint(XCoordinate=beam_origin_x, YCoordinate=division, ZCoordinate=0)
subtraction = Subtraction(A=construct_point_2, B=unit_x)
addition_3 = Addition(A=construct_point, B=unit_x)
subtraction_2 = Subtraction(A=construct_point_3, B=unit_x)
division_2 = Division(A=addition, B="2")
subtraction_3 = Subtraction(A=subtraction_2, B=unit_y)
addition_4 = Addition(A=addition_3, B=unit_y)
addition_5 = Addition(A=subtraction, B=unit_y)
# Full Rectangle
rectangle_3pt = Rectangle3Pt(PointA=construct_point_2, PointB=construct_point, PointC=construct_point_3)  # -> Rectangle, Length
unit_x_2 = UnitX(Factor=division_2)
unit_y_2 = UnitY(Factor=division)
# Inner Rectangle
rectangle_3pt_2 = Rectangle3Pt(PointA=addition_5, PointB=subtraction_3, PointC=addition_4)  # -> Rectangle, Length
# Beam Center
construct_point_7 = ConstructPoint(XCoordinate=unit_x_2, YCoordinate=unit_y_2, ZCoordinate=0)
boundary_surfaces = BoundarySurfaces(Edges=rectangle_3pt_2.Rectangle)
addition_6 = Addition(A=construct_point_2, B=unit_y)
addition_7 = Addition(A=construct_point, B=unit_y)
# Use Poylines to create the points for the X bracing
subtraction_4 = Subtraction(A=construct_point_4, B=unit_y)
subtraction_5 = Subtraction(A=construct_point_3, B=unit_y)
# Bottom Inner Line
polyline = PolyLine(Vertices=[addition_7, addition_6], Closed=False)
# Center Line of Inner Rectangle
polyline_2 = PolyLine(Vertices=[construct_point_6, construct_point_5], Closed=False)
# Top Inner Line
polyline_3 = PolyLine(Vertices=[subtraction_4, subtraction_5], Closed=False)
multiplication = Multiplication(A=number_of_sections, B="2")
# Double the number of sections and then take every other one.
divide = DivideCurve(Curve=polyline_2, Count=multiplication, Kinks=False)  # -> flatten(Points), Tangents, Parameters
divide_2 = DivideCurve(Curve=polyline_3, Count=number_of_sections, Kinks=False)  # -> flatten(Points), Tangents, Parameters
divide_3 = DivideCurve(Curve=polyline, Count=number_of_sections, Kinks=False)  # -> flatten(Points), Tangents, Parameters
dispatch = Dispatch(List=divide.Points, DispatchPattern=[True, False])  # -> ListA, ListB
list_length = ListLength(List=divide_2.Points)
# Build Triangles at top and bottom and diamonds in the middle.
# Series Sections
series = Series(Start=0, Step=1, Count=number_of_sections)
point = Point(dispatch.ListB)
# Series Offset by 1
addition_8 = Addition(A=series, B="1")
# Offset Series Shortened by 1
panel_2 = Panel("-1")
# Series Shortened by 1
cull_index = CullIndex(List=series, Indices="-1", Wrap=True)
cull_index_2 = CullIndex(List=addition_8, Indices=panel_2, Wrap=True)
list_item = ListItem(List=divide_3.Points, Index=series, Wrap=True)  # disabled
list_item_2 = ListItem(List=point, Index="-1", Wrap=True)  # disabled
# Triangle top left
list_item_3 = ListItem(List=divide_2.Points, Index=series, Wrap=True)  # disabled
# Diamond left
list_item_4 = ListItem(List=point, Index=cull_index, Wrap=True)
list_item_5 = ListItem(List=point, Index=series, Wrap=True)  # disabled
list_item_6 = ListItem(List=point, Index="0", Wrap=True)  # disabled
# Triangle bottom
list_item_7 = ListItem(List=point, Index=series, Wrap=True)  # disabled
list_item_8 = ListItem(List=divide_3.Points, Index="-1", Wrap=True)  # disabled
list_item_9 = ListItem(List=divide_2.Points, Index="-1", Wrap=True)  # disabled
# Diamond top
list_item_10 = ListItem(List=divide_2.Points, Index=cull_index_2, Wrap=True)
# Diamond bottom
list_item_11 = ListItem(List=divide_3.Points, Index=cull_index_2, Wrap=True)
list_item_12 = ListItem(List=divide_3.Points, Index=addition_8, Wrap=True)  # disabled
list_item_13 = ListItem(List=divide_3.Points, Index="0", Wrap=True)  # disabled
list_item_14 = ListItem(List=divide_2.Points, Index="0", Wrap=True)  # disabled
# Diamond Right
list_item_15 = ListItem(List=point, Index=cull_index_2, Wrap=True)
# Triangle top right
list_item_16 = ListItem(List=divide_2.Points, Index=addition_8, Wrap=True)  # disabled
# Bottom Triangles
_4point_surface = _4PointSurface(CornerA=list_item_5, CornerB=list_item, CornerC=list_item_12)  # disabled
# Center End Triangle
_4point_surface_2 = _4PointSurface(CornerA=list_item_9, CornerB=list_item_2, CornerC=list_item_8)  # disabled
# Center First Triangle
_4point_surface_3 = _4PointSurface(CornerA=list_item_14, CornerB=list_item_6, CornerC=list_item_13)  # disabled
# Top Triangles
_4point_surface_4 = _4PointSurface(CornerA=list_item_3, CornerB=list_item_16, CornerC=list_item_7)  # disabled
# Defining the Diamonds is the only necessary
# part because the edge
# triangles are formed by the cuts with the
# inner rectangle.
_4point_surface_5 = _4PointSurface(CornerA=list_item_10, CornerB=list_item_4, CornerC=list_item_11, CornerD=list_item_15)
curve = Curve(_4point_surface_5)
# Limit Bracing To Inner Rectangle
split_brep_multiple = SplitBrepMultiple(Brep=boundary_surfaces, Cutters=flatten(curve))  # -> flatten(Result)
# Offset for Bracing Width
offset_curve = OffsetCurve(Curve=flatten(split_brep_multiple), Distance=opening_offset, Corners=1)
# Round Corners
fillet = Fillet(Curve=offset_curve, Radius=corner_radius)
unit_y_3 = UnitY(Factor=y_offset)
boundary_surfaces_2 = BoundarySurfaces(Edges=flatten(fillet))
# Y Offset of Bracing
move = Move(Geometry=boundary_surfaces_2, Motion=unit_y_3)  # -> Geometry, Transform
unit_x_3 = UnitX(Factor=x_offset)
# X Offset of Bracing
move_2 = Move(Geometry=move.Geometry, Motion=unit_x_3)  # -> Geometry, Transform
list_length_2 = ListLength(List=curve)
addition_9 = Addition(A=list_length_2, B=panel)
# Remove the Selected Element
# (Center Diamond)
cull_index_3 = CullIndex(List=move_2.Geometry, Indices=element_to_remove, Wrap=True)
# Trim from Rectangle
split_brep_multiple_2 = SplitBrepMultiple(Brep=rectangle_3pt.Rectangle, Cutters=cull_index_3)
# Generate the path to cut out these curves
surface = Surface(cull_index_3)
list_length_3 = ListLength(List=surface)
list_item_17 = ListItem(List=split_brep_multiple_2, Index="-1", Wrap=True)  # -> flatten(Item)
# Series Sections
series_2 = Series(Start=0, Step=1, Count=list_length_3)
surface_2 = Surface(list_item_17)
# We need to reverse the points of the triangles after they are totally processed, therefore split
# all the shapes into two groups at this point.
panel_3 = Panel("1")
# Compare area to a full rectangle
area = Area(Geometry=surface_2)  # -> Area, Centroid
area_2 = Area(Geometry=rectangle_3pt.Rectangle)  # -> Area, Centroid
# Series Offset by 1
addition_10 = Addition(A=series_2, B=panel_3)
panel_4 = Panel(area_2.Area)
panel_5 = Panel(area.Area)
# Pair off shapes
# 
# May not Be needed!!
# First and Second,
# Then Second and Third ...
list_item_18 = ListItem(List=surface, Index=series_2, Wrap=True)
list_item_19 = ListItem(List=surface, Index=addition_10, Wrap=True)
division_3 = Division(A=panel_5, B=panel_4)
panel_6 = Panel(division_3)
divlength = DivideLength(Curve=list_item_18, Length="1")  # -> Points, Tangents, Parameters
divlength_2 = DivideLength(Curve=list_item_19, Length="1")  # -> Points, Tangents, Parameters
split_list = SplitList(List=move_2.Geometry, Index=addition_9)  # -> ListA, ListB
list_item_20 = ListItem(List=surface, Index=series_2, Wrap=True)  # -> graft(Item)
cull_index_4 = CullIndex(List=split_list.ListA, Indices=element_to_remove, Wrap=True)
# First point of each shape
list_item_21 = ListItem(List=divlength.Points, Index="1", Wrap=True)
list_item_22 = ListItem(List=divlength_2.Points, Index="1", Wrap=True)
number_slider = Slider(0, range=0..52)
# Add the shape twice before the
# connecting line, to have it
# retrace before moving on.
duplicate_data = DuplicateData(Data=cull_index_4, Number=2, Order="0")
# Create a Polyline from one
# shape start to the next
pline = PolyLine(Vertices=[list_item_21, list_item_22], Closed=False)  # -> graft(Polyline)
duplicate_data_2 = DuplicateData(Data=split_list.ListB, Number=2, Order="0")
# Create new lines that join the first points
# of each shape.  Then order them by the
#  series of points.
# Graft here  to get shapes together
# in the right order.
curve_2 = Curve(graft([list_item_20, list_item_18, pline]))
divlength_3 = DivideLength(Curve=flatten(duplicate_data_2), Length="1")  # -> flatten(Points), Tangents, Parameters
# Then flatten to keep that sequence
# and end series loop
# Break curves into small parts
divlength_4 = DivideLength(Curve=flatten(duplicate_data), Length="1")  # -> flatten(Points), Tangents, Parameters
# Reverse so the shapes have the
# same direction of cutting. (counter clockwise)
reverse_list = ReverseList(List=divlength_3.Points)
# Join all the points to make one
# long tool path
# Break the path into each segment
pline_2 = PolyLine(Vertices=flatten([divlength_4.Points, reverse_list]), Closed=False)
explode = Explode(Curve=pline_2, Recursive=True)  # -> Segments, Vertices
# To Follow the path of points
list_item_23 = ListItem(List=explode.Vertices, Index=Slider(29001, range=0..50000), Wrap=True)
curve_3 = Curve(list_item_23)
line = Line(list_item_23)
point_2 = Point(list_item_23)
curve_4 = Curve(pline_2)
panel_7 = Panel("2000")
panel_8 = Panel("0")
line_2 = Line(explode.Segments)
point_3 = Point(explode.Vertices)
extrusion = SilkwormExtrusionPath(MovementLines=line_2, SpeedParameter=3000, FlowRatio=0.35)
silkworm = SilkwormCompiler(SilkwormMovements=flatten(extrusion))  # -> GCode, SilkwormModel
panel_9 = Panel(silkworm.GCode)
