# Grasshopper definition Beam_Optimization_with_triangles_side.gh (Grasshopper 1.0.7)

opening_size = Slider(-0.584, range=-5..0)
corner_radius = Slider(1.036, range=0..5)
triangle_alignment = Slider(0.139, range=0..5)
y_offset = Slider(-0.194, range=-5..5)
number_slider = Slider(6, range=0..500)
number_slider_2 = Slider(144, range=0..500)
pt = Point(Point(43.58985625, 2.860448369, 0))
pt_2 = Point(Point(10.32057484, 2.321145671, 0))
division = Division(A=number_slider_2, B=number_slider)
rectangle = Rectangle(Plane=PlaneXY(0, 0, 0), XSize=number_slider_2, YSize=number_slider, Radius=0)  # -> Rectangle, Length
divide = DivideCurve(Curve=rectangle.Rectangle, Count=division, Kinks=False)  # -> flatten(Points), Tangents, Parameters
division_2 = Division(A=division, B="2")
split_list = SplitList(List=divide.Points, Index=division_2)  # -> ListA, ListB
reverse_list = ReverseList(List=split_list.ListB)
list_length = ListLength(List=split_list.ListA)
subtraction = Subtraction(A=list_length, B="1")
series = Series(Start=0, Step=1, Count=subtraction)
addition = Addition(A=series, B="1")
list_item = ListItem(List=reverse_list, Index=addition, Wrap=True)
list_item_2 = ListItem(List=reverse_list, Index=series, Wrap=True)
list_item_3 = ListItem(List=split_list.ListA, Index=addition, Wrap=True)
list_item_4 = ListItem(List=divide.Points, Index=series, Wrap=True)
unit_y = UnitY(Factor=triangle_alignment)
unit_y_2 = UnitY(Factor=y_offset)
_4point_surface = _4PointSurface(CornerA=list_item_4, CornerB=list_item_2, CornerC=list_item_3)
_4point_surface_2 = _4PointSurface(CornerA=list_item_2, CornerB=list_item_3, CornerC=list_item)
offset_curve = OffsetCurve(Curve=_4point_surface, Distance=opening_size, Corners=1)
offset_curve_2 = OffsetCurve(Curve=_4point_surface_2, Distance=opening_size, Corners=1)
multiplication = Multiplication(A=unit_y, B="-1")
boundary_surfaces = BoundarySurfaces(Edges=rectangle.Rectangle)
fillet = Fillet(Curve=offset_curve, Radius=corner_radius)
fillet_2 = Fillet(Curve=offset_curve_2, Radius=corner_radius)
addition_2 = Addition(A=unit_y, B=unit_y_2)
addition_3 = Addition(A=multiplication, B=unit_y_2)
flip = Flip(Surface=boundary_surfaces)  # -> Surface, Result
move = Move(Geometry=fillet, Motion=addition_2)  # -> Geometry, Transform
move_2 = Move(Geometry=fillet_2, Motion=addition_3)  # -> Geometry, Transform
boundary_surfaces_2 = BoundarySurfaces(Edges=flatten(move.Geometry))
boundary_surfaces_3 = BoundarySurfaces(Edges=flatten(move_2.Geometry))
solid_difference = SolidDifference(BrepsA=flip.Surface, BrepsB=boundary_surfaces_2)
flip_2 = Flip(Surface=solid_difference)  # -> Surface, Result
solid_difference_2 = SolidDifference(BrepsA=flip_2.Surface, BrepsB=boundary_surfaces_3)
number_slider_3 = Slider(1, range=-20..500)
surface = Surface(solid_difference_2)
area = Area(Geometry=surface)  # -> Area, Centroid
area_2 = Area(Geometry=rectangle.Rectangle)  # -> Area, Centroid
panel = Panel(area_2.Area)
panel_2 = Panel(area.Area)
division_3 = Division(A=panel_2, B=panel)
panel_3 = Panel(division_3)
