# Grasshopper definition Corner Test Wall 6 points.gh (Grasshopper 1.0.7)
# plug-ins: Silkworm

# Main Parmeters
farthest_left = Slider(-79, range=-100..101)
print_speed = Slider(2873, range=0..5000)
lowest_point = Slider(0, range=-10..100)
points_in_base_curves = Slider(326, range=0..1000)
outer_wall_coner_radius = Slider(79, range=0..200)
wall_height = Slider(1, range=0..300)
wall_thickness = Slider(109, range=0..300)
building_length = Slider(1000, range=0..1000)
roof_height_front = Slider(104, range=0..300)
roof_height_back = Slider(81, range=0..300)
building_depth = Slider(441, range=0..1000)
X = UnitX(Factor=farthest_left)
Y = UnitY(Factor=lowest_point)
Y_2 = UnitY(Factor=building_depth)
X_2 = UnitX(Factor=lowest_point)
# Outside corner
pt = ConstructPoint(XCoordinate=farthest_left, YCoordinate=Y, ZCoordinate=0)
pt_2 = ConstructPoint(XCoordinate=farthest_left, YCoordinate=Y_2, ZCoordinate=0)
Y_3 = UnitY(Factor=lowest_point)
X_3 = UnitX(Factor=building_length)
addition = Addition(A=farthest_left, B=wall_thickness)
addition_2 = Addition(A=lowest_point, B=wall_thickness)
# Inside Corner
addition_3 = Addition(A=farthest_left, B=wall_thickness)
pt_3 = ConstructPoint(XCoordinate=X_3, YCoordinate=Y_3, ZCoordinate=0)
rec_3pt = Rectangle3Pt(PointA=pt, PointB=pt_2, PointC=pt_3)  # -> Rectangle, Length; disabled
pt_4 = ConstructPoint(XCoordinate=addition_3, YCoordinate=addition_2, ZCoordinate=0)
pt_5 = ConstructPoint(XCoordinate=addition, YCoordinate=building_depth, ZCoordinate=0)
pt_6 = ConstructPoint(XCoordinate=X_3, YCoordinate=wall_thickness, ZCoordinate=0)
Z = UnitZ(Factor=wall_height)
pt_7 = Point([pt, pt_2, pt_5, pt_4, pt_6, pt_3])
pline = PolyLine(Vertices=pt_7, Closed=True)
fillet = Fillet(Curve=pline, Radius=outer_wall_coner_radius)
divide = DivideCurve(Curve=fillet, Count=points_in_base_curves, Kinks=False)  # -> Points, Tangents, Parameters
pline_2 = PolyLine(Vertices=divide.Points, Closed=False)
extr = Extrude(Base=pline_2, Direction=Z)
extrusion = SilkwormExtrusionPath(MovementLines=simplify(graft(divide.Points)), SpeedParameter=print_speed, FlowRatio=0.35)
silkworm = SilkwormCompiler(SilkwormMovements=flatten(extrusion))  # -> GCode, SilkwormModel
panel = Panel(silkworm.GCode)
silkworm_viewer = SilkwormViewer(SilkwormModel=silkworm.SilkwormModel, DisplayLogistics=False, DisplayValues=False)
