# Grasshopper definition Corner Test Wall Simple Curve Segments.gh (Grasshopper 1.0.7)
# plug-ins: Silkworm

# Main Parmeters
farthest_left = Slider(-100, range=-100..101)
start_point_x = Slider(0, range=-10..100)
start_point_y = Slider(0, range=-10..100)
building_length = Slider(1000, range=0..1000)
wall_height = Slider(1, range=0..300)
building_depth = Slider(510, range=0..1000)
outer_wall_coner_radius = Slider(70, range=0..100)
wall_thickness = Slider(156, range=0..300)
# segment length of 16 was too jerky
# segment length of 4 was smooth with 38 radius
# - but was bad with 60  (Yoff 80, X off 38)
# - changing to length of 8 - better (Y off 68, X off 32)
# - changing to length of 10 and radius of 50 (Y off y 35, X off by 6)
# - changing to length of 12 and radius of 45 (Y off y 30, X off by 27)
# --- 4-16-22 with new motor settings we can do fine points again.
# (Better for no path planning issues)
#        - length of 6 and radius of 70
length_of_curve_segments = Slider(6, range=0..20)
print_speed = Slider(2873, range=0..5000)
Y = UnitY(Factor=building_depth)
X = UnitX(Factor=building_length)
Y_2 = UnitY(Factor=start_point_y)
addition = Addition(A=farthest_left, B=wall_thickness)
addition_2 = Addition(A=start_point_y, B=wall_thickness)
# Corner Wall Points
# Start Point
# Gradually Rise from 0 Z
# Start Material Flow once moving
pt = ConstructPoint(XCoordinate=start_point_x, YCoordinate=Y_2, ZCoordinate=0)
# Bottom Right Corner
pt_2 = ConstructPoint(XCoordinate=X, YCoordinate=Y_2, ZCoordinate=0)
# Inside Corner
pt_3 = ConstructPoint(XCoordinate=addition, YCoordinate=addition_2, ZCoordinate=0)
pt_4 = ConstructPoint(XCoordinate=addition, YCoordinate=Y, ZCoordinate=0)
pt_5 = ConstructPoint(XCoordinate=X, YCoordinate=addition_2, ZCoordinate=0)
# Top Left Corner
pt_6 = ConstructPoint(XCoordinate=farthest_left, YCoordinate=Y, ZCoordinate=0)
# Bottom Left Corner
pt_7 = ConstructPoint(XCoordinate=farthest_left, YCoordinate=Y_2, ZCoordinate=0)
# Back to the first point
pt_8 = ConstructPoint(XCoordinate=start_point_x, YCoordinate=Y_2, ZCoordinate=0)
# Add points in
# order of path
pline = PolyLine(Vertices=[pt, pt_2, pt_5, pt_3, pt_4, pt_6, pt_7, pt_8], Closed=False)
Z = UnitZ(Factor=wall_height)
# Round
# Corners
fillet = Fillet(Curve=pline, Radius=outer_wall_coner_radius)
# Break the curves
# into segments of
# specified length
divlength = DivideLength(Curve=fillet, Length=length_of_curve_segments)  # -> Points, Tangents, Parameters
pline_2 = PolyLine(Vertices=divlength.Points, Closed=False)
# Optimize
# Remove extra points
# in straight lines
simplify = SimplifyCurve(Curve=pline_2)  # -> Curve, Simplified
explode = Explode(Curve=pline_2, Recursive=True)  # -> Segments, Vertices
extrusion = SilkwormExtrusionPath(MovementLines=simplify(graft(explode.Vertices)), SpeedParameter=print_speed, FlowRatio=0.35)
extr = Extrude(Base=explode.Segments, Direction=Z)
silkworm = SilkwormCompiler(SilkwormMovements=flatten(extrusion))  # -> GCode, SilkwormModel
silkworm_viewer = SilkwormViewer(SilkwormModel=silkworm.SilkwormModel, DisplayLogistics=False, DisplayValues=False)
panel = Panel(silkworm.GCode)
