# Grasshopper definition Corner Test Wall With Center Fill Cells.gh (Grasshopper 1.0.7)
# plug-ins: Silkworm

# Infill Parmeters
inset_distance = Slider(8, range=-100..101)
start_point_x = Slider(0, range=-10..100)
# Main Parmeters
farthest_left = Slider(-123, range=-500..500)
start_point_y = Slider(0, range=-10..100)
start_point_x_2 = Slider(0, range=-10..100)
building_depth = Slider(453, range=0..1000)
start_point_y_2 = Slider(0, range=-10..100)
outer_wall_coner_radius = Slider(29, range=0..100)
wall_height = Slider(1, range=0..300)
building_length = Slider(1000, range=0..1000)
wall_height_2 = Slider(1, range=0..300)
outer_wall_coner_radius_2 = Slider(41, range=0..100)
wall_thickness = Slider(124, range=0..300)
length_of_curve_segments = Slider(5, range=0..1000)
print_speed = Slider(2873, range=0..5000)
Y = UnitY(Factor=start_point_y)
Y_2 = UnitY(Factor=building_depth)
X = UnitX(Factor=building_length)
Y_3 = UnitY(Factor=start_point_y_2)
# Center Wall Front
infill_length_multiplier = Slider(1, range=0..10)
# Center Wall Front
infill_length_multiplier_2 = Slider(1, range=0..10)
addition = Addition(A=farthest_left, B=wall_thickness)
addition_2 = Addition(A=start_point_y_2, B=wall_thickness)
addition_3 = Addition(A=start_point_y_2, B=inset_distance)
addition_4 = Addition(A=start_point_x_2, B=inset_distance)
subtraction = Subtraction(A=building_length, B=inset_distance)
frequency_alignment = Slider(64.954, range=0..100)
# Start Point
# Gradually Rise from 0 Z
# Start Material Flow once moving
pt = ConstructPoint(XCoordinate=start_point_x, YCoordinate=addition_4, ZCoordinate=0)
# Corner Wall Points
# Start Point
# Gradually Rise from 0 Z
# Start Material Flow once moving
pt_2 = ConstructPoint(XCoordinate=start_point_x_2, YCoordinate=Y_3, ZCoordinate=0)
pt_3 = ConstructPoint(XCoordinate=farthest_left, YCoordinate=Y_2, ZCoordinate=0)
# Bottom Right Corner
pt_4 = ConstructPoint(XCoordinate=X, YCoordinate=Y_3, ZCoordinate=0)
# Inside Corner
pt_5 = ConstructPoint(XCoordinate=addition, YCoordinate=addition_2, ZCoordinate=0)
pt_6 = ConstructPoint(XCoordinate=addition, YCoordinate=Y_2, ZCoordinate=0)
pt_7 = ConstructPoint(XCoordinate=X, YCoordinate=addition_2, ZCoordinate=0)
# Top Left Corner
# Bottom Left Corner
pt_8 = ConstructPoint(XCoordinate=farthest_left, YCoordinate=Y_3, ZCoordinate=0)
# Back to the first point
pt_9 = ConstructPoint(XCoordinate=start_point_x_2, YCoordinate=Y_3, ZCoordinate=0)
X_2 = UnitX(Factor=infill_length_multiplier)
X_3 = UnitX(Factor=infill_length_multiplier_2)
subtraction_2 = Subtraction(A=building_depth, B=inset_distance)
frequency_alignment_2 = Slider(116.529, range=0..160)
frequency_multiplier = Slider(10.824, range=0..100)
amplitude_multiplier = Slider(33.476, range=0..100)
frequency_alignment_3 = Slider(56.57, range=0..160)
subtraction_3 = Subtraction(A=subtraction_2, B=inset_distance)
# Add points in
# order of path
pline = PolyLine(Vertices=[pt_2, pt_4, pt_7, pt_5, pt_6, pt_3, pt_8, pt_9], Closed=False)
arrlinear = LinearArray(Geometry=pt, Direction=X_2, Count=subtraction)  # -> Geometry, Transform
arrlinear_2 = LinearArray(Geometry=pt, Direction=X_3, Count=subtraction_3)  # -> Geometry, Transform
Z = UnitZ(Factor=wall_height_2)
# Round
# Corners
fillet = Fillet(Curve=pline, Radius=outer_wall_coner_radius_2)
pdecon = Deconstruct(Point=arrlinear.Geometry)  # -> XComponent, YComponent, ZComponent
# Break the curves
# into segments of
# specified length
divlength = DivideLength(Curve=fillet, Length=length_of_curve_segments)  # -> Points, Tangents, Parameters
pdecon_2 = Deconstruct(Point=arrlinear_2.Geometry)  # -> XComponent, YComponent, ZComponent
multiplication = Multiplication(A=pdecon.XComponent, B=frequency_multiplier)
pline_2 = PolyLine(Vertices=divlength.Points, Closed=False)
addition_5 = Addition(A=pdecon_2.XComponent, B=frequency_alignment_2)
division = Division(A=multiplication, B=360)
multiplication_2 = Multiplication(A=addition_5, B=frequency_multiplier)
# Optimize
# Remove extra points
# in straight lines
simplify = SimplifyCurve(Curve=pline_2)  # -> Curve, Simplified
addition_6 = Addition(A=division, B=frequency_alignment_3)
addition_7 = Addition(A=pdecon_2.XComponent, B=inset_distance)
division_2 = Division(A=multiplication_2, B=360)
explode = Explode(Curve=simplify.Curve, Recursive=True)  # -> Segments, Vertices
column_alignment_adjustment = Slider(6.543, range=-10..10)
align_mirror = Slider(126.464, range=0..1000)
extr = Extrude(Base=explode.Segments, Direction=Z)
cos = Cosine(Value=addition_6)
cos_2 = Cosine(Value=division_2)
extrusion = SilkwormExtrusionPath(MovementLines=simplify(graft(explode.Vertices)), SpeedParameter=print_speed, FlowRatio=0.35)
acos = ArcCosine(Value=cos_2)
acos_2 = ArcCosine(Value=cos)
multiplication_3 = Multiplication(A=acos, B=amplitude_multiplier)
multiplication_4 = Multiplication(A=acos_2, B=amplitude_multiplier)
addition_8 = Addition(A=multiplication_3, B=column_alignment_adjustment)
addition_9 = Addition(A=multiplication_4, B=column_alignment_adjustment)
silkworm = SilkwormCompiler(SilkwormMovements=flatten(extrusion))  # -> GCode, SilkwormModel
silkworm_viewer = SilkwormViewer(SilkwormModel=silkworm.SilkwormModel, DisplayLogistics=False, DisplayValues=False)
addition_10 = Addition(A=addition_8, B=farthest_left)
panel = Panel(silkworm.GCode)
pt_10 = ConstructPoint(XCoordinate=addition_10, YCoordinate=addition_7, ZCoordinate=pdecon_2.ZComponent)
pt_11 = ConstructPoint(XCoordinate=pdecon.XComponent, YCoordinate=addition_9, ZCoordinate=pdecon.ZComponent)
pline_3 = PolyLine(Vertices=pt_10, Closed=False)
pline_4 = PolyLine(Vertices=pt_11, Closed=False)
