# Grasshopper definition Corner Test Wall With Center Fill.gh (Grasshopper 1.0.7)
# plug-ins: Silkworm

# Infill Parmeters
inset_distance = Slider(8, range=-100..101)
start_point_x = Slider(0, range=-10..100)
# Main Parmeters
farthest_left = Slider(-100, range=-100..101)
start_point_y = Slider(0, range=-10..100)
start_point_x_2 = Slider(0, range=-10..100)
building_depth = Slider(414, range=0..1000)
start_point_y_2 = Slider(0, range=-10..100)
outer_wall_coner_radius = Slider(29, range=0..100)
wall_height = Slider(1, range=0..300)
building_length = Slider(847, range=0..1000)
wall_height_2 = Slider(1, range=0..300)
outer_wall_coner_radius_2 = Slider(48, range=0..100)
wall_thickness = Slider(100, range=0..300)
length_of_curve_segments = Slider(5, range=0..1000)
print_speed = Slider(2873, range=0..5000)
# Center Wall Front
infill_length_multiplier = Slider(1, range=0..10)
# Center Wall Front
infill_length_multiplier_2 = Slider(1, range=0..10)
Y = UnitY(Factor=start_point_y)
Y_2 = UnitY(Factor=1)
Y_3 = UnitY(Factor=building_depth)
X = UnitX(Factor=building_length)
Y_4 = UnitY(Factor=start_point_y_2)
X_2 = UnitX(Factor=infill_length_multiplier)
X_3 = UnitX(Factor=infill_length_multiplier_2)
division = Division(A=wall_thickness, B=2)
subtraction = Subtraction(A=building_depth, B=inset_distance)
addition = Addition(A=farthest_left, B=wall_thickness)
addition_2 = Addition(A=start_point_y_2, B=wall_thickness)
addition_3 = Addition(A=start_point_y_2, B=inset_distance)
addition_4 = Addition(A=start_point_x_2, B=inset_distance)
subtraction_2 = Subtraction(A=building_length, B=inset_distance)
subtraction_3 = Subtraction(A=building_depth, B=inset_distance)
addition_5 = Addition(A=farthest_left, B=division)
subtraction_4 = Subtraction(A=subtraction_2, B=division)
frequency_alignment = Slider(71.755, range=0..100)
frequency_alignment_2 = Slider(37.885, range=0..100)
frequency_multiplier = Slider(28.766, range=0..100)
amplitude_multiplier = Slider(12.815, range=0..100)
# Start Point
# Gradually Rise from 0 Z
# Start Material Flow once moving
pt = ConstructPoint(XCoordinate=start_point_x, YCoordinate=addition_4, ZCoordinate=0)
subtraction_5 = Subtraction(A=subtraction_3, B=inset_distance)
# Inside Corner
pt_2 = ConstructPoint(XCoordinate=division, YCoordinate=division, ZCoordinate=0)
# Corner Wall Points
# Start Point
# Gradually Rise from 0 Z
# Start Material Flow once moving
pt_3 = ConstructPoint(XCoordinate=start_point_x_2, YCoordinate=Y_4, ZCoordinate=0)
pt_4 = ConstructPoint(XCoordinate=farthest_left, YCoordinate=Y_3, ZCoordinate=0)
# Top Left Infill End
pt_5 = ConstructPoint(XCoordinate=addition_5, YCoordinate=subtraction, ZCoordinate=0)
# Bottom Right Corner
pt_6 = ConstructPoint(XCoordinate=X, YCoordinate=Y_4, ZCoordinate=0)
# Inside Corner
pt_7 = ConstructPoint(XCoordinate=addition, YCoordinate=addition_2, ZCoordinate=0)
# Bottom Right Infill End
pt_8 = ConstructPoint(XCoordinate=subtraction_2, YCoordinate=division, ZCoordinate=0)
pt_9 = ConstructPoint(XCoordinate=addition, YCoordinate=Y_3, ZCoordinate=0)
pt_10 = ConstructPoint(XCoordinate=X, YCoordinate=addition_2, ZCoordinate=0)
# Back to the first point
pt_11 = ConstructPoint(XCoordinate=start_point_x, YCoordinate=addition_4, ZCoordinate=0)
# Top Left Corner
# Bottom Left Corner
pt_12 = ConstructPoint(XCoordinate=farthest_left, YCoordinate=Y_4, ZCoordinate=0)
# Back to the first point
pt_13 = ConstructPoint(XCoordinate=start_point_x_2, YCoordinate=Y_4, ZCoordinate=0)
arrlinear = LinearArray(Geometry=pt, Direction=X_2, Count=subtraction_4)  # -> Geometry, Transform
arrlinear_2 = LinearArray(Geometry=pt, Direction=X_3, Count=subtraction_5)  # -> Geometry, Transform
pdecon = Deconstruct(Point=arrlinear.Geometry)  # -> XComponent, YComponent, ZComponent
pdecon_2 = Deconstruct(Point=arrlinear_2.Geometry)  # -> XComponent, YComponent, ZComponent
multiplication = Multiplication(A=pdecon.XComponent, B=frequency_multiplier)
# Add points in
# order of path
pline = PolyLine(Vertices=[pt_3, pt_6, pt_10, pt_7, pt_9, pt_4, pt_12, pt_13], Closed=False)
pline_2 = PolyLine(Vertices=[pt, pt_8, pt_2, pt_5, pt_11], Closed=False)  # disabled
addition_6 = Addition(A=pdecon_2.XComponent, B=frequency_alignment_2)
Z = UnitZ(Factor=wall_height_2)
division_2 = Division(A=multiplication, B=360)
# Round
# Corners
fillet = Fillet(Curve=pline, Radius=outer_wall_coner_radius_2)
multiplication_2 = Multiplication(A=addition_6, B=frequency_multiplier)
# Break the curves
# into segments of
# specified length
divlength = DivideLength(Curve=fillet, Length=length_of_curve_segments)  # -> Points, Tangents, Parameters
addition_7 = Addition(A=division_2, B=frequency_alignment)
addition_8 = Addition(A=pdecon_2.XComponent, B=inset_distance)
division_3 = Division(A=multiplication_2, B=360)
column_alignment_adjustment = Slider(7.131, range=-10..10)
align_mirror = Slider(100, range=0..1000)
cos = Cosine(Value=addition_7)
pline_3 = PolyLine(Vertices=divlength.Points, Closed=False)
cos_2 = Cosine(Value=division_3)
acos = ArcCosine(Value=cos)
acos_2 = ArcCosine(Value=cos_2)
# Optimize
# Remove extra points
# in straight lines
simplify = SimplifyCurve(Curve=pline_3)  # -> Curve, Simplified
multiplication_3 = Multiplication(A=acos, B=amplitude_multiplier)
multiplication_4 = Multiplication(A=acos_2, B=amplitude_multiplier)
explode = Explode(Curve=simplify.Curve, Recursive=True)  # -> Segments, Vertices
addition_9 = Addition(A=multiplication_3, B=column_alignment_adjustment)
extr = Extrude(Base=explode.Segments, Direction=Z)
addition_10 = Addition(A=multiplication_4, B=column_alignment_adjustment)
addition_11 = Addition(A=pdecon.XComponent, B=division)
extrusion = SilkwormExtrusionPath(MovementLines=simplify(graft(explode.Vertices)), SpeedParameter=print_speed, FlowRatio=0.35)
multiplication_5 = Multiplication(A=addition_9, B=-1)
multiplication_6 = Multiplication(A=addition_10, B=-1)
addition_12 = Addition(A=multiplication_5, B=align_mirror)
addition_13 = Addition(A=addition_10, B=farthest_left)
addition_14 = Addition(A=multiplication_6, B=align_mirror)
addition_15 = Addition(A=addition_14, B=farthest_left)
pt_14 = ConstructPoint(XCoordinate=addition_11, YCoordinate=addition_9, ZCoordinate=pdecon.ZComponent)
pt_15 = ConstructPoint(XCoordinate=addition_11, YCoordinate=addition_12, ZCoordinate=pdecon.ZComponent)
silkworm = SilkwormCompiler(SilkwormMovements=flatten(extrusion))  # -> GCode, SilkwormModel
pt_16 = ConstructPoint(XCoordinate=addition_13, YCoordinate=addition_8, ZCoordinate=pdecon_2.ZComponent)
pt_17 = ConstructPoint(XCoordinate=addition_15, YCoordinate=addition_8, ZCoordinate=pdecon_2.ZComponent)
pline_4 = PolyLine(Vertices=pt_14, Closed=False)
pline_5 = PolyLine(Vertices=pt_15, Closed=False)
pline_6 = PolyLine(Vertices=pt_16, Closed=False)
pline_7 = PolyLine(Vertices=pt_17, Closed=False)
silkworm_viewer = SilkwormViewer(SilkwormModel=silkworm.SilkwormModel, DisplayLogistics=False, DisplayValues=False)
panel = Panel(silkworm.GCode)
