# Grasshopper definition Cut shapes.gh (Grasshopper 1.0.7)
# plug-ins: Silkworm

# Two straight Walls With Double Wyth
# (two 1" beads to make a 2" thick inner and
#  outter wall) - the bridge between the two
#  should be cut
# Insert Geometry to Flow around
# Curve to surface is what we want for
# morphonig around outlets, etc.
# We just have to get a good
# surface around the brep obstacle.
length_of_curve_segments = Slider(2, range=0..20)
curve = Curve([<curve referenced from the Rhino model> x6])
# Break and Join again
# to get points across inner to outer
# Optimizing to
# Remove extra points
# in straight lines can cause the
# issue of the printer not doing
# the points in order
divlength = DivideLength(Curve=curve, Length=length_of_curve_segments)  # -> Points, Tangents, Parameters
pline = PolyLine(Vertices=divlength.Points, Closed=False)
explode = Explode(Curve=pline, Recursive=True)  # -> Segments, Vertices

# ---- group: Arrange Parts
# Take the Triangles
# and put it onto the last of the diamonds.
panel = Panel("1")

# ----
# Create te move vector
# from the point
# towards the center.
# Partition List to get
# the center of each
# shape separately!!
# Get the centroid
# for each shape.
# Set the move distance
# to be 6 mm.
# Replace the first point
# with the moved point.
# Move the first point
# towards the center.
# Get all points.
# Get first point of each shape.
curve_2 = Curve(curve)
list_length = ListLength(List=curve_2)
series = Series(Start=list_length, Step=-1, Count=list_length)
list_item = ListItem(List=curve_2, Index=series, Wrap=True)
area = Area(Geometry=list_item)  # -> Area, Centroid
divlength_2 = DivideLength(Curve=list_item, Length="1")  # -> Points, Tangents, Parameters
partition_list = PartitionList(List=area.Centroid, Size=1)
list_item_2 = ListItem(List=divlength_2.Points, Index=0, Wrap=True)
vector_2pt = Vector2Pt(PointA=list_item_2, PointB=partition_list, Unitize=True)  # -> Vector, Length
amplitude = Amplitude(Vector=vector_2pt.Vector, Amplitude=6)
move = Move(Geometry=list_item_2, Motion=amplitude)  # -> Geometry, Transform
replace_items = ReplaceItems(List=divlength_2.Points, Item=move.Geometry, Indices=0, Wrap=False)

unit_x = UnitX(Factor="-1")

# ---- group: Arrange Parts
# Remove the Rectangle
#  at the start
# Remove the Rectangle
#  at the end
# Join all the points to make
#  paths for each shape
# Break curves into
# small parts
# Break the paths into separate
# segment collections
# We need to reverse the points of the triangles
#  after they are totally processed, therefore split
# all the shapes into two groups at this point.
# Length of curves
# (Resolution)
# Add the shape twice before the
# connecting line, to have it
# retrace before moving on.
# Reverse to start cutting
# the triangles at the end
# of the diamonds
# Flip to fix the normals
# so we have the
# same direction of cutting.
# (counter clockwise)
# Remove the Rectangle
# ** May need to adjust this based
# on the number of sections.
# Adjust for Split between Diamond and
#  Triagle shapes for setting tracing direction.
# ** May need to adjust this based
# on the number of sections and Inner Rectangle.
list_length_2 = ListLength(List=curve)
# Bulding Depth
# minus Offset
element_to_remove = Slider(1, range=0..100)
addition = Addition(A=list_length_2)
split_list = SplitList(Index=addition)  # -> ListA, ListB
cull_index = CullIndex(List=split_list.ListA, Indices=element_to_remove, Wrap=True)
cull_index_2 = CullIndex(List=cull_index, Indices=-1, Wrap=True)
duplicate_data = DuplicateData(Data=split_list.ListB, Number="1", Order="0")
duplicate_data_2 = DuplicateData(Data=cull_index_2, Number=panel, Order="0")
reverse_list = ReverseList(List=duplicate_data)
pline_2 = PolyLine(Vertices=replace_items, Closed=False)
explode_2 = Explode(Curve=pline_2, Recursive=True)  # -> Segments, Vertices
line = Line(explode_2.Segments)
point = Point(explode_2.Vertices)

# ----
list_item_3 = ListItem(List=point, Index=Slider(537, range=0..590), Wrap=True)
point_2 = Point(list_item_3)
flip_curve = FlipCurve(Curve=reverse_list)  # -> Curve, Flag
dispatch = Dispatch(List=flip_curve.Curve, DispatchPattern=[True, False])  # -> ListA, ListB
# Adjusting for some printer slop!
# Nudging top triangles back
move_2 = Move(Geometry=dispatch.ListB, Motion=unit_x)  # -> Geometry, Transform

# ---- group: Silkworm
# With the Delimiter, we now have
# non-extuding moves!  Just keep the
# Line collections separate when sending them in
# and silkworm will add the moves between..
# How high to raise for travel
# How fast to raise
# How much negative extrusiuon
# How far to come back down
# How fast to come down
# How much to extrude to get flow again
# Travel speed
# E-1.135  Will be what I want to signal
# Turning off the Plasma Cutter
# And E1.136 will be to turn it on.
# I'll replace for my M Code in the Gcode.
panel_2 = Panel("4")
# Very slow speeds for plasma cutting!
# We travel even slower to let the tip cool
# and keep a lower duty cycle.
unit_z = UnitZ(Factor=panel_2)
multiplication = Multiplication(A=unit_z, B=-1)
silkworm_movement_delimiter = SilkwormMovementDelimiter(
    DelimitingStartVectors=multiplication,
    StartVectorDelimitingSpeed=360,
    StartVectorDelimitingPressure=1.136,
    DelimitingEndVectors=unit_z,
    EndVectorDelimitingSpeed=360,
    EndVectoreDelimitingPressure=-1.135,
    TravelSpeed="312")
extrusion = SilkwormExtrusionPath(MovementLines=line, SpeedParameter="351", FlowRatio=0, Delimiter=silkworm_movement_delimiter)
silkworm = SilkwormCompiler(SilkwormMovements=extrusion)  # -> GCode, SilkwormModel

# ----
# Check direction of point flow
panel_3 = Panel(silkworm.GCode)

# ---- group: Arrange Parts (continued)
# Add a plunge point to start cut inside shape.
curve_3 = Curve([dispatch.ListA, move_2.Geometry])

# ----
insert_items = InsertItems(List=duplicate_data_2, Item=curve_3, Indices=-1, Wrap=True)

# ---- group: Arrange Parts (continued)
divlength_3 = DivideLength(Curve=insert_items, Length="1")  # -> Points, Tangents, Parameters
