# Grasshopper definition Field Lines in a rectangle.gh (Grasshopper 1.0.7)

number_slider = Slider(67.343, range=0..500)
pt = Point(Point(14.46260001, 13.81789408, 0))
pt_2 = Point(Point(29.69723517, 31.64934205, 0))
rectangle = Rectangle(Plane=PlaneXY(0, 0, 0), XSize=number_slider, YSize=number_slider, Radius=0)  # -> Rectangle, Length
number_slider_2 = Slider(58.683, range=0..500)
pcharge = PointCharge(Point=flatten(pt), Charge=Slider(-160.406, range=-500..500), Decay=Slider(0, range=0..500), Bounds=rectangle.Rectangle)
rectangle_2 = Rectangle(Plane=PlaneXY(0, 0, 0), XSize=number_slider_2, YSize=number_slider_2, Radius=0)  # -> Rectangle, Length
fspin = SpinForce(
    Plane=pt_2,
    Strength=Slider(-90.278, range=-100..500),
    Radius=Slider(29.023, range=0..500),
    Decay=Slider(0, range=0..500),
    Bounds=rectangle.Rectangle)
mergef = MergeFields(Fields=[pcharge, fspin])
divide = DivideCurve(Curve=rectangle_2.Rectangle, Count=Slider(18.718, range=0..500), Kinks=False)  # -> flatten(Points), Tangents, Parameters
fline = FieldLine(Field=mergef, Point=divide.Points, Steps=Slider(350.102, range=0..500), Accuracy=0.1, Method=3)
