# Grasshopper definition Genetic_Algorythm_to_optimize_slab_with_air_heat_4_zones.gh (Grasshopper 1.0.7)

number_slider = Slider(15, range=0..500)
number_slider_2 = Slider(55, range=0..500)
number_slider_3 = Slider(9, range=0..500)
number_slider_4 = Slider(15, range=0..500)
construct_point = ConstructPoint(XCoordinate=number_slider, YCoordinate=Slider(8, range=0..500), ZCoordinate="0")
construct_point_2 = ConstructPoint(XCoordinate=number_slider, YCoordinate=number_slider, ZCoordinate="0")
rectangle = Rectangle(Plane=PlaneXY(0, 0, 0), XSize=number_slider_2, YSize=number_slider_2, Radius=0)  # -> Rectangle, Length
construct_point_3 = ConstructPoint(XCoordinate=Slider(8, range=0..500), YCoordinate=number_slider, ZCoordinate="0")
number_slider_5 = Slider(223, range=0..500)
number_slider_6 = Slider(5, range=0..500)
number_slider_7 = Slider(0, range=0..500)
surface = Surface(rectangle.Rectangle)
divide_domain² = DivideDomain²(Domain=surface, UCount=number_slider_3, VCount=number_slider_3)
rectangle_3pt = Rectangle3Pt(PointA=construct_point_3, PointB=construct_point_2, PointC=construct_point)  # -> Rectangle, Length
number_slider_8 = Slider(4, range=0..500)
multiplication = Multiplication(A=number_slider_3, B="4")
number_slider_9 = Slider(49, range=-500..500)
number_slider_10 = Slider(1, range=0..500)
isotrim = Isotrim(Surface=surface, Domain=divide_domain²)
divide_curve = DivideCurve(Curve=rectangle_3pt.Rectangle, Count="4", Kinks=False)  # -> Points, Tangents, Parameters
divide_curve_2 = DivideCurve(Curve=rectangle.Rectangle, Count="4", Kinks=False)  # -> Points, Tangents, Parameters
divide_curve_3 = DivideCurve(Curve=rectangle.Rectangle, Count=multiplication, Kinks=False)  # -> Points, Tangents, Parameters
area = Area(Geometry=isotrim)  # -> Area, Centroid
shift_list = ShiftList(List=divide_curve.Points, Shift=1, Wrap=True)
number_slider_11 = Slider(14, range=0..500)
cull_nth = CullNth(List=shift_list, CullFrequency=Slider(2, range=0..500))
partition_list = PartitionList(List=area.Centroid, Size=number_slider_3)
list_item = ListItem(List=cull_nth, Index=Slider(1, range=0..500), Wrap=True)
gene_pool = GenePool(Decimals=0, Maximum=36, Minimum=1, Value=[24, 22, 13, 14])
list_item_2 = ListItem(List=cull_nth, Index=Slider(2, range=0..500), Wrap=True)
multiplication_2 = Multiplication(A=number_slider_3, B=["4", "3", "2", "1"])
subtraction = Subtraction(A=multiplication_2, B="1")
integer = Integer([multiplication_2, gene_pool])
sort_list = SortList(Keys=integer)  # -> Keys, ValuesA
cull_index = CullIndex(Indices=["0", "-1"], Wrap="1")
list_item_3 = ListItem(List=sort_list.Keys, Index="7", Wrap=True)
list_item_4 = ListItem(List=sort_list.Keys, Index="1", Wrap=True)
list_item_5 = ListItem(List=sort_list.Keys, Index="0", Wrap=True)
list_item_6 = ListItem(List=sort_list.Keys, Index="6", Wrap=True)
list_item_7 = ListItem(List=sort_list.Keys, Index="2", Wrap=True)
list_item_8 = ListItem(List=sort_list.Keys, Index="5", Wrap=True)
list_item_9 = ListItem(List=sort_list.Keys, Index="3", Wrap=True)
list_item_10 = ListItem(List=sort_list.Keys, Index="4", Wrap=True)
list_item_11 = ListItem(List=divide_curve_3.Points, Index=list_item_3, Wrap=True)
list_item_12 = ListItem(List=divide_curve_3.Points, Index=list_item_10, Wrap=True)
list_item_13 = ListItem(List=divide_curve_3.Points, Index=list_item_5, Wrap=True)
list_item_14 = ListItem(List=divide_curve_3.Points, Index=list_item_6, Wrap=True)
list_item_15 = ListItem(List=divide_curve_3.Points, Index=list_item_8, Wrap=True)
list_item_16 = ListItem(List=divide_curve_3.Points, Index=list_item_9, Wrap=True)
list_item_17 = ListItem(List=divide_curve_3.Points, Index=list_item_4, Wrap=True)
list_item_18 = ListItem(List=divide_curve_3.Points, Index=list_item_7, Wrap=True)
insert_items = InsertItems(Item=list_item, Indices="0", Wrap=True)
list_item_19 = ListItem(List=divide_curve.Points, Index="0", Wrap=True)
list_item_20 = ListItem(List=divide_curve.Points, Index="1", Wrap=True)
list_item_21 = ListItem(List=divide_curve.Points, Index="2", Wrap=True)
list_item_22 = ListItem(List=divide_curve.Points, Index="3", Wrap=True)
insert_items_2 = InsertItems(List=insert_items, Item=list_item_2, Indices="-1", Wrap=True)  # -> flatten(List)
polyline = PolyLine(Vertices=[list_item_19, list_item_22, list_item_11, list_item_14, list_item_15], Closed="1")
polyline_2 = PolyLine(Vertices=[list_item_22, list_item_21, list_item_17, list_item_13, list_item_11], Closed="1")
polyline_3 = PolyLine(Vertices=[list_item_19, list_item_20, list_item_16, list_item_12, list_item_15], Closed="1")
polyline_4 = PolyLine(Vertices=[list_item_20, list_item_21, list_item_17, list_item_18, list_item_16], Closed="1")
point_in_curve = PointInCurve(Point=area.Centroid, Curve=polyline)  # -> Relationship, Point
point_in_curve_2 = PointInCurve(Point=area.Centroid, Curve=polyline_3)  # -> Relationship, Point
point_in_curve_3 = PointInCurve(Point=area.Centroid, Curve=polyline_2)  # -> Relationship, Point
interpolate = Interpolate(Vertices=insert_items_2, Degree=3, Periodic=False, KnotStyle=1)  # -> Curve, Length, Domain
point_in_curve_4 = PointInCurve(Point=area.Centroid, Curve=polyline_4)  # -> Relationship, Point
brep_curve = BrepCurve(Brep=isotrim, Curve=interpolate.Curve)  # -> Curves, Points
pipe = Pipe(Curve=interpolate.Curve, Radius="1", Caps=0)
equality = Equality(FirstNumber=point_in_curve.Relationship, SecondNumber="2")  # -> Equality, Inequality
clash = Clash(FirstSet=pipe, SecondSet=isotrim, Distance=0, ResultLimit=100)  # -> ClashCount, ClashPoints, ClashRadii, FirstIndex, SecondIndex
equality_2 = Equality(FirstNumber=point_in_curve_2.Relationship, SecondNumber="2")  # -> Equality, Inequality
equality_3 = Equality(FirstNumber=point_in_curve_3.Relationship, SecondNumber="2")  # -> Equality, Inequality
equality_4 = Equality(FirstNumber=point_in_curve_4.Relationship, SecondNumber="2")  # -> Equality, Inequality
curve_self = CurveSelf(Curve=interpolate.Curve)  # -> Points, Params
curve = Curve(brep_curve.Curves)
point = Point(brep_curve.Points)
list_item_23 = ListItem(List=isotrim, Index=clash.SecondIndex, Wrap=True)
dispatch = Dispatch(List=point_in_curve.Point, DispatchPattern=equality.Inequality)  # -> ListA, ListB
dispatch_2 = Dispatch(List=point_in_curve_2.Point, DispatchPattern=equality_2.Inequality)  # -> ListA, ListB
dispatch_3 = Dispatch(List=point_in_curve_3.Point, DispatchPattern=equality_3.Inequality)  # -> ListA, ListB
dispatch_4 = Dispatch(List=point_in_curve_4.Point, DispatchPattern=equality_4.Inequality)  # -> ListA, ListB
list_length = ListLength(List=curve_self.Points)
list_length_2 = ListLength(List=clash.SecondIndex)
convex_hull = ConvexHull(Points=dispatch.ListB, Plane=dispatch.ListB)  # -> Hull, HullZ, Indices
convex_hull_2 = ConvexHull(Points=dispatch_2.ListB, Plane=dispatch_2.ListB)  # -> Hull, HullZ, Indices
convex_hull_3 = ConvexHull(Points=dispatch_3.ListB, Plane=dispatch_3.ListB)  # -> Hull, HullZ, Indices
convex_hull_4 = ConvexHull(Points=dispatch_4.ListB, Plane=dispatch_4.ListB)  # -> Hull, HullZ, Indices
panel = Panel(list_length)
panel_2 = Panel(list_length_2)
panel_3 = Panel(interpolate.Length)
point_in_curve_5 = PointInCurve(Point=dispatch.ListB, Curve=convex_hull.Hull)  # -> Relationship, Point
point_in_curve_6 = PointInCurve(Point=dispatch_2.ListB, Curve=convex_hull_2.Hull)  # -> Relationship, Point
point_in_curve_7 = PointInCurve(Point=dispatch_3.ListB, Curve=convex_hull_3.Hull)  # -> Relationship, Point
point_in_curve_8 = PointInCurve(Point=dispatch_4.ListB, Curve=convex_hull_4.Hull)  # -> Relationship, Point
galapagos = Galapagos(fitness=mass_addition, gene=gene_pool)
equality_5 = Equality(FirstNumber=point_in_curve_5.Relationship, SecondNumber="2")  # -> Equality, Inequality
equality_6 = Equality(FirstNumber=point_in_curve_6.Relationship, SecondNumber="2")  # -> Equality, Inequality
equality_7 = Equality(FirstNumber=point_in_curve_7.Relationship, SecondNumber="2")  # -> Equality, Inequality
equality_8 = Equality(FirstNumber=point_in_curve_8.Relationship, SecondNumber="2")  # -> Equality, Inequality
dispatch_5 = Dispatch(List=point_in_curve_5.Point, DispatchPattern=equality_5.Inequality)  # -> ListA, ListB
dispatch_6 = Dispatch(List=point_in_curve_6.Point, DispatchPattern=equality_6.Inequality)  # -> ListA, ListB
dispatch_7 = Dispatch(List=point_in_curve_7.Point, DispatchPattern=equality_7.Inequality)  # -> ListA, ListB
dispatch_8 = Dispatch(List=point_in_curve_8.Point, DispatchPattern=equality_8.Inequality)  # -> ListA, ListB
convex_hull_5 = ConvexHull(Points=dispatch_5.ListB, Plane=dispatch_5.ListB)  # -> Hull, HullZ, Indices
convex_hull_6 = ConvexHull(Points=dispatch_6.ListB, Plane=dispatch_6.ListB)  # -> Hull, HullZ, Indices
convex_hull_7 = ConvexHull(Points=dispatch_7.ListB, Plane=dispatch_7.ListB)  # -> Hull, HullZ, Indices
convex_hull_8 = ConvexHull(Points=dispatch_8.ListB, Plane=dispatch_8.ListB)  # -> Hull, HullZ, Indices
point_in_curve_9 = PointInCurve(Point=dispatch_5.ListB, Curve=convex_hull_5.Hull)  # -> Relationship, Point
point_in_curve_10 = PointInCurve(Point=dispatch_6.ListB, Curve=convex_hull_6.Hull)  # -> Relationship, Point
point_in_curve_11 = PointInCurve(Point=dispatch_7.ListB, Curve=convex_hull_7.Hull)  # -> Relationship, Point
point_in_curve_12 = PointInCurve(Point=dispatch_8.ListB, Curve=convex_hull_8.Hull)  # -> Relationship, Point
equality_9 = Equality(FirstNumber=point_in_curve_9.Relationship, SecondNumber="2")  # -> Equality, Inequality
equality_10 = Equality(FirstNumber=point_in_curve_10.Relationship, SecondNumber="2")  # -> Equality, Inequality
equality_11 = Equality(FirstNumber=point_in_curve_11.Relationship, SecondNumber="2")  # -> Equality, Inequality
equality_12 = Equality(FirstNumber=point_in_curve_12.Relationship, SecondNumber="2")  # -> Equality, Inequality
dispatch_9 = Dispatch(List=point_in_curve_9.Point, DispatchPattern=equality_9.Inequality)  # -> ListA, ListB
dispatch_10 = Dispatch(List=point_in_curve_10.Point, DispatchPattern=equality_10.Inequality)  # -> ListA, ListB
dispatch_11 = Dispatch(List=point_in_curve_11.Point, DispatchPattern=equality_11.Inequality)  # -> ListA, ListB
dispatch_12 = Dispatch(List=point_in_curve_12.Point, DispatchPattern=equality_12.Inequality)  # -> ListA, ListB
convex_hull_9 = ConvexHull(Points=dispatch_9.ListB, Plane=dispatch_9.ListB)  # -> Hull, HullZ, Indices
convex_hull_10 = ConvexHull(Points=dispatch_10.ListB, Plane=dispatch_10.ListB)  # -> Hull, HullZ, Indices
convex_hull_11 = ConvexHull(Points=dispatch_11.ListB, Plane=dispatch_11.ListB)  # -> Hull, HullZ, Indices
convex_hull_12 = ConvexHull(Points=dispatch_12.ListB, Plane=dispatch_12.ListB)  # -> Hull, HullZ, Indices
curve_2 = Curve([convex_hull_9.Hull, convex_hull_5.Hull, convex_hull.Hull])
curve_3 = Curve([convex_hull_10.Hull, convex_hull_6.Hull, convex_hull_2.Hull])
curve_4 = Curve([convex_hull_11.Hull, convex_hull_7.Hull, convex_hull_3.Hull])
curve_5 = Curve([convex_hull_12.Hull, convex_hull_8.Hull, convex_hull_4.Hull])
curve_6 = Curve([curve_2, curve_3, curve_5, curve_4])
length = Length(Curve=curve_6)
replace_nulls = ReplaceNulls(Items=length, Replacements="0")  # -> Items, Count
mass_addition = MassAddition(Input=flatten(replace_nulls.Items))  # -> Result, PartialResults
