# Grasshopper definition Genetic_Algorythm_to_optimize_slab_with_air_heat_4_zones_hulls.gh (Grasshopper 1.0.7)

# Define Heat Origin
box_diagonal = Slider(16, range=0..500)
tube_frequency = Slider(14, range=0..500)
# Footprint
x_and_y_length = Slider(57, range=0..500)
box_x = Slider(8, range=0..500)
box_y = Slider(8, range=0..500)
construct_point = ConstructPoint(XCoordinate=box_diagonal, YCoordinate=box_y, ZCoordinate="0")
construct_point_2 = ConstructPoint(XCoordinate=box_x, YCoordinate=box_diagonal, ZCoordinate="0")
construct_point_3 = ConstructPoint(XCoordinate=box_diagonal, YCoordinate=box_diagonal, ZCoordinate="0")
rectangle = Rectangle(Plane=PlaneXY(0, 0, 0), XSize=x_and_y_length, YSize=x_and_y_length, Radius=0)  # -> Rectangle, Length
surface = Surface(rectangle.Rectangle)
divide_domain² = DivideDomain²(Domain=surface, UCount=tube_frequency, VCount=tube_frequency)
rectangle_3pt = Rectangle3Pt(PointA=construct_point_2, PointB=construct_point_3, PointC=construct_point)  # -> Rectangle, Length
multiplication = Multiplication(A=tube_frequency, B="4")
isotrim = Isotrim(Surface=surface, Domain=divide_domain²)
divide_curve = DivideCurve(Curve=rectangle.Rectangle, Count="4", Kinks=False)  # -> Points, Tangents, Parameters
divide_curve_2 = DivideCurve(Curve=rectangle.Rectangle, Count=multiplication, Kinks=False)  # -> Points, Tangents, Parameters
area = Area(Geometry=isotrim)  # -> Area, Centroid
divide_curve_3 = DivideCurve(Curve=rectangle_3pt.Rectangle, Count="4", Kinks=False)  # -> Points, Tangents, Parameters
# Gene Pool
gene_pool = GenePool(Decimals=0, Maximum=36, Minimum=1, Value=[20, 30, 36, 21])
multiplication_2 = Multiplication(A=tube_frequency, B=["4", "3", "2", "1"])
integer = Integer([multiplication_2, gene_pool])
sort_list = SortList(Keys=integer)  # -> Keys, ValuesValuesA
# Rays to Separate Zones
panel = Panel("7")
list_item = ListItem(List=sort_list.Keys, Index=panel, Wrap=True)
list_item_2 = ListItem(List=sort_list.Keys, Index="1", Wrap=True)
list_item_3 = ListItem(List=sort_list.Keys, Index="0", Wrap=True)
list_item_4 = ListItem(List=sort_list.Keys, Index="6", Wrap=True)
list_item_5 = ListItem(List=sort_list.Keys, Index="2", Wrap=True)
list_item_6 = ListItem(List=sort_list.Keys, Index="5", Wrap=True)
list_item_7 = ListItem(List=sort_list.Keys, Index="3", Wrap=True)
list_item_8 = ListItem(List=sort_list.Keys, Index="4", Wrap=True)
list_item_9 = ListItem(List=divide_curve_2.Points, Index=list_item, Wrap=True)
list_item_10 = ListItem(List=divide_curve_2.Points, Index=list_item_8, Wrap=True)
list_item_11 = ListItem(List=divide_curve_2.Points, Index=list_item_3, Wrap=True)
list_item_12 = ListItem(List=divide_curve_2.Points, Index=list_item_4, Wrap=True)
list_item_13 = ListItem(List=divide_curve_2.Points, Index=list_item_6, Wrap=True)
list_item_14 = ListItem(List=divide_curve_2.Points, Index=list_item_7, Wrap=True)
list_item_15 = ListItem(List=divide_curve_2.Points, Index=list_item_2, Wrap=True)
list_item_16 = ListItem(List=divide_curve_2.Points, Index=list_item_5, Wrap=True)
# Heat Origin
# Corners
list_item_17 = ListItem(List=divide_curve_3.Points, Index="0", Wrap=True)
list_item_18 = ListItem(List=divide_curve_3.Points, Index="1", Wrap=True)
list_item_19 = ListItem(List=divide_curve_3.Points, Index="2", Wrap=True)
list_item_20 = ListItem(List=divide_curve_3.Points, Index="3", Wrap=True)
# Zones
polyline = PolyLine(Vertices=[list_item_17, list_item_20, list_item_9, list_item_12, list_item_13], Closed="1")
polyline_2 = PolyLine(Vertices=[list_item_20, list_item_19, list_item_15, list_item_11, list_item_9], Closed="1")
polyline_3 = PolyLine(Vertices=[list_item_17, list_item_18, list_item_14, list_item_10, list_item_13], Closed="1")
polyline_4 = PolyLine(Vertices=[list_item_18, list_item_19, list_item_15, list_item_16, list_item_14], Closed="1")
point_in_curve = PointInCurve(Point=area.Centroid, Curve=polyline)  # -> Relationship, Point
point_in_curve_2 = PointInCurve(Point=area.Centroid, Curve=polyline_3)  # -> Relationship, Point
point_in_curve_3 = PointInCurve(Point=area.Centroid, Curve=polyline_2)  # -> Relationship, Point
point_in_curve_4 = PointInCurve(Point=area.Centroid, Curve=polyline_4)  # -> Relationship, Point
equality = Equality(FirstNumber=point_in_curve.Relationship, SecondNumber="2")  # -> Equality, Inequality
equality_2 = Equality(FirstNumber=point_in_curve_2.Relationship, SecondNumber="2")  # -> Equality, Inequality
equality_3 = Equality(FirstNumber=point_in_curve_3.Relationship, SecondNumber="2")  # -> Equality, Inequality
equality_4 = Equality(FirstNumber=point_in_curve_4.Relationship, SecondNumber="2")  # -> Equality, Inequality
# Points inside Each Zone
dispatch = Dispatch(List=point_in_curve.Point, DispatchPattern=equality.Inequality)  # -> ListA, ListB
dispatch_2 = Dispatch(List=point_in_curve_2.Point, DispatchPattern=equality_2.Inequality)  # -> ListA, ListB
dispatch_3 = Dispatch(List=point_in_curve_3.Point, DispatchPattern=equality_3.Inequality)  # -> ListA, ListB
dispatch_4 = Dispatch(List=point_in_curve_4.Point, DispatchPattern=equality_4.Inequality)  # -> ListA, ListB
point = Point(dispatch.ListB)
convex_hull = ConvexHull(Points=dispatch_3.ListB, Plane=dispatch_3.ListB)  # -> Hull, HullZ, Indices
convex_hull_2 = ConvexHull(Points=dispatch_4.ListB, Plane=dispatch_4.ListB)  # -> Hull, HullZ, Indices
convex_hull_3 = ConvexHull(Points=dispatch_2.ListB, Plane=dispatch_2.ListB)  # -> Hull, HullZ, Indices
convex_hull_4 = ConvexHull(Points=dispatch.ListB, Plane=dispatch.ListB)  # -> Hull, HullZ, Indices
list_item_21 = ListItem(List=convex_hull.Hull, Index=0, Wrap=True)
list_item_22 = ListItem(List=convex_hull_2.Hull, Index=0, Wrap=True)
list_item_23 = ListItem(List=convex_hull_3.Hull, Index=0, Wrap=True)
list_item_24 = ListItem(List=convex_hull_4.Hull, Index=0, Wrap=True)
curve = Curve(list_item_21)
curve_2 = Curve(list_item_22)
curve_3 = Curve(list_item_23)
curve_4 = Curve(list_item_24)
point_in_curve_5 = PointInCurve(Point=dispatch_3.ListB, Curve=curve)  # -> Relationship, Point
equality_5 = Equality(FirstNumber=point_in_curve_5.Relationship, SecondNumber=2)  # -> Equality, Inequality
dispatch_5 = Dispatch(List=point_in_curve_5.Point, DispatchPattern=equality_5.Inequality)  # -> ListA, ListB
point_in_curve_6 = PointInCurve(Point=dispatch_4.ListB, Curve=curve_2)  # -> Relationship, Point
equality_6 = Equality(FirstNumber=point_in_curve_6.Relationship, SecondNumber=2)  # -> Equality, Inequality
dispatch_6 = Dispatch(List=point_in_curve_6.Point, DispatchPattern=equality_6.Inequality)  # -> ListA, ListB
point_in_curve_7 = PointInCurve(Point=dispatch_2.ListB, Curve=curve_3)  # -> Relationship, Point
equality_7 = Equality(FirstNumber=point_in_curve_7.Relationship, SecondNumber=2)  # -> Equality, Inequality
dispatch_7 = Dispatch(List=point_in_curve_7.Point, DispatchPattern=equality_7.Inequality)  # -> ListA, ListB
point_in_curve_8 = PointInCurve(Point=dispatch.ListB, Curve=curve_4)  # -> Relationship, Point
equality_8 = Equality(FirstNumber=point_in_curve_8.Relationship, SecondNumber=2)  # -> Equality, Inequality
dispatch_8 = Dispatch(List=point_in_curve_8.Point, DispatchPattern=equality_8.Inequality)  # -> ListA, ListB
convex_hull_5 = ConvexHull(Points=dispatch_5.ListB, Plane=dispatch_5.ListB)  # -> Hull, HullZ, Indices
convex_hull_6 = ConvexHull(Points=dispatch_6.ListB, Plane=dispatch_6.ListB)  # -> Hull, HullZ, Indices
convex_hull_7 = ConvexHull(Points=dispatch_7.ListB, Plane=dispatch_7.ListB)  # -> Hull, HullZ, Indices
convex_hull_8 = ConvexHull(Points=dispatch_8.ListB, Plane=dispatch_8.ListB)  # -> Hull, HullZ, Indices
list_item_25 = ListItem(List=convex_hull_5.Hull, Index=0, Wrap=True)
list_item_26 = ListItem(List=convex_hull_6.Hull, Index=0, Wrap=True)
list_item_27 = ListItem(List=convex_hull_7.Hull, Index=0, Wrap=True)
list_item_28 = ListItem(List=convex_hull_8.Hull, Index=0, Wrap=True)
curve_5 = Curve(list_item_25)
curve_6 = Curve(list_item_26)
curve_7 = Curve(list_item_27)
curve_8 = Curve(list_item_28)
point_in_curve_9 = PointInCurve(Point=dispatch_5.ListB, Curve=curve_5)  # -> Relationship, Point
equality_9 = Equality(FirstNumber=point_in_curve_9.Relationship, SecondNumber=2)  # -> Equality, Inequality
dispatch_9 = Dispatch(List=point_in_curve_9.Point, DispatchPattern=equality_9.Inequality)  # -> ListA, ListB
point_in_curve_10 = PointInCurve(Point=dispatch_6.ListB, Curve=curve_6)  # -> Relationship, Point
equality_10 = Equality(FirstNumber=point_in_curve_10.Relationship, SecondNumber=2)  # -> Equality, Inequality
dispatch_10 = Dispatch(List=point_in_curve_10.Point, DispatchPattern=equality_10.Inequality)  # -> ListA, ListB
point_in_curve_11 = PointInCurve(Point=dispatch_7.ListB, Curve=curve_7)  # -> Relationship, Point
equality_11 = Equality(FirstNumber=point_in_curve_11.Relationship, SecondNumber=2)  # -> Equality, Inequality
dispatch_11 = Dispatch(List=point_in_curve_11.Point, DispatchPattern=equality_11.Inequality)  # -> ListA, ListB
point_in_curve_12 = PointInCurve(Point=dispatch_8.ListB, Curve=curve_8)  # -> Relationship, Point
equality_12 = Equality(FirstNumber=point_in_curve_12.Relationship, SecondNumber=2)  # -> Equality, Inequality
dispatch_12 = Dispatch(List=point_in_curve_12.Point, DispatchPattern=equality_12.Inequality)  # -> ListA, ListB
convex_hull_9 = ConvexHull(Points=dispatch_9.ListB, Plane=dispatch_9.ListB)  # -> Hull, HullZ, Indices
convex_hull_10 = ConvexHull(Points=dispatch_10.ListB, Plane=dispatch_10.ListB)  # -> Hull, HullZ, Indices
convex_hull_11 = ConvexHull(Points=dispatch_11.ListB, Plane=dispatch_11.ListB)  # -> Hull, HullZ, Indices
convex_hull_12 = ConvexHull(Points=dispatch_12.ListB, Plane=dispatch_12.ListB)  # -> Hull, HullZ, Indices
list_item_29 = ListItem(List=convex_hull_9.Hull, Index=0, Wrap=True)
list_item_30 = ListItem(List=convex_hull_10.Hull, Index=0, Wrap=True)
list_item_31 = ListItem(List=convex_hull_11.Hull, Index=0, Wrap=True)
list_item_32 = ListItem(List=convex_hull_12.Hull, Index=0, Wrap=True)
curve_9 = Curve([list_item_29, curve_5, curve])
curve_10 = Curve([list_item_30, curve_6, curve_2])
curve_11 = Curve([list_item_31, curve_7, curve_3])
curve_12 = Curve([list_item_32, curve_8, curve_4])
fillet = Fillet(Curve=curve_9, Radius="4")
fillet_2 = Fillet(Curve=curve_10, Radius="4")
fillet_3 = Fillet(Curve=curve_11, Radius="4")
fillet_4 = Fillet(Curve=curve_12, Radius="4")
length = Length(Curve=fillet)
length_2 = Length(Curve=fillet_2)
length_3 = Length(Curve=fillet_3)
length_4 = Length(Curve=fillet_4)
replace_nulls = ReplaceNulls(Items=length, Replacements="0")  # -> Items, Count
replace_nulls_2 = ReplaceNulls(Items=length_2, Replacements="0")  # -> Items, Count
replace_nulls_3 = ReplaceNulls(Items=length_3, Replacements="0")  # -> Items, Count
replace_nulls_4 = ReplaceNulls(Items=length_4, Replacements="0")  # -> Items, Count
lengthd = MassAddition(Input=flatten(replace_nulls.Items))  # -> Result, PartialResults
lengthc = MassAddition(Input=flatten(replace_nulls_2.Items))  # -> Result, PartialResults
leng_b = MassAddition(Input=flatten(replace_nulls_3.Items))  # -> flatten(Result), PartialResults
leng_a = MassAddition(Input=flatten(replace_nulls_4.Items))  # -> flatten(Result), PartialResults
integer_2 = Integer([leng_a.Result, leng_b.Result, lengthc.Result, lengthd.Result])
sort_list_2 = SortList(Keys=integer_2)  # -> Keys, ValuesA
min_len = ListItem(List=sort_list_2.Keys, Index=0, Wrap=True)
max_len = ListItem(List=sort_list_2.Keys, Index=-1, Wrap=True)
mass_addition = MassAddition(Input=flatten([leng_b.Result, leng_a.Result, lengthc.Result, lengthd.Result]))  # -> Result, PartialResults
expression = Expression(
    Leng_A=leng_a.Result,
    Leng_B=leng_b.Result,
    Leng_C=lengthc.Result,
    Leng_D=lengthd.Result,
    Max_Len=max_len,
    Min_Len=min_len,
    Expression="(Leng_A + Leng_B + Leng_C + Leng_D) + (3* (Max_Len - Min_Len))")
galapagos = Galapagos(fitness=expression, gene=gene_pool)
