# Grasshopper definition Genetic_Algorythm_to_optimize_slab_with_air_heat_4_zones_snake.gh (Grasshopper 1.0.7)
# plug-ins: ONLMapGraph

# Define Heat Origin
box_diagonal = Slider(20, range=0..500)
tube_frequency = Slider(9, range=0..50)
# Footprint
x_and_y_length = Slider(63, range=0..500)
box_x = Slider(12, range=0..500)
box_y = Slider(12, range=0..500)
construct_point = ConstructPoint(XCoordinate=box_diagonal, YCoordinate=box_y, ZCoordinate="0")
construct_point_2 = ConstructPoint(XCoordinate=box_x, YCoordinate=box_diagonal, ZCoordinate="0")
construct_point_3 = ConstructPoint(XCoordinate=box_diagonal, YCoordinate=box_diagonal, ZCoordinate="0")
rectangle = Rectangle(Plane=PlaneXY(0, 0, 0), XSize=x_and_y_length, YSize=x_and_y_length, Radius=0)  # -> Rectangle, Length
surface = Surface(rectangle.Rectangle)
divide_domain² = DivideDomain²(Domain=surface, UCount=tube_frequency, VCount=tube_frequency)
rectangle_3pt = Rectangle3Pt(PointA=construct_point_2, PointB=construct_point_3, PointC=construct_point)  # -> Rectangle, Length
multiplication = Multiplication(A=tube_frequency, B="4")
isotrim = Isotrim(Surface=surface, Domain=divide_domain²)
divide_curve = DivideCurve(Curve=rectangle.Rectangle, Count=multiplication, Kinks=False)  # -> Points, Tangents, Parameters
area = Area(Geometry=isotrim)  # -> Area, Centroid
divide_curve_2 = DivideCurve(Curve=rectangle_3pt.Rectangle, Count="4", Kinks=False)  # -> Points, Tangents, Parameters
# Gene Pool
gene_pool = GenePool(Decimals=0, Maximum=36, Minimum=1, Value=[24, 27, 20, 14])
multiplication_2 = Multiplication(A=tube_frequency, B=["4", "3", "2", "1"])
integer = Integer([multiplication_2, gene_pool])
sort_list = SortList(Keys=integer)  # -> Keys, ValuesValuesA
# Rays to Separate Zones
panel = Panel("7")
list_item = ListItem(List=sort_list.Keys, Index=panel, Wrap=True)
list_item_2 = ListItem(List=sort_list.Keys, Index="1", Wrap=True)
list_item_3 = ListItem(List=sort_list.Keys, Index="0", Wrap=True)
list_item_4 = ListItem(List=sort_list.Keys, Index="6", Wrap=True)
list_item_5 = ListItem(List=sort_list.Keys, Index="2", Wrap=True)
list_item_6 = ListItem(List=sort_list.Keys, Index="5", Wrap=True)
list_item_7 = ListItem(List=sort_list.Keys, Index="3", Wrap=True)
list_item_8 = ListItem(List=sort_list.Keys, Index="4", Wrap=True)
list_item_9 = ListItem(List=divide_curve.Points, Index=list_item, Wrap=True)
list_item_10 = ListItem(List=divide_curve.Points, Index=list_item_8, Wrap=True)
list_item_11 = ListItem(List=divide_curve.Points, Index=list_item_3, Wrap=True)
list_item_12 = ListItem(List=divide_curve.Points, Index=list_item_4, Wrap=True)
list_item_13 = ListItem(List=divide_curve.Points, Index=list_item_6, Wrap=True)
list_item_14 = ListItem(List=divide_curve.Points, Index=list_item_7, Wrap=True)
list_item_15 = ListItem(List=divide_curve.Points, Index=list_item_2, Wrap=True)
list_item_16 = ListItem(List=divide_curve.Points, Index=list_item_5, Wrap=True)
list_item_17 = ListItem(List=divide_curve_2.Points, Index="1", Wrap=True)
list_item_18 = ListItem(List=divide_curve_2.Points, Index="2", Wrap=True)
list_item_19 = ListItem(List=divide_curve_2.Points, Index="3", Wrap=True)
# Heat Origin
# Corners
list_item_20 = ListItem(List=divide_curve_2.Points, Index="0", Wrap=True)
# Zones
polyline = PolyLine(Vertices=[list_item_20, list_item_19, list_item_9, list_item_12, list_item_13], Closed="1")
polyline_2 = PolyLine(Vertices=[list_item_19, list_item_18, list_item_15, list_item_11, list_item_9], Closed="1")
polyline_3 = PolyLine(Vertices=[list_item_17, list_item_18, list_item_15, list_item_16, list_item_14], Closed="1")
polyline_4 = PolyLine(Vertices=[list_item_20, list_item_17, list_item_14, list_item_10, list_item_13], Closed="1")
point_in_curve = PointInCurve(Point=area.Centroid, Curve=polyline)  # -> Relationship, Point
point_in_curve_2 = PointInCurve(Point=area.Centroid, Curve=polyline_4)  # -> Relationship, Point
point_in_curve_3 = PointInCurve(Point=area.Centroid, Curve=polyline_2)  # -> Relationship, Point
point_in_curve_4 = PointInCurve(Point=area.Centroid, Curve=polyline_3)  # -> Relationship, Point
equality = Equality(FirstNumber=point_in_curve.Relationship, SecondNumber="2")  # -> Equality, Inequality
equality_2 = Equality(FirstNumber=point_in_curve_2.Relationship, SecondNumber="2")  # -> Equality, Inequality
equality_3 = Equality(FirstNumber=point_in_curve_3.Relationship, SecondNumber="2")  # -> Equality, Inequality
equality_4 = Equality(FirstNumber=point_in_curve_4.Relationship, SecondNumber="2")  # -> Equality, Inequality
# Points inside Each Zone
dispatch = Dispatch(List=point_in_curve.Point, DispatchPattern=equality.Inequality)  # -> ListA, ListB
dispatch_2 = Dispatch(List=point_in_curve_2.Point, DispatchPattern=equality_2.Inequality)  # -> ListA, ListB
dispatch_3 = Dispatch(List=point_in_curve_3.Point, DispatchPattern=equality_3.Inequality)  # -> ListA, ListB
dispatch_4 = Dispatch(List=point_in_curve_4.Point, DispatchPattern=equality_4.Inequality)  # -> ListA, ListB
point = Point([list_item_19, dispatch.ListB, list_item_20])
point_2 = Point([list_item_20, dispatch_2.ListB, list_item_17])
point_3 = Point([list_item_18, dispatch_3.ListB, list_item_19])
point_4 = Point([list_item_17, dispatch_4.ListB, list_item_18])
complete_graph = CompleteGraph(Ps=point_4)  # -> G, As, Ns
complete_graph_2 = CompleteGraph(Ps=point_2)  # -> G, As, Ns
complete_graph_3 = CompleteGraph(Ps=point_3)  # -> G, As, Ns
# Change ordering of points for the shortest line connecting them.
complete_graph_4 = CompleteGraph(Ps=point)  # -> G, As, Ns
travelling_salesman_problem_solver = TravellingSalesmanProblemSolver(MarshallingSignalParameter=complete_graph.G, MarshallingSignalParameter_2=complete_graph.Ns)  # -> C, T
travelling_salesman_problem_solver_2 = TravellingSalesmanProblemSolver(MarshallingSignalParameter=complete_graph_2.G, MarshallingSignalParameter_2=complete_graph_2.Ns)  # -> C, T
travelling_salesman_problem_solver_3 = TravellingSalesmanProblemSolver(MarshallingSignalParameter=complete_graph_3.G, MarshallingSignalParameter_2=complete_graph_3.Ns)  # -> C, T
travelling_salesman_problem_solver_4 = TravellingSalesmanProblemSolver(MarshallingSignalParameter=complete_graph_4.G, MarshallingSignalParameter_2=complete_graph_4.Ns)  # -> C, T
node_to_point = NodeToPoint(MarshallingSignalParameter=complete_graph.G, MarshallingSignalParameter_2=travelling_salesman_problem_solver.T)
node_to_point_2 = NodeToPoint(MarshallingSignalParameter=complete_graph_2.G, MarshallingSignalParameter_2=travelling_salesman_problem_solver_2.T)
node_to_point_3 = NodeToPoint(MarshallingSignalParameter=complete_graph_3.G, MarshallingSignalParameter_2=travelling_salesman_problem_solver_3.T)
node_to_point_4 = NodeToPoint(MarshallingSignalParameter=complete_graph_4.G, MarshallingSignalParameter_2=travelling_salesman_problem_solver_4.T)
point_5 = Point(node_to_point)
point_6 = Point(node_to_point_2)
point_7 = Point(node_to_point_3)
point_8 = Point(node_to_point_4)
polyline_5 = PolyLine(Vertices=point_5, Closed=False)
polyline_6 = PolyLine(Vertices=point_6, Closed=False)
polyline_7 = PolyLine(Vertices=point_7, Closed=False)
polyline_8 = PolyLine(Vertices=point_8, Closed=False)
fillet = Fillet(Curve=polyline_7, Radius="4")
fillet_2 = Fillet(Curve=polyline_5, Radius="4")
fillet_3 = Fillet(Curve=polyline_6, Radius="4")
fillet_4 = Fillet(Curve=polyline_8, Radius="4")
length = Length(Curve=fillet)
length_2 = Length(Curve=fillet_2)
length_3 = Length(Curve=fillet_3)
length_4 = Length(Curve=fillet_4)
replace_nulls = ReplaceNulls(Items=length, Replacements="0")  # -> Items, Count
replace_nulls_2 = ReplaceNulls(Items=length_2, Replacements="0")  # -> Items, Count
replace_nulls_3 = ReplaceNulls(Items=length_3, Replacements="0")  # -> Items, Count
replace_nulls_4 = ReplaceNulls(Items=length_4, Replacements="0")  # -> Items, Count
lengthd = MassAddition(Input=flatten(replace_nulls.Items))  # -> Result, PartialResults
lengthc = MassAddition(Input=flatten(replace_nulls_2.Items))  # -> Result, PartialResults
leng_b = MassAddition(Input=flatten(replace_nulls_3.Items))  # -> flatten(Result), PartialResults
leng_a = MassAddition(Input=flatten(replace_nulls_4.Items))  # -> flatten(Result), PartialResults
integer_2 = Integer([leng_a.Result, leng_b.Result, lengthc.Result, lengthd.Result])
sort_list_2 = SortList(Keys=integer_2)  # -> Keys, ValuesValuesA
min_len = ListItem(List=sort_list_2.Keys, Index=0, Wrap=True)
max_len = ListItem(List=sort_list_2.Keys, Index=-1, Wrap=True)
mass_addition = MassAddition(Input=flatten([leng_b.Result, leng_a.Result, lengthc.Result, lengthd.Result]))  # -> Result, PartialResults
expression = Expression(
    Leng_A=leng_a.Result,
    Leng_B=leng_b.Result,
    Leng_C=lengthc.Result,
    Leng_D=lengthd.Result,
    Max_Len=max_len,
    Min_Len=min_len,
    Expression="(Leng_A + Leng_B + Leng_C + Leng_D) + (3* (Max_Len - Min_Len))")
galapagos = Galapagos(fitness=expression, gene=gene_pool)
