# Grasshopper definition Genetic_Algorythm_to_optimize_slab_with_air_heat_random_points.gh (Grasshopper 1.0.7)

number_slider = Slider(15, range=0..500)
number_slider_2 = Slider(55, range=0..500)
number_slider_3 = Slider(9, range=0..500)
number_slider_4 = Slider(15, range=0..500)
construct_point = ConstructPoint(XCoordinate=number_slider, YCoordinate=Slider(8, range=0..500), ZCoordinate="0")
construct_point_2 = ConstructPoint(XCoordinate=number_slider, YCoordinate=number_slider, ZCoordinate="0")
rectangle = Rectangle(Plane=PlaneXY(0, 0, 0), XSize=number_slider_2, YSize=number_slider_2, Radius=0)  # -> Rectangle, Length
construct_point_3 = ConstructPoint(XCoordinate=Slider(8, range=0..500), YCoordinate=number_slider, ZCoordinate="0")
surface = Surface(rectangle.Rectangle)
divide_domain² = DivideDomain²(Domain=surface, UCount=number_slider_3, VCount=number_slider_3)
number_slider_5 = Slider(5, range=0..500)
number_slider_6 = Slider(0, range=0..500)
number_slider_7 = Slider(223, range=0..500)
rectangle_3pt = Rectangle3Pt(PointA=construct_point_3, PointB=construct_point_2, PointC=construct_point)  # -> Rectangle, Length
number_slider_8 = Slider(49, range=-500..500)
number_slider_9 = Slider(1, range=0..500)
isotrim = Isotrim(Surface=surface, Domain=divide_domain²)
divide_curve = DivideCurve(Curve=rectangle_3pt.Rectangle, Count=Slider(16, range=0..500), Kinks=False)  # -> Points, Tangents, Parameters
area = Area(Geometry=isotrim)  # -> Area, Centroid
shift_list = ShiftList(List=divide_curve.Points, Shift=1, Wrap=True)
number_slider_10 = Slider(14, range=0..500)
cull_nth = CullNth(List=shift_list, CullFrequency=Slider(2, range=0..500))
partition_list = PartitionList(List=area.Centroid, Size=number_slider_3)
list_item = ListItem(List=cull_nth, Index=Slider(1, range=0..500), Wrap=True)
list_item_2 = ListItem(List=cull_nth, Index=Slider(2, range=0..500), Wrap=True)
line = Line(StartPoint=list_item, EndPoint=list_item_2)
divide_curve_2 = DivideCurve(Curve=line, Count="10", Kinks=False)  # -> Points, Tangents, Parameters
gene_pool = GenePool(
    Decimals=0,
    Maximum=10,
    Minimum=-40,
    Value=[-26, -14, -12, -5, -25, -3, -3, 1, -26, -18, -30, -17, -25, -19, -21, -17, -20, -3])
cull_index = CullIndex(List=divide_curve_2.Points, Indices=["0", "-1"], Wrap="1")
split_list = SplitList(List=gene_pool, Index="9")  # -> ListA, ListB
unit_y = UnitY(Factor=1)
unit_x = UnitX(Factor=1)
multiplication = Multiplication(A=split_list.ListB, B="-1")
multiplication_2 = Multiplication(A=split_list.ListA, B=unit_x)
multiplication_3 = Multiplication(A=multiplication, B=unit_y)
vector_2pt = Vector2Pt(PointA=multiplication_2, PointB=multiplication_3, Unitize="0")  # -> Vector, Length
vector = Vector(vector_2pt.Vector)
move = Move(Geometry=cull_index, Motion=vector)  # -> Geometry, Transform
insert_items = InsertItems(List=move.Geometry, Item=list_item, Indices="0", Wrap=True)
insert_items_2 = InsertItems(List=insert_items, Item=list_item_2, Indices="-1", Wrap=True)  # -> flatten(List)
interpolate = Interpolate(Vertices=insert_items_2, Degree=3, Periodic=False, KnotStyle=1)  # -> Curve, Length, Domain
brep_curve = BrepCurve(Brep=isotrim, Curve=interpolate.Curve)  # -> Curves, Points
pipe = Pipe(Curve=interpolate.Curve, Radius="1", Caps=0)
clash = Clash(FirstSet=pipe, SecondSet=isotrim, Distance=0, ResultLimit=100)  # -> ClashCount, ClashPoints, ClashRadii, FirstIndex, SecondIndex
curve_self = CurveSelf(Curve=interpolate.Curve)  # -> Points, Params
curve = Curve(brep_curve.Curves)
point = Point(brep_curve.Points)
list_item_3 = ListItem(List=isotrim, Index=clash.SecondIndex, Wrap=True)
list_length = ListLength(List=curve_self.Points)
list_length_2 = ListLength(List=clash.SecondIndex)
panel = Panel(list_length)
panel_2 = Panel(list_length_2)
panel_3 = Panel(interpolate.Length)
galapagos = Galapagos(fitness=list_item_3, gene=gene_pool)
