# Grasshopper definition Duda_2020Feb27a.gh (Grasshopper 1.0.7)
# plug-ins: Anemone

crv_l3 = Curve(<curve referenced from the Rhino model>)
crv_l1 = Curve(<curve referenced from the Rhino model>)

explode = Explode(Curve=crv_l3, Recursive=True)  # -> Segments, Vertices
reverse_list = ReverseList(List=explode.Vertices)
polyline = PolyLine(Vertices=reverse_list, Closed=False)
circle_leg_radius = Slider(290.511, range=0..500)
filet_radius = Slider(109.836, range=0..500)
entwine = Entwine(Branch00=crv_l1, Branch01=polyline, FlattenInputs=True)  # -> flatten(Result)
end = EndPoints(Curve=crv_l1)  # -> Start, End
point = Point(end.Start)
loop_start = LoopStart(N="1", T=[Button(), circle_leg_radius], D0=end.Start, D1=entwine)  # -> port, Counter, Data, Data_2
item = ListItem(List=loop_start.Data, Index=0, Wrap=True)
cir = Circle(Plane=item, Radius=circle_leg_radius)
rev = ReverseList(List=loop_start.Data_2)
item_2 = ListItem(List=rev, Index=0, Wrap=True)
ccx = CurveCurve(CurveA=item_2, CurveB=cir)  # -> Points, ParamsA, ParamsB
sort = SortList(Keys=ccx.ParamsA, ValuesA=ccx.Points)  # -> Keys, ValuesA
item_3 = ListItem(List=ccx.Points, Index=0, Wrap=True)
mindex = MemberIndex(Set=loop_start.Data, Member=item_3)  # -> Index, Count
ins = InsertItems(List=loop_start.Data, Item=item_3, Indices="0", Wrap=True)
equals = Equality(FirstNumber=mindex.Count, SecondNumber=0)  # -> Equality, Inequality
loop_end = LoopEnd(
    port=loop_start.port,
    Exit=equals.Inequality,
    Data=ins,
    Data_2=rev,
    TimeOutVal=0,
    pausedState=False,
    state="Constant output")  # -> D0, D1
cullpt = CullDuplicates(Points=loop_end.D0, Tolerance=0.1, CullMode=3)  # -> reverse(Points), Indices, Valence
pline = PolyLine(Vertices=cullpt.Points, Closed=False)
fillet = Fillet(Curve=pline, Radius=filet_radius)
