# Grasshopper definition attractors.gh (Grasshopper 1.0.7)

number_slider = Slider(0.25, range=0..1)
number_slider_2 = Slider(4.842, range=0..20)
curve = Curve(<curve referenced from the Rhino model>)
radians = Radians(Degrees=Slider(64, range=0..1000))
vector = Vector()
unit_z = UnitZ(Factor=Slider(17.162, range=0..20))
arc = Arc(Plane=PlaneXY(0, 0, 0), Radius=1, Angle=radians)  # -> Arc, Length
circular_arc = CircularArc(arc.Arc)
point_charge = PointCharge(Point=<geometry referenced from the Rhino model>, Charge=Slider(-832, range=-1000..1000), Decay=2)
bend_deform = BendDeform(Geometry=curve, BendingArc=circular_arc)  # disabled
point_deform = PointDeform(Geometry=curve, Points=Point(305.7056952, -1.273048975, 0), Motion=unit_z)  # disabled
field_line = FieldLine(Field=point_charge, Point=<geometry referenced from the Rhino model>, Steps=1000, Accuracy=0.1, Method=3)
