# Grasshopper definition bounce_in_boundary.gh (Grasshopper 1.0.7)

point = Point(<point referenced from the Rhino model>)
point_2 = Point(<point referenced from the Rhino model>)
surface = Surface(<surface referenced from the Rhino model>)
width = Slider(435.663, range=0..10000)
height = Slider(8964.028, range=0..10000)
vector_2pt = Vector2Pt(PointA=point, PointB=point_2, Unitize=False)  # -> Vector, Length
trigger = Trigger(Interval=10, TimerInterval=10, Target=c_script)  # disabled
c_script = CSharpScript(reset=Button(), startPoint=point, startVelocity=vector_2pt.Vector, bounds=surface)  # -> out, R, P, Trace; inputs reset: Boolean, startPoint: Point3d, startVelocity: Vector3d, bounds: Brep, tolerance: Double
# ---------- c_script: C# ----------
    
    if (reset){
      location = startPoint;
      boundaryBrep = bounds;
      currentVelocity = startVelocity;
      traceLine = new Polyline();
      return;
    }


    // Update location of moving point with velocity
    location += currentVelocity;

    double d = double.MaxValue;
    double t = (tolerance == 0) ? doc.ModelAbsoluteTolerance : tolerance;

    //Check if we're still in bounds
    foreach(BrepFace f in bounds.Faces)
    {
      // short version:
      double dist = f.DuplicateFace(false).ClosestPoint(location).DistanceTo(location);

      if(dist < d)
        d = dist;
    }


    if(d > t){
      // We went outside the bounds

      // Check where to go next.  We can change X or Y to get back in (unless we went out a corner).

      // Try X first
      // update temp location to the next step
      double tempD = double.MaxValue;
      Point3d tempLocation = location;
      Vector3d tempVelocity = currentVelocity;

      tempVelocity.X = -tempVelocity.X;
      tempLocation += tempVelocity;

      foreach(BrepFace f in bounds.Faces)
      {
        double tempDist = f.DuplicateFace(false).ClosestPoint(tempLocation).DistanceTo(tempLocation);

        if(tempDist < tempD)
          tempD = tempDist;
      }

      if(tempD <= t){
        // We're back in. So use X
        currentVelocity.X = -currentVelocity.X;

      }
      else{

        // Still out.  Try changing Y.
        tempD = double.MaxValue;
        tempLocation = location;
        tempVelocity = currentVelocity;

        tempVelocity.Y = -tempVelocity.Y;
        tempLocation += tempVelocity;

        foreach(BrepFace f in bounds.Faces)
        {
          double tempDist = f.DuplicateFace(false).ClosestPoint(tempLocation).DistanceTo(tempLocation);

          if(tempDist < tempD)
            tempD = tempDist;
        }

        if(tempD <= t){
          currentVelocity.Y = -currentVelocity.Y;
        }
        else {
          // We're oddly out of a corner or something.
          // We escaped.  No change in velocity.
        }

      }


    }


    // Add current location to the footprint ployline
    traceLine.Add(location);



    //Output
    R = bounds;
    P = location;
    Trace = traceLine;
# ---------- c_script: C# additional code ----------
  Point3d location = Point3d.Unset;
  Brep boundaryBrep;
  Vector3d currentVelocity = Vector3d.Unset;
  Polyline traceLine = new Polyline();
# ---------- end c_script ----------
panel = Panel(c_script.out)
panel_2 = Panel(c_script.R)
fillet = Fillet(Curve=c_script.Trace, Radius=width)
