# Grasshopper definition hit_boundary.gh (Grasshopper 1.0.7)

max_wave_edge_length = Slider(355, range=0..2000)
wave_travel_step_size = Slider(5, range=0..200)
wave_angle = Slider(34.412, range=0..90)
reset = Button()
# Start Point
wave_radius = Slider(45.734, range=0..300)
tolerance = Slider(0.992, range=0..100)
point = Point(<point referenced from the Rhino model>)
# Filet the corners of the border brep curves first
surface = Surface(<surface referenced from the Rhino model>)
tolerance_2 = Slider(77.172, range=0..100)
deconstruct = Deconstruct(Point=point)  # -> XComponent, YComponent, ZComponent
trigger = Trigger(Interval=200, TimerInterval=200, Target=c_script)  # disabled
edges_from_faces = EdgesFromFaces(Brep=surface)  # -> Edges, Indices; disabled
edges_from_linearity = EdgesFromLinearity(Brep=surface, Minimum=0, Maximum=1)  # -> Edges, Indices; disabled
subtraction = Subtraction(A=deconstruct.YComponent, B=wave_travel_step_size)
construct_point = ConstructPoint(XCoordinate=deconstruct.XComponent, YCoordinate=subtraction, ZCoordinate=deconstruct.ZComponent)
curve = Curve(edges_from_linearity.Edges)
unit_z = UnitZ(Factor=1)
radians = Radians(Degrees=wave_angle)
curve_2 = Curve(<curve referenced from the Rhino model>)
vector_2pt = Vector2Pt(PointA=point, PointB=construct_point, Unitize=False)  # -> Vector, Length
curve_3 = Curve(<curve referenced from the Rhino model>)
rotate = Rotate(Vector=vector_2pt.Vector, Axis=unit_z, Angle=radians)
fit_curve = FitCurve(Curve=[curve_3, curve_2])  # disabled
offset_curve = OffsetCurve(Curve=[curve_2, curve_3], Distance=tolerance_2, Corners=1)  # disabled
c_script = CSharpScript(
    reset=reset,
    startPoint=point,
    startVelocity=rotate,
    bounds=surface,
    tolerance=tolerance,
    maxEdgeLength=max_wave_edge_length)  # -> out, R, P, Trace; inputs reset: Boolean, startPoint: Point3d, startVelocity: Vector3d, bounds: Brep, tolerance: Double, maxEdgeLength: Double
# ---------- c_script: C# usings ----------
using Rhino.Geometry.Intersect;
using Rhino.Input;
using Rhino.Input.Custom;
using Rhino.DocObjects;
# ---------- c_script: C# ----------
    if (reset){
      location = startPoint;
      //boundaryBrep = bounds;
      smallStepVelocity = startVelocity;
      traceLine = new Polyline();
      //return;
    }


    double t = (tolerance == 0) ? doc.ModelAbsoluteTolerance : tolerance;
    bigStepVelocity = smallStepVelocity * 50; // Very big step

    // Make a line of Max edge length from current velocity and location
    LineCurve edgeFinder = new LineCurve(location, location + bigStepVelocity);

    Curve[] overlap_curves;
    Point3d[] inter_points;
    Point3d first_intersection = location; // Just setting it to something.

    Intersection.CurveBrep(edgeFinder, bounds, t, out overlap_curves, out inter_points);

    if (overlap_curves.Length > 0)
    {
      // grab all the points resulting from the intersection.

      double shortDist = double.MaxValue;

      first_intersection = overlap_curves[0].PointAtEnd;

      foreach(Curve c in overlap_curves)
      {
        double tempDist = c.PointAtEnd.DistanceTo(location);

        if(tempDist < shortDist){
          first_intersection = c.PointAtEnd; // set as first if closer

        }
      }

      location = first_intersection;  // Assign our winner
    }


    // optionally some results could be in the variable below
    //if (overlap_curves.Length > 0){}



    // If we didn't hit the bounds, then just continue.  This would be very rare.
    if (inter_points.Length == 0 && overlap_curves.Length == 0){
      // Update location of moving point with the bigStepVelocity
      location += bigStepVelocity;
    }

    // If we're now at the boundary, check which way to go next
    // by trying a short step in a different direction and see if we're still in.
    // Then in the next iteration we'll try another big step.
    if (inter_points.Length > 0 || overlap_curves.Length > 0){

      // Check where to go next.  We can change X or Y to get back in (unless we went out a corner).

      // Try X first
      // update temp location to the next small step
      double tempD = double.MaxValue;
      Point3d tempLocation = location;
      Vector3d tempVelocity = smallStepVelocity;

      tempVelocity.X = -tempVelocity.X;
      tempLocation += tempVelocity;

      foreach(BrepFace f in bounds.Faces)
      {
        double tempDist = f.DuplicateFace(false).ClosestPoint(tempLocation).DistanceTo(tempLocation);

        if(tempDist < tempD)
          tempD = tempDist;
      }

      if(tempD <= t){
        // We're back in within tolerance. So use X
        smallStepVelocity.X = -smallStepVelocity.X;

      }
      else{

        // Still out.  Try changing Y.
        double tempD2 = double.MaxValue;
        tempLocation = location;
        tempVelocity = smallStepVelocity;

        tempVelocity.Y = -tempVelocity.Y;
        tempLocation += tempVelocity;

        foreach(BrepFace f in bounds.Faces)
        {
          double tempDist = f.DuplicateFace(false).ClosestPoint(tempLocation).DistanceTo(tempLocation);

          if(tempDist < tempD2)
            tempD2 = tempDist;
        }

        if(tempD2 <= t){
          // We're back in within tolerance so use Y direction
          smallStepVelocity.Y = -smallStepVelocity.Y;
        }
        else {
          // We're oddly in a corner or something.
          // We escaped.  No change in velocity.
        }

      }

    }



    // Add current location to the footprint ployline
    traceLine.Add(location);


    //Output
    R = bounds;
    P = location;
    Trace = traceLine;
# ---------- c_script: C# additional code ----------
  Point3d location = Point3d.Unset;
  // Brep boundaryBrep;
  Vector3d smallStepVelocity = Vector3d.Unset;
  Vector3d bigStepVelocity = Vector3d.Unset;
  Polyline traceLine = new Polyline();

  //Return a BoundingBox that contains all the geometry you are about to draw.
  public override BoundingBox ClippingBox
  {
    get
    {
      return BoundingBox.Empty;
    }
  }

  //Draw all meshes in this method.
  public override void DrawViewportMeshes(IGH_PreviewArgs args)
  {
  }

  //Draw all wires and points in this method.
  public override void DrawViewportWires(IGH_PreviewArgs args)
  {
  }
# ---------- end c_script ----------
panel = Panel(c_script.R)
panel_2 = Panel(c_script.out)
curve_4 = Curve(c_script.Trace)
# Break in to larger sections before filet
simplify_curve = SimplifyCurve(Curve=curve_4)  # -> Curve, Simplified
fillet = Fillet(Curve=simplify_curve.Curve, Radius=wave_radius)
