# Grasshopper definition pull curve_v2.gh (Grasshopper 1.0.5)

number_slider = Slider(4, range=0..10)
number_slider_2 = Slider(2, range=0..10)
circle = Circle(Plane=PlaneXY(0, 0, 0), Radius=Slider(20, range=0..100))
series = Series(Start=number_slider, Step=number_slider, Count=Slider(8, range=0..10))
list_length = ListLength(List=series)
series_2 = Series(Start=number_slider_2, Step=number_slider_2, Count=list_length)
unit_z = UnitZ(Factor=series_2)
offset_curve = OffsetCurve(Curve=circle, Distance=series, Plane=PlaneXY(0, 0, 0), Corners=1)  # -> flatten(Curve)
move = Move(Geometry=offset_curve, Motion=unit_z)  # -> Geometry, Transform
dispatch = Dispatch(List=move.Geometry, DispatchPattern=[True, False])  # -> ListA, ListB
number_slider_3 = Slider(3, range=0..10)
division = Division(A="180", B=number_slider_3)
radians = Radians(Degrees=division)
rotate = Rotate(Geometry=dispatch.ListB, Angle=radians, Plane=PlaneXY(0, 0, 0))  # -> Geometry, Transform
radians_2 = Radians(Degrees="10")

divide_curve = DivideCurve(Curve=rotate.Geometry, Count=number_slider_3, Kinks=False)  # -> Points, Tangents, Parameters
rotate_2 = Rotate(Geometry=divide_curve.Points, Angle=radians_2, Plane=PlaneXY(0, 0, 0))  # -> Geometry, Transform

divide_curve_2 = DivideCurve(Curve=dispatch.ListA, Count=number_slider_3, Kinks=False)  # -> Points, Tangents, Parameters
rotate_3 = Rotate(Geometry=divide_curve_2.Points, Angle=radians_2, Plane=PlaneXY(0, 0, 0))  # -> Geometry, Transform

simplify = SimplifyTree(Tree=divide_curve_2.Points, Front=False)
simplify_2 = SimplifyTree(Tree=rotate_3.Geometry, Front=False)
simplify_3 = SimplifyTree(Tree=divide_curve.Points, Front=False)
simplify_4 = SimplifyTree(Tree=rotate_2.Geometry, Front=False)
merge = Merge(Data1=simplify_3, Data2=simplify_4)
merge_2 = Merge(Data1=simplify, Data2=simplify_2)
path_mapper = PathMapper(merge_2, source="{A}", target="{2*A}")
path_mapper_2 = PathMapper(merge, source="{A}", target="{2*A+1}")
merge_3 = Merge(Data1=path_mapper, Data2=path_mapper_2)
tstat = TreeStatistics(Tree=merge_3)  # -> Paths, Length, Count
subtraction = Subtraction(A=tstat.Count, B="1")
series_3 = Series(Start=0, Step=1, Count=subtraction)
addition = Addition(A=series_3, B="1")
panel = Panel(series_3)
panel_2 = Panel(addition)
branch = TreeBranch(Tree=merge_3, Path=panel_2, MaintainPaths=False)
branch_2 = TreeBranch(Tree=merge_3, Path=panel, MaintainPaths=False)
merge_4 = Merge(Data1=branch_2, Data2=branch)
alongcrv = SortAlongCurve(Points=merge_4, Curve=circle)  # -> Points, Indices
intcrv = Interpolate(Vertices=alongcrv.Points, Degree=3, Periodic=Toggle(True), KnotStyle=1)  # -> Curve, Length, Domain
