# Grasshopper definition zigzag curve.gh (Grasshopper 1.0.7)

A = Curve(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)
B = Curve(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)
flip = FlipCurve(Curve=A)  # -> Curve, Flag
flip_2 = FlipCurve(Curve=B)  # -> Curve, Flag
explode = Explode(Curve=flip_2.Curve, Recursive=True)  # -> Segments, Vertices
item = ListItem(List=explode.Segments, Index=0, Wrap=True)  # -> Item, Item1
cluster = Cluster(crv=flip.Curve, crv_2=item.Item, crv_3=item.Item1, L=Slider(8.36, range=0..20))
join = JoinCurves(Curves=flatten(cluster), Preserve=False)
explode_2 = Explode(Curve=join, Recursive=True)  # -> Segments, Vertices
len = Length(Curve=explode_2.Segments)
panel = Panel(len)

# ==== cluster Cluster
crv = ClusterInput()
crv_2 = ClusterInput()
crv_3 = ClusterInput()
crv_4 = Curve(crv)
crv_5 = Curve(crv_2)
crv_6 = Curve(crv_3)
L = ClusterInput()
eval = EvaluateLength(Curve=crv_5, Length=L, Normalized=invert(True))  # -> Point, Tangent, Parameter
end = EndPoints(Curve=crv_4)  # -> Start, End
ln = Line(StartPoint=end.Start, EndPoint=eval.Point)
series = Series(Start=1, Step=2, Count=10)
dist = Distance(PointA=end.Start, PointB=eval.Point)
B = Angle(VectorA=crv_4, VectorB=ln)  # -> Angle, Reflex
A = Angle(VectorA=crv_4, VectorB=crv_5)  # -> Angle, Reflex
series_2 = Series(Start=0, Step=2, Count=10)
dist_2 = Distance(PointA=end.Start, PointB=eval.Point)
expression = Expression(x=A.Angle, y=series, z=B.Angle, u=dist, Expression="cos((x*y)+z)*u*2")
expression_2 = Expression(x=A.Angle, y=series_2, z=B.Angle, u=dist_2, Expression="cos((x*y)+z)*u*2")
num = Number(expression)
num_2 = Number(expression_2)
larger = LargerThan(FirstNumber=num_2, SecondNumber=0)  # -> LargerThan, OrEqualTo
larger_2 = LargerThan(FirstNumber=num, SecondNumber=0)  # -> LargerThan, OrEqualTo
dispatch = Dispatch(List=num_2, DispatchPattern=larger.LargerThan)  # -> ListA, ListB
dispatch_2 = Dispatch(List=num, DispatchPattern=larger_2.LargerThan)  # -> ListA, ListB
item = ListItem(List=dispatch.ListB, Index=0, Wrap=True)
item_2 = ListItem(List=dispatch_2.ListB, Index=0, Wrap=True)
index = ItemIndex(List=num, Item=item_2)
index_2 = ItemIndex(List=num_2, Item=item)
split = SplitList(List=num, Index=index)  # -> ListA, ListB
split_2 = SplitList(List=num_2, Index=index_2)  # -> ListA, ListB
ma = MassAddition(Input=split.ListA)  # -> Result, PartialResults
ma_2 = MassAddition(Input=split_2.ListA)  # -> Result, PartialResults
amp = Amplitude(Vector=unitize(crv_4), Amplitude=ma_2.PartialResults)
amp_2 = Amplitude(Vector=unitize(crv_5), Amplitude=ma.PartialResults)
move = Move(Geometry=end.Start, Motion=amp)  # -> Geometry, Transform
move_2 = Move(Geometry=eval.Point, Motion=amp_2)  # -> Geometry, Transform
crv_cp = CurveClosestPoint(Point=move_2.Geometry, Curve=crv_5)  # -> Point, Parameter, expr("Round(x,1)", Distance)
crv_cp_2 = CurveClosestPoint(Point=move.Geometry, Curve=crv_4)  # -> Point, Parameter, expr("Round(x,1)", Distance)
similar = Similarity(FirstNumber=crv_cp.Distance, SecondNumber=0, Threshold=0.1)  # -> Similarity, AbsoluteDifference
similar_2 = Similarity(FirstNumber=crv_cp_2.Distance, SecondNumber=0, Threshold=0.1)  # -> Similarity, AbsoluteDifference
cull = CullPattern(List=move_2.Geometry, CullPattern=similar.Similarity)
cull_2 = CullPattern(List=move.Geometry, CullPattern=similar_2.Similarity)
merge = Merge(Data1=end.Start, Data2=cull_2)  # -> flatten(Result)
merge_2 = Merge(Data1=eval.Point, Data2=cull)  # -> flatten(Result)
lng = ListLength(List=merge_2)
series_3 = Series(Start=0, Step=1, Count=expr("x+1", lng))
item_3 = ListItem(List=merge, Index=series_3, Wrap=True)
entwine = Entwine(Branch00=item_3, Branch01=merge_2, FlattenInputs=True)
flip = FlipMatrix(Data=entwine)  # -> flatten(Data)
pline = PolyLine(Vertices=flip, Closed=False)
end_2 = EndPoints(Curve=pline)  # -> Start, End
explode = Explode(Curve=pline, Recursive=True)  # -> Segments, Vertices
len = Length(Curve=explode.Segments)
item_4 = ListItem(List=len, Index=0, Wrap=True)
crv_7 = Curve(crv_6)
cir = Circle(Plane=end_2.End, Radius=item_4)
crv_cp_3 = CurveClosestPoint(Point=end_2.End, Curve=crv_4)  # -> Point, Parameter, Distance
end_3 = EndPoints(Curve=crv_7)  # -> Start, End
shatter = Shatter(Curve=crv_4, Parameters=crv_cp_3.Parameter)
ccx = CurveCurve(CurveA=cir, CurveB=crv_7)  # -> Points, ParamsA, ParamsB
sort = SortList(Keys=shatter, ValuesA=shatter)  # -> Keys, ValuesA
cp = ClosestPoint(Point=end_3.Start, Cloud=ccx.Points)  # -> ClosestPoint, CPIndex, Distance
item_5 = ListItem(List=sort.ValuesA, Index=0, Wrap=True)
dist_3 = Distance(PointA=cp.ClosestPoint, PointB=end_3.Start)
crv_8 = Curve(item_5)
crv_9 = Curve(crv_7)
end_4 = EndPoints(Curve=crv_8)  # -> Start, End
eval_2 = EvaluateLength(Curve=crv_9, Length=dist_3, Normalized=invert(True))  # -> Point, Tangent, Parameter
ln_2 = Line(StartPoint=end_4.Start, EndPoint=eval_2.Point)
series_4 = Series(Start=1, Step=2, Count=10)
dist_4 = Distance(PointA=end_4.Start, PointB=eval_2.Point)
B_2 = Angle(VectorA=crv_8, VectorB=ln_2)  # -> Angle, Reflex
A_2 = Angle(VectorA=crv_8, VectorB=crv_9)  # -> Angle, Reflex
series_5 = Series(Start=0, Step=2, Count=10)
dist_5 = Distance(PointA=end_4.Start, PointB=eval_2.Point)
expression_3 = Expression(x=A_2.Angle, y=series_4, z=B_2.Angle, u=dist_4, Expression="cos(z-(x*y))*u*2")
expression_4 = Expression(x=A_2.Angle, y=series_5, z=B_2.Angle, u=dist_5, Expression="cos(z-(x*y))*u*2")
num_3 = Number(expression_3)
num_4 = Number(expression_4)
larger_3 = LargerThan(FirstNumber=num_4, SecondNumber=0)  # -> LargerThan, OrEqualTo
larger_4 = LargerThan(FirstNumber=num_3, SecondNumber=0)  # -> LargerThan, OrEqualTo
dispatch_3 = Dispatch(List=num_4, DispatchPattern=larger_3.LargerThan)  # -> ListA, ListB
dispatch_4 = Dispatch(List=num_3, DispatchPattern=larger_4.LargerThan)  # -> ListA, ListB
item_6 = ListItem(List=dispatch_3.ListB, Index=0, Wrap=True)
item_7 = ListItem(List=dispatch_4.ListB, Index=0, Wrap=True)
index_3 = ItemIndex(List=num_3, Item=item_7)
index_4 = ItemIndex(List=num_4, Item=item_6)
split_3 = SplitList(List=num_3, Index=index_3)  # -> ListA, ListB
split_4 = SplitList(List=num_4, Index=index_4)  # -> ListA, ListB
ma_3 = MassAddition(Input=split_3.ListA)  # -> Result, PartialResults
ma_4 = MassAddition(Input=split_4.ListA)  # -> Result, PartialResults
amp_3 = Amplitude(Vector=unitize(crv_8), Amplitude=ma_4.PartialResults)
amp_4 = Amplitude(Vector=unitize(crv_9), Amplitude=ma_3.PartialResults)
move_3 = Move(Geometry=end_4.Start, Motion=amp_3)  # -> Geometry, Transform
move_4 = Move(Geometry=eval_2.Point, Motion=amp_4)  # -> Geometry, Transform
crv_cp_4 = CurveClosestPoint(Point=move_4.Geometry, Curve=crv_9)  # -> Point, Parameter, expr("Round(x,1)", Distance)
crv_cp_5 = CurveClosestPoint(Point=move_3.Geometry, Curve=crv_8)  # -> Point, Parameter, expr("Round(x,1)", Distance)
similar_3 = Similarity(FirstNumber=crv_cp_4.Distance, SecondNumber=0, Threshold=0.1)  # -> Similarity, AbsoluteDifference
similar_4 = Similarity(FirstNumber=crv_cp_5.Distance, SecondNumber=0, Threshold=0.1)  # -> Similarity, AbsoluteDifference
cull_3 = CullPattern(List=move_4.Geometry, CullPattern=similar_3.Similarity)
cull_4 = CullPattern(List=move_3.Geometry, CullPattern=similar_4.Similarity)
merge_3 = Merge(Data1=end_4.Start, Data2=cull_4)  # -> flatten(Result)
merge_4 = Merge(Data1=eval_2.Point, Data2=cull_3)  # -> flatten(Result)
entwine_2 = Entwine(Branch00=merge_3, Branch01=merge_4, FlattenInputs=True)
flip_2 = FlipMatrix(Data=entwine_2)  # -> flatten(Data)
pline_2 = PolyLine(Vertices=flip_2, Closed=False)
crv_10 = Curve(pline)
join = JoinCurves(Curves=[crv_10, pline_2], Preserve=False)
C = ClusterOutput(join)
