# Grasshopper definition Hopper Center Plate with Circle.gh (Grasshopper 1.0.7)
# plug-ins: Silkworm

circle_center_x = Slider(170, range=0..2000)
length_of_curve_segments = Slider(5, range=0..1000)
# Main Parmeters
farthest_left = Slider(0, range=-500..500)
# Infill Parmeters
circle_radius = Slider(132, range=0..2000)
start_point_x = Slider(0, range=-10..100)
building_depth = Slider(340, range=0..1000)
print_speed = Slider(2873, range=0..5000)
start_point_y = Slider(0, range=-10..100)
building_length = Slider(340, range=0..5000)
trapeziod_space_from_edge = Slider(333, range=0..2000)
wall_height = Slider(1, range=0..300)
outer_wall_coner_radius = Slider(41, range=0..100)
wall_thickness = Slider(340, range=0..1000)
Y = UnitY(Factor=building_depth)
X = UnitX(Factor=building_length)
Y_2 = UnitY(Factor=start_point_y)
addition = Addition(A=start_point_y, B=wall_thickness)
addition_2 = Addition(A=circle_radius, B=trapeziod_space_from_edge)
addition_3 = Addition(A=farthest_left, B=wall_thickness)
# Corner Wall Points
# Start Point
# Gradually Rise from 0 Z
# Start Material Flow once moving
pt = ConstructPoint(XCoordinate=start_point_x, YCoordinate=Y_2, ZCoordinate=0)
# Bottom Right Corner
pt_2 = ConstructPoint(XCoordinate=X, YCoordinate=Y_2, ZCoordinate=0)
pt_3 = ConstructPoint(XCoordinate=farthest_left, YCoordinate=Y, ZCoordinate=0)
pt_4 = ConstructPoint(XCoordinate=circle_center_x, YCoordinate=Y_2, ZCoordinate=0)
pt_5 = ConstructPoint(XCoordinate=X, YCoordinate=addition, ZCoordinate=0)
pt_6 = ConstructPoint(XCoordinate=addition_2, YCoordinate=addition, ZCoordinate=0)
pt_7 = ConstructPoint(XCoordinate=farthest_left, YCoordinate=Y_2, ZCoordinate=0)
# Circle Center
pt_8 = ConstructPoint(XCoordinate=circle_center_x, YCoordinate=circle_center_x, ZCoordinate=0)
addition_4 = Addition(A=circle_center_x, B=circle_radius)
addition_5 = Addition(A=circle_center_x, B=addition_2)
addition_6 = Addition(A=circle_center_x, B=circle_center_x)
addition_7 = Addition(A=circle_center_x, B=circle_radius)
# Round
# Corners
# Add points in
# order of path
Z = UnitZ(Factor=[wall_height, pt_7])
addition_8 = Addition(A=addition_4, B=trapeziod_space_from_edge)
circle_cnr = CircleCNR(Center=pt_8, Normal=Vector(0, 0, 1), Radius=circle_radius)
pt_9 = ConstructPoint(XCoordinate=addition_5, YCoordinate=wall_thickness, ZCoordinate=0)
pt_10 = ConstructPoint(XCoordinate=addition_7, YCoordinate=start_point_y, ZCoordinate=0)
pt_11 = ConstructPoint(XCoordinate=circle_center_x, YCoordinate=start_point_y, ZCoordinate=0)
pline = PolyLine(Vertices=[pt, pt_2, pt_5, pt_3, pt_7], Closed=False)
pline_2 = PolyLine(Closed=False)
# Break the curves
# into segments of
# specified length
divlength = DivideLength(Curve=[pline, circle_cnr], Length=length_of_curve_segments)  # -> Points, Tangents, Parameters
pline_3 = PolyLine(Vertices=divlength.Points, Closed=False)
# Optimize
# Remove extra points
# in straight lines
simplify = SimplifyCurve(Curve=pline_3)  # -> Curve, Simplified
explode = Explode(Curve=simplify.Curve, Recursive=True)  # -> Segments, Vertices
extrusion = SilkwormExtrusionPath(MovementLines=simplify(graft(divlength.Points)), SpeedParameter=print_speed, FlowRatio=0.35)
silkworm = SilkwormCompiler(SilkwormMovements=flatten(extrusion))  # -> GCode, SilkwormModel
panel = Panel(silkworm.GCode)
