# Grasshopper definition Hopper Plates 3 plates.gh (Grasshopper 1.0.7)
# plug-ins: Silkworm

trapeziod_short_side = Slider(337, range=0..2000)
trapeziod_long_side = Slider(930, range=0..2000)
# Main Parmeters
farthest_left = Slider(0, range=-500..500)
start_point_x = Slider(0, range=-10..100)
start_point_y = Slider(0, range=-10..100)
wall_thickness = Slider(425, range=0..1000)
subtraction = Subtraction(A=trapeziod_long_side, B=trapeziod_short_side)
Y = UnitY(Factor=start_point_y)
division = Division(A=subtraction, B="2")
Y_2 = UnitY(Factor=wall_thickness)
addition = Addition(A=start_point_y, B=wall_thickness)
addition_2 = Addition(A=trapeziod_short_side, B=division)
# Corner Wall Points
# Start Point
# Gradually Rise from 0 Z
# Start Material Flow once moving
pt = ConstructPoint(XCoordinate=start_point_x, YCoordinate=Y, ZCoordinate=0)
pt_2 = ConstructPoint(XCoordinate=farthest_left, YCoordinate=Y_2, ZCoordinate=0)
# Frist Bottom Left Corner
pt_3 = ConstructPoint(XCoordinate=farthest_left, YCoordinate=Y, ZCoordinate=0)
# First Bottom Right
pt_4 = ConstructPoint(XCoordinate=trapeziod_long_side, YCoordinate=Y, ZCoordinate=0)
# First Top Corner
pt_5 = ConstructPoint(XCoordinate=division, YCoordinate=Y_2, ZCoordinate=0)
# Frist Top Right Corner
pt_6 = ConstructPoint(XCoordinate=addition_2, YCoordinate=addition, ZCoordinate=0)
addition_3 = Addition(A=trapeziod_long_side, B=trapeziod_short_side)
addition_4 = Addition(A=trapeziod_long_side, B=addition_2)
addition_5 = Addition(A=trapeziod_long_side, B=trapeziod_long_side)
addition_6 = Addition(A=trapeziod_long_side, B=trapeziod_short_side)
addition_7 = Addition(A=addition_3, B=division)
# Second Bottom Left Corner
pt_7 = ConstructPoint(XCoordinate=addition_4, YCoordinate=wall_thickness, ZCoordinate=0)
# Second Top Corner
# Second Top Right Corner
pt_8 = ConstructPoint(XCoordinate=addition_6, YCoordinate=start_point_y, ZCoordinate=0)
# Second Bottom Right
pt_9 = ConstructPoint(XCoordinate=addition_2, YCoordinate=wall_thickness, ZCoordinate=0)
# Round
# Corners
length_of_curve_segments = Slider(5, range=0..1000)
pt_10 = ConstructPoint(XCoordinate=trapeziod_long_side, YCoordinate=start_point_y, ZCoordinate=0)
addition_8 = Addition(A=trapeziod_long_side, B=trapeziod_short_side)
point = Point(pt_6)
addition_9 = Addition(A=trapeziod_long_side, B=trapeziod_short_side)
addition_10 = Addition(A=addition_8, B=division)
addition_11 = Addition(A=addition_10, B=trapeziod_short_side)
addition_12 = Addition(A=addition_9, B=trapeziod_long_side)
pt_11 = ConstructPoint(XCoordinate=addition_12, YCoordinate=addition, ZCoordinate=0)
# Bottom Right Corner
pt_12 = ConstructPoint(XCoordinate=addition_12, YCoordinate=Y, ZCoordinate=0)
# Add points in
# order of path
pline = PolyLine(Vertices=[pt, pt_12, pt_11, pt_6, pt_5, pt_2, pt_3, pt_4], Closed=False)
# Third Top Corner
pt_13 = ConstructPoint(XCoordinate=addition_11, YCoordinate=addition, ZCoordinate=0)
pt_14 = ConstructPoint(XCoordinate=addition_10, YCoordinate=wall_thickness, ZCoordinate=0)
# Third Bottom Left Corner
pt_15 = ConstructPoint(XCoordinate=addition_9, YCoordinate=Y, ZCoordinate=0)
print_speed = Slider(2873, range=0..5000)
# Third Top Right Corner
# Third Bottom Right
pt_16 = ConstructPoint(XCoordinate=addition_12, YCoordinate=Y, ZCoordinate=0)
pline_2 = PolyLine(Vertices=[pt_10, pt_8, pt_7, pt_9], Closed=False)
pline_3 = PolyLine(Vertices=[pt_3, pt_5, pt_6, pt_4, pt_8, pt_7, pt_13, pt_16, pt_11, point], Closed=False)
# Break the curves
# into segments of
# specified length
divlength = DivideLength(Curve=pline_3, Length=length_of_curve_segments)  # -> Points, Tangents, Parameters
pline_4 = PolyLine(Vertices=divlength.Points, Closed=False)
# Optimize
# Remove extra points
# in straight lines
simplify = SimplifyCurve(Curve=pline_4)  # -> Curve, Simplified
explode = Explode(Curve=simplify.Curve, Recursive=True)  # -> Segments, Vertices
extrusion = SilkwormExtrusionPath(MovementLines=simplify(graft(divlength.Points)), SpeedParameter=print_speed, FlowRatio=0.35)
pline_5 = PolyLine(Vertices=[pt_14, pt_13, pt_16, pt_15], Closed=False)
silkworm = SilkwormCompiler(SilkwormMovements=flatten(extrusion))  # -> GCode, SilkwormModel
panel = Panel(silkworm.GCode)
