# Grasshopper definition Hopper Plates.gh (Grasshopper 1.0.7)
# plug-ins: Silkworm

trapeziod_long_side = Slider(940, range=0..2000)
# Main Parmeters
farthest_left = Slider(0, range=-500..500)
start_point_x = Slider(0, range=-10..100)
building_depth = Slider(432, range=0..1000)
# Infill Parmeters
length_of_curve_segments = Slider(5, range=0..1000)
start_point_y = Slider(0, range=-10..100)
building_length = Slider(2185, range=0..5000)
wall_height = Slider(1, range=0..300)
trapeziod_short_side = Slider(304, range=0..2000)
outer_wall_coner_radius = Slider(41, range=0..100)
wall_thickness = Slider(432, range=0..1000)
print_speed = Slider(2873, range=0..5000)
trapeziod_space_from_edge = Slider(318, range=0..2000)
inset_distance = Slider(8, range=-100..101)
start_point_x_2 = Slider(0, range=-10..100)
start_point_y_2 = Slider(0, range=-10..100)
outer_wall_coner_radius_2 = Slider(29, range=0..100)
wall_height_2 = Slider(1, range=0..300)
# Center Wall Front
infill_length_multiplier = Slider(1, range=0..10)
# Center Wall Front
infill_length_multiplier_2 = Slider(1, range=0..10)
Y = UnitY(Factor=building_depth)
X = UnitX(Factor=building_length)
Y_2 = UnitY(Factor=start_point_y)
frequency_alignment = Slider(64.954, range=0..100)
addition = Addition(A=start_point_y, B=wall_thickness)
Y_3 = UnitY(Factor=start_point_y_2)
Y_4 = UnitY(Factor=1)
addition_2 = Addition(A=trapeziod_short_side, B=trapeziod_space_from_edge)
addition_3 = Addition(A=farthest_left, B=wall_thickness)
X_2 = UnitX(Factor=infill_length_multiplier)
X_3 = UnitX(Factor=infill_length_multiplier_2)
division = Division(A=wall_thickness, B=2)
subtraction = Subtraction(A=building_depth, B=inset_distance)
# Corner Wall Points
# Start Point
# Gradually Rise from 0 Z
# Start Material Flow once moving
pt = ConstructPoint(XCoordinate=start_point_x, YCoordinate=Y_2, ZCoordinate=0)
pt_2 = ConstructPoint(XCoordinate=X, YCoordinate=Y_2, ZCoordinate=0)
pt_3 = ConstructPoint(XCoordinate=X, YCoordinate=addition, ZCoordinate=0)
addition_4 = Addition(A=start_point_y, B=inset_distance)
addition_5 = Addition(A=start_point_x, B=inset_distance)
# Frist Bottom Left Corner
pt_4 = ConstructPoint(XCoordinate=farthest_left, YCoordinate=Y_2, ZCoordinate=0)
# First Bottom Right
pt_5 = ConstructPoint(XCoordinate=trapeziod_long_side, YCoordinate=Y_2, ZCoordinate=0)
# First Top Corner
pt_6 = ConstructPoint(XCoordinate=trapeziod_space_from_edge, YCoordinate=Y, ZCoordinate=0)
# Frist Top Right Corner
pt_7 = ConstructPoint(XCoordinate=addition_2, YCoordinate=addition, ZCoordinate=0)
subtraction_2 = Subtraction(A=building_length, B=inset_distance)
subtraction_3 = Subtraction(A=building_depth, B=inset_distance)
addition_6 = Addition(A=farthest_left, B=division)
frequency_alignment_2 = Slider(116.529, range=0..160)
frequency_multiplier = Slider(10.824, range=0..100)
amplitude_multiplier = Slider(33.476, range=0..100)
frequency_alignment_3 = Slider(56.57, range=0..160)
# Bottom Right Corner
pt_8 = ConstructPoint(XCoordinate=farthest_left, YCoordinate=Y, ZCoordinate=0)
# Start Point
# Gradually Rise from 0 Z
# Start Material Flow once moving
pt_9 = ConstructPoint(XCoordinate=start_point_x_2, YCoordinate=addition_5, ZCoordinate=0)  # disabled
subtraction_4 = Subtraction(A=subtraction_3, B=inset_distance)
# Inside Corner
pt_10 = ConstructPoint(XCoordinate=division, YCoordinate=division, ZCoordinate=0)
# Top Left Infill End
pt_11 = ConstructPoint(XCoordinate=addition_6, YCoordinate=subtraction, ZCoordinate=0)
# Bottom Right Infill End
pt_12 = ConstructPoint(XCoordinate=subtraction_2, YCoordinate=division, ZCoordinate=0)
# Back to the first point
pt_13 = ConstructPoint(XCoordinate=start_point_x_2, YCoordinate=addition_5, ZCoordinate=0)
arrlinear = LinearArray(Geometry=pt_9, Direction=X_2, Count=subtraction_2)  # -> Geometry, Transform
arrlinear_2 = LinearArray(Geometry=pt_9, Direction=X_3, Count=subtraction_4)  # -> Geometry, Transform
addition_7 = Addition(A=trapeziod_long_side, B=trapeziod_short_side)
addition_8 = Addition(A=trapeziod_long_side, B=addition_2)
# Round
# Corners
# Add points in
# order of path
pline = PolyLine(Vertices=[pt, pt_2, pt_3, pt_7, pt_6, pt_8, pt_4, pt_5], Closed=False)
addition_9 = Addition(A=trapeziod_long_side, B=trapeziod_long_side)
pdecon = Deconstruct(Point=arrlinear.Geometry)  # -> XComponent, YComponent, ZComponent
addition_10 = Addition(A=trapeziod_long_side, B=trapeziod_short_side)
addition_11 = Addition(A=addition_7, B=trapeziod_space_from_edge)
pdecon_2 = Deconstruct(Point=arrlinear_2.Geometry)  # -> XComponent, YComponent, ZComponent
Z = UnitZ(Factor=wall_height)
multiplication = Multiplication(A=pdecon.XComponent, B=frequency_multiplier)
pline_2 = PolyLine(Vertices=[pt_9, pt_12, pt_10, pt_11, pt_13], Closed=False)  # disabled
# Second Bottom Left Corner
pt_14 = ConstructPoint(XCoordinate=addition_8, YCoordinate=wall_thickness, ZCoordinate=0)
# Second Bottom Right
pt_15 = ConstructPoint(XCoordinate=addition_2, YCoordinate=wall_thickness, ZCoordinate=0)
# Second Top Right Corner
pt_16 = ConstructPoint(XCoordinate=addition_10, YCoordinate=start_point_y, ZCoordinate=0)
addition_12 = Addition(A=pdecon_2.XComponent, B=frequency_alignment_2)
# Second Top Corner
pt_17 = ConstructPoint(XCoordinate=trapeziod_long_side, YCoordinate=start_point_y, ZCoordinate=0)
division_2 = Division(A=multiplication, B=360)
multiplication_2 = Multiplication(A=addition_12, B=frequency_multiplier)
addition_13 = Addition(A=division_2, B=frequency_alignment_3)
addition_14 = Addition(A=pdecon_2.XComponent, B=inset_distance)
division_3 = Division(A=multiplication_2, B=360)
column_alignment_adjustment = Slider(6.543, range=-10..10)
align_mirror = Slider(126.464, range=0..1000)
cos = Cosine(Value=addition_13)
addition_15 = Addition(A=trapeziod_long_side, B=trapeziod_short_side)
cos_2 = Cosine(Value=division_3)
addition_16 = Addition(A=trapeziod_long_side, B=trapeziod_short_side)
addition_17 = Addition(A=addition_15, B=trapeziod_space_from_edge)
addition_18 = Addition(A=addition_17, B=trapeziod_short_side)
addition_19 = Addition(A=addition_16, B=trapeziod_long_side)
acos = ArcCosine(Value=cos_2)
acos_2 = ArcCosine(Value=cos)
multiplication_3 = Multiplication(A=acos, B=amplitude_multiplier)
# Third Top Right Corner
pt_18 = ConstructPoint(XCoordinate=addition_18, YCoordinate=addition, ZCoordinate=0)
multiplication_4 = Multiplication(A=acos_2, B=amplitude_multiplier)
# Third Top Corner
pt_19 = ConstructPoint(XCoordinate=addition_17, YCoordinate=Y, ZCoordinate=0)
# Third Bottom Right
pt_20 = ConstructPoint(XCoordinate=addition_19, YCoordinate=Y_2, ZCoordinate=0)
pline_3 = PolyLine(Vertices=[pt_4, pt_6, pt_7, pt_5, pt_16, pt_14, pt_18, pt_20], Closed=False)
# Break the curves
# into segments of
# specified length
divlength = DivideLength(Curve=pline_3, Length=length_of_curve_segments)  # -> Points, Tangents, Parameters
pline_4 = PolyLine(Vertices=divlength.Points, Closed=False)
pt_21 = ConstructPoint(XCoordinate=addition_16, YCoordinate=Y_2, ZCoordinate=0)
# Third Bottom Left Corner
pline_5 = PolyLine(Vertices=[pt_17, pt_16, pt_14, pt_15], Closed=False)
addition_20 = Addition(A=multiplication_3, B=column_alignment_adjustment)
addition_21 = Addition(A=multiplication_4, B=column_alignment_adjustment)
# Optimize
# Remove extra points
# in straight lines
simplify = SimplifyCurve(Curve=pline_4)  # -> Curve, Simplified
explode = Explode(Curve=simplify.Curve, Recursive=True)  # -> Segments, Vertices
addition_22 = Addition(A=addition_20, B=farthest_left)
extrusion = SilkwormExtrusionPath(MovementLines=simplify(graft(explode.Vertices)), SpeedParameter=print_speed, FlowRatio=0.35)
pline_6 = PolyLine(Vertices=[pt_19, pt_18, pt_20, pt_21], Closed=False)
pt_22 = ConstructPoint(XCoordinate=addition_22, YCoordinate=addition_14, ZCoordinate=pdecon_2.ZComponent)
pt_23 = ConstructPoint(XCoordinate=pdecon.XComponent, YCoordinate=addition_21, ZCoordinate=pdecon.ZComponent)
pline_7 = PolyLine(Vertices=pt_22, Closed=False)
pline_8 = PolyLine(Vertices=pt_23, Closed=False)
silkworm = SilkwormCompiler(SilkwormMovements=flatten(extrusion))  # -> GCode, SilkwormModel
panel = Panel(silkworm.GCode)
