# Grasshopper definition Hopper_foot_5.5_inch.gh (Grasshopper 1.0.7)
# plug-ins: Silkworm

# Imported curve
# HSS 7x7x0.375.dwg
# Model inches
# Layout millimeters
length_of_curve_segments = Slider(5, range=0..1000)
# Main Parmeters
print_speed = Slider(2873, range=0..5000)
# Shrink inner to about 5.5 inches wide - 0.811
# Then add some for the cut width.
number_slider = Slider(0.811, range=0..3)
x_move = Slider(69.349, range=0..1000)
x_move_2 = Slider(69.349, range=0..1000)
curve = Curve(<curve referenced from the Rhino model>)
unit_x = UnitX(Factor=x_move_2)
unit_y = UnitY(Factor=x_move)
scale = Scale(Geometry=curve, Center=Point(0, 0, 0), Factor=number_slider)  # -> Geometry, Transform
start_curve_point = Slider(6, range=0..178)
# Break the curves
# into segments of
# specified length
divlength = DivideLength(Curve=scale.Geometry, Length=length_of_curve_segments)  # -> Points, Tangents, Parameters
divlength_2 = DivideLength(Curve=scale.Geometry, Length=length_of_curve_segments)  # -> Points, Tangents, Parameters
final_point = Slider(110, range=0..178)
end_curve_point = Slider(7, range=0..178)
split_list = SplitList(List=divlength.Points, Index=start_curve_point)  # -> ListA, ListB
split_list_2 = SplitList(List=divlength_2.Points, Index=final_point)  # -> ListA, ListB
split_list_3 = SplitList(List=split_list.ListB, Index=end_curve_point)  # -> ListA, ListB
first_pt_of_inner = Slider(0, range=-1..178)
last_pt_of_inner = Slider(-1, range=-1..178)
pline = PolyLine(Vertices=split_list_2.ListA, Closed=False)
reverse_list = ReverseList(List=split_list_3.ListA)
point = Point(reverse_list)
list_item = ListItem(List=split_list_2.ListA, Index=first_pt_of_inner, Wrap=True)
list_item_2 = ListItem(List=split_list_2.ListA, Index=last_pt_of_inner, Wrap=True)
# Set Start Point of outer C
# as the end of the inner
set_start_point = Slider(0, range=-1..178)
# Back to first point of inner C
end_curve_section = Slider(-1, range=-1..178)
point_2 = Point(list_item)
point_3 = Point(list_item_2)
insert_items = InsertItems(List=point, Item=point_3, Indices=set_start_point, Wrap=True)
insert_items_2 = InsertItems(List=split_list_2.ListA, Item=point_2, Indices=end_curve_section, Wrap=True)
point_4 = Point(insert_items_2)
point_5 = Point(flatten(point_4))
move = Move(Geometry=point_5, Motion=unit_y)  # -> Geometry, Transform
move_2 = Move(Geometry=move.Geometry, Motion=unit_x)  # -> Geometry, Transform
pline_2 = PolyLine(Vertices=move_2.Geometry, Closed=False)
extrusion = SilkwormExtrusionPath(MovementLines=simplify(graft(move_2.Geometry)), SpeedParameter=print_speed, FlowRatio=0.35)
silkworm = SilkwormCompiler(SilkwormMovements=flatten(extrusion))  # -> GCode, SilkwormModel
panel = Panel(silkworm.GCode)
