# Grasshopper definition Outline_for_Printing_From_Outer_Only.gh (Grasshopper 1.0.7)
# plug-ins: Silkworm

ramp_adjust_x_points = Slider(15, range=-100..1000)
ramp_adjust_x = Slider(56, range=-100..1000)
# Layers Control
layer_height = Slider(25, range=0..100)
ramp_adjust_height = Slider(39, range=0..100)
# segment length of 16 was too jerky
# segment length of 4 was smooth with 38 radius
# - but was bad with 60  (Yoff 80, X off 38)
# - changing to length of 8 - better (Y off 68, X off 32)
# - changing to length of 10 and radius of 50 (Y off y 35, X off by 6)
# - changing to length of 12 and radius of 45 (Y off y 30, X off by 27)
# --- 4-16-22 with new motor settings we can do fine points again.
# (Better for no path planning issues)
#        - length of 6 and radius of 70
length_of_curve_segments = Slider(6, range=0..20)
# Interlayer Ramp Control
layer_height_2 = Slider(25, range=0..100)
ramp_adjust_height_2 = Slider(39, range=0..100)
wyth_offset = Slider(25, range=0..100)
# Two straight Walls With Double Wyth
# (two 1" beads to make a 2" thick inner and
#  outter wall) - the bridge between the two
#  should be cut
# First Wall Parmeters
outer_wall_coner_radius = Slider(58, range=0..100)
building_length = Slider(1153, range=0..2000)  # disabled
print_speed = Slider(2873, range=0..5000)
bead_width = Slider(50, range=0..100)
inner_wall_coner_radius = Slider(39, range=0..100)
wall_height = Slider(1524, range=0..5000)
building_depth = Slider(200, range=0..1000)  # disabled
bridge_location4 = Slider(50, range=-100..101)
wall_thickness = Slider(-150, range=-500..300)
# Bridge Between Walls
bridge_location = Slider(-50, range=-100..101)
bridge_location2 = Slider(-55, range=-100..101)
bridge_location3 = Slider(0, range=-100..101)
inverse = Slider(-1, range=-1..1)
inverse_2 = Slider(-1, range=-1..1)
# Outer Shape
curve = Curve(<curve referenced from the Rhino model>)
multiplication = Multiplication(A=wyth_offset, B=inverse)
Y = UnitY(Factor=building_depth)  # disabled
X = UnitX(Factor=building_length)  # disabled
division = Division(A=wall_height, B=layer_height)
multiplication_2 = Multiplication(B=inverse_2)
series = Series(Start=0, Step=1, Count=ramp_adjust_x_points)
division_2 = Division(A=layer_height_2, B=ramp_adjust_x_points)
series_2 = Series(Start=0, Step=1, Count=division)
cull_index = CullIndex(List=series, Indices=0, Wrap=True)
# Interior Shape (Offset)
offset_curve = OffsetCurve(Curve=curve, Distance=wall_thickness, Corners=1)
multiplication_3 = Multiplication(A=series_2, B=layer_height)
# Inside Corner
# Top Left Corner
# Bottom Left Corner
# Back to the first point
# Inner Wyth Points
# Inside Corner
# minus Offset
addition = Addition(B=multiplication_2)
# Start Y
# plus Offset
addition_2 = Addition()
# Farthest Left
# plus Offset
addition_3 = Addition()
# Wall Thickness
# minus Offset
addition_4 = Addition(B=multiplication_2)
# Bulding Depth
# minus Offset
addition_5 = Addition(B=multiplication_2)
# Bulding Length
# minus Offset
addition_6 = Addition(B=multiplication_2)
# Corner Wall Points
multiplication_4 = Multiplication(A=division_2, B=cull_index)
Z = UnitZ(Factor=multiplication_3)
subtraction = Subtraction(A=layer_height_2, B=multiplication_4)
reverse_list = ReverseList(List=subtraction)
# Round corners early
# Outer corners
fillet = Fillet(Curve=curve, Radius=outer_wall_coner_radius)
# Inner corners
fillet_2 = Fillet(Curve=offset_curve, Radius=inner_wall_coner_radius)
# Start Point
# Gradually Rise from 0 Z
# Start Material Flow once moving
# Bottom Right Corner
Z_2 = UnitZ(Factor=reverse_list)
# Combine Inner
# and Outer in layer
divlength = DivideLength(Curve=fillet, Length=length_of_curve_segments)  # -> flatten(Points), Tangents, Parameters
# Start Point
# Gradually Rise from 0 Z
# Start Material Flow once moving
# Bottom Right Corner
divlength_2 = DivideLength(Curve=fillet_2, Length=length_of_curve_segments)  # -> flatten(Points), Tangents, Parameters
# Add ramp in path
move = Move(Geometry=[divlength.Points, divlength_2.Points], Motion=Z_2)  # -> Geometry, Transform
# Add points in
# order of path
pline = PolyLine(Vertices=move.Geometry, Closed=False)
# Insert Geometry to Flow around
Z_3 = UnitZ(Factor=wall_height)
# Copy for a series
# of z vectors (layers)
# toggle
move_2 = Move(Geometry=graft(pline), Motion=Z)  # -> Geometry, Transform
list_item = ListItem(Index=Slider(1, range=0..590), Wrap=True)  # disabled
# Curve to surface is what we want for
# morphonig around outlets, etc.
# We just have to get a good
# surface around the brep obstacle.
pull_curve = PullCurve(Curve=move_2.Geometry, Surface=list_item)  # disabled
# Break and Join again
# to get points across inner to outer
# Optimizing to
# Remove extra points
# in straight lines can cause the
# issue of the printer not doing
# the points in order
divlength_3 = DivideLength(Curve=move_2.Geometry, Length=length_of_curve_segments)  # -> Points, Tangents, Parameters
pline_2 = PolyLine(Vertices=divlength_3.Points, Closed=False)
explode = Explode(Curve=pline_2, Recursive=True)  # -> Segments, Vertices

# ---- group: Silkworm
# With the Delimiter, we now have
# non-extuding moves!  Just keep the
# Line collections separate when sending them in
# and silkworm will add the moves between..
# How high to raise for travel
# How fast to raise
# How much negative extrusiuon
# How far to come back down
# How fast to come down
# How much to extrude to get flow again
# Travel speed
# E-1.135  Will be what I want to signal
# Turning off the Plasma Cutter
# And E1.136 will be to turn it on.
# I'll replace for my M Code in the Gcode.
# Very slow speeds for plasma cutting!
# We travel even slower to let the tip cool
# and keep a lower duty cycle.
panel = Panel("4")
unit_z = UnitZ(Factor=panel)
multiplication_5 = Multiplication(A=unit_z, B=-1)
silkworm_movement_delimiter = SilkwormMovementDelimiter(
    DelimitingStartVectors=multiplication_5,
    StartVectorDelimitingSpeed=360,
    StartVectorDelimitingPressure=1.136,
    DelimitingEndVectors=unit_z,
    EndVectorDelimitingSpeed=360,
    EndVectoreDelimitingPressure=-1.135,
    TravelSpeed="312")
extrusion = SilkwormExtrusionPath(MovementLines=explode.Segments, SpeedParameter="351", FlowRatio=0, Delimiter=silkworm_movement_delimiter)
silkworm = SilkwormCompiler(SilkwormMovements=extrusion)  # -> GCode, SilkwormModel

# ----
list_item_2 = ListItem(List=explode.Segments, Index=Slider(480, range=0..590), Wrap=True)
extrusion_2 = SilkwormExtrusionPath(MovementLines=simplify(graft(explode.Segments)), SpeedParameter=print_speed, FlowRatio=0.35)
# Check direction of point flow
point = Point(list_item_2)
panel_2 = Panel(silkworm.GCode)
silkworm_2 = SilkwormCompiler(SilkwormMovements=flatten(extrusion_2))  # -> GCode, SilkwormModel
