# Grasshopper definition Parametric Wall Design - line research.gh (Grasshopper 1.0.7)

# Center Wall Corners
distance_to_layer_2 = Slider(2, range=0..10)
# CenterWall Left
number_slider = Slider(1, range=0..1)
# CenterWall Front
number_slider_2 = Slider(0.512, range=0..1)
# Inner Wall
distance_to_layer_3 = Slider(4, range=0..10)
wall_height = Slider(15, range=0..100)
zero_zero_corner = Slider(0, range=0..100)
oter_wall_coner_radius = Slider(19, range=0..30)
building_width = Slider(56, range=0..100)
building_length = Slider(100, range=0..100)
X = UnitX(Factor=number_slider_2)
Y = UnitY(Factor=number_slider)
multiplication = Multiplication(A=distance_to_layer_2, B=-1)
multiplication_2 = Multiplication(A=distance_to_layer_2, B=-1)
multiplication_3 = Multiplication(A=distance_to_layer_3, B=-1)
addition = Addition(A=oter_wall_coner_radius, B=multiplication_2)
num = Number(oter_wall_coner_radius)
multiplication_4 = Multiplication(A=num, B=2)
multiplication_5 = Multiplication(A=num, B=2)
addition_2 = Addition(A=building_width, B=multiplication)
addition_3 = Addition(A=zero_zero_corner, B=distance_to_layer_2)
addition_4 = Addition(A=building_length, B=multiplication)
subtraction = Subtraction(A=building_width, B=multiplication_4)
subtraction_2 = Subtraction(A=building_length, B=multiplication_5)
addition_5 = Addition(A=zero_zero_corner, B=num)
addition_6 = Addition(A=zero_zero_corner, B=num)
addition_7 = Addition(A=addition_3, B=distance_to_layer_3)
addition_8 = Addition(A=addition_2, B=multiplication_3)
addition_9 = Addition(A=addition_4, B=multiplication_3)
X_2 = UnitX(Factor=num)
Y_2 = UnitY(Factor=num)
division = Division(A=subtraction_2, B=number_slider_2)
division_2 = Division(A=subtraction, B=number_slider)
pt = ConstructPoint(XCoordinate=0, YCoordinate=addition_5, ZCoordinate=0)
pt_2 = ConstructPoint(XCoordinate=addition_6, YCoordinate=0, ZCoordinate=0)
X_3 = UnitX(Factor=zero_zero_corner)
Y_3 = UnitY(Factor=zero_zero_corner)
Y_4 = UnitY(Factor=building_width)
X_4 = UnitX(Factor=building_length)
Y_5 = UnitY(Factor=building_width)
X_5 = UnitX(Factor=zero_zero_corner)
X_6 = UnitX(Factor=addition_7)
X_7 = UnitX(Factor=addition_9)
Y_6 = UnitY(Factor=addition_7)
X_8 = UnitX(Factor=addition_7)
Y_7 = UnitY(Factor=addition_8)
Y_8 = UnitY(Factor=addition_8)
X_9 = UnitX(Factor=addition_3)
X_10 = UnitX(Factor=addition_4)
Y_9 = UnitY(Factor=addition_3)
X_11 = UnitX(Factor=addition_3)
Y_10 = UnitY(Factor=addition_2)
Y_11 = UnitY(Factor=addition_2)
arrlinear = LinearArray(Geometry=pt, Direction=Y, Count=division_2)  # -> Geometry, Transform
arrlinear_2 = LinearArray(Geometry=pt_2, Direction=X, Count=division)  # -> Geometry, Transform
pt_3 = ConstructPoint(XCoordinate=X_3, YCoordinate=Y_3, ZCoordinate=0)
pt_4 = ConstructPoint(XCoordinate=X_5, YCoordinate=Y_5, ZCoordinate=0)
pt_5 = ConstructPoint(XCoordinate=X_4, YCoordinate=Y_4, ZCoordinate=0)
pt_6 = ConstructPoint(XCoordinate=X_6, YCoordinate=Y_6, ZCoordinate=0)
pt_7 = ConstructPoint(XCoordinate=X_8, YCoordinate=Y_7, ZCoordinate=0)
pt_8 = ConstructPoint(XCoordinate=X_7, YCoordinate=Y_8, ZCoordinate=0)
pt_9 = ConstructPoint(XCoordinate=X_10, YCoordinate=Y_11, ZCoordinate=0)
pt_10 = ConstructPoint(XCoordinate=X_11, YCoordinate=Y_10, ZCoordinate=Y_10)
pt_11 = ConstructPoint(XCoordinate=X_10, YCoordinate=Y_9, ZCoordinate=0)
# Middle
pt_12 = ConstructPoint(XCoordinate=X_9, YCoordinate=Y_9, ZCoordinate=0)
pdecon = Deconstruct(Point=arrlinear.Geometry)  # -> XComponent, YComponent, ZComponent
multiplication_6 = Multiplication(A=distance_to_layer_3, B=-1)
pdecon_2 = Deconstruct(Point=arrlinear_2.Geometry)  # -> XComponent, YComponent, ZComponent
rec_3pt = Rectangle3Pt(PointA=pt_3, PointB=pt_4, PointC=pt_5)  # -> Rectangle, Length
rec_3pt_2 = Rectangle3Pt(PointA=pt_6, PointB=pt_7, PointC=pt_8)  # -> Rectangle, Length
subtraction_3 = Subtraction(A=X_10, B=X_2)
addition_10 = Addition()
subtraction_4 = Subtraction(A=Y_10, B=Y_2)
graph = GraphMapper(
    pdecon.YComponent,
    x0=0,
    x1=1,
    y0=0,
    y1=1,
    container_name="Sine",
    Equation_px=[0.5676054358, 1],
    Equation_py=[0.3016214371, 1])
graph_2 = GraphMapper(
    pdecon_2.XComponent,
    x0=0,
    x1=1,
    y0=0,
    y1=1,
    container_name="Sine",
    Equation_px=[0.7150728703, 1],
    Equation_py=[0.07264012098, 1])
addition_11 = Addition(A=addition, B=multiplication_6)
fillet = Fillet(Curve=rec_3pt.Rectangle, Radius=oter_wall_coner_radius)
addition_12 = Addition(A=graph, B=addition_3)
addition_13 = Addition(A=graph_2, B=addition_3)
pt_13 = ConstructPoint(XCoordinate=subtraction_3, YCoordinate=Y_11, ZCoordinate=0)
# First
pt_14 = ConstructPoint(XCoordinate=X_2, YCoordinate=Y_9, ZCoordinate=0)
pt_15 = ConstructPoint(XCoordinate=X_11, YCoordinate=subtraction_4, ZCoordinate=0)
pt_16 = ConstructPoint(XCoordinate=X_10, YCoordinate=num, ZCoordinate=0)
Z = UnitZ(Factor=wall_height)
fillet_2 = Fillet(Curve=rec_3pt_2.Rectangle, Radius=addition_11)
pt_17 = ConstructPoint(XCoordinate=pdecon_2.XComponent, YCoordinate=addition_13, ZCoordinate=pdecon_2.ZComponent)
divide = DivideCurve(Curve=fillet, Count=200, Kinks=False)  # -> Points, Tangents, Parameters
subtraction_5 = Subtraction(A=Y_11, B=Y_2)
subtraction_6 = Subtraction(A=X_10, B=X_2)
pt_18 = ConstructPoint(XCoordinate=addition_12, YCoordinate=pdecon.YComponent, ZCoordinate=pdecon.ZComponent)
extr = Extrude(Base=fillet_2, Direction=Z)
rev = ReverseList(List=pt_17)
# Last
pt_19 = ConstructPoint(XCoordinate=X_9, YCoordinate=Y_2, ZCoordinate=0)
pt_20 = ConstructPoint(XCoordinate=num, YCoordinate=Y_10, ZCoordinate=0)
pt_21 = ConstructPoint(XCoordinate=X_10, YCoordinate=subtraction_5, ZCoordinate=0)
pt_22 = ConstructPoint(XCoordinate=subtraction_6, YCoordinate=Y_9, ZCoordinate=0)
pt_23 = Point(<point referenced from the Rhino model>)
pt_24 = Point(<point referenced from the Rhino model>)
pt_25 = Point(<point referenced from the Rhino model>)
# Build Center Wall Corners
# Order of points is important - we'll go clockwise
number_slider_3 = Slider(-1, range=-20..20)
nurbs = NurbsCurve(Vertices=divide.Points, Degree=3, Periodic=False)  # -> Curve, Length, Domain
subtraction_7 = Subtraction(A=addition_4, B=addition_3)
# CenterWall Right
subtraction_8 = Subtraction(A=addition_2, B=addition_3)
pt_26 = Point([pt_23, pt_24, pt_25])
Y_12 = UnitY(Factor=Slider(1, range=-20..20))
X_12 = UnitX(Factor=Slider(1, range=-20..20))
X_13 = UnitX(Factor=subtraction_7)
Y_13 = UnitY(Factor=Slider(-1, range=-20..20))
Y_14 = UnitY(Factor=subtraction_8)
intcrv = Interpolate(Vertices=pt_26, Degree=3, Periodic=False, KnotStyle=1)  # -> Curve, Length, Domain
X_14 = UnitX(Factor=number_slider_3)
move = Move(Geometry=pt_18, Motion=X_13)  # -> Geometry, Transform
# CenterWall Back
move_2 = Move(Geometry=pt_17, Motion=Y_14)  # -> Geometry, Transform
arc = ArcSED(Start=pt_15, End=pt_20, Direction=Y_12)  # -> Arc, Plane, Radius
arc_2 = ArcSED(Start=pt_13, End=pt_21, Direction=X_12)  # -> Arc, Plane, Radius
arc_3 = ArcSED(Start=pt_16, End=pt_22, Direction=Y_13)  # -> Arc, Plane, Radius
arc_4 = ArcSED(Start=pt_14, End=pt_19, Direction=X_14)  # -> Arc, Plane, Radius
rev_2 = ReverseList(List=move.Geometry)
crvprox = CurveProximity(CurveA=intcrv.Curve, CurveB=nurbs.Curve)  # -> PointA, PointB, Distance
divide_2 = DivideCurve(Curve=arc_2.Arc, Count=10, Kinks=False)  # -> Points, Tangents, Parameters
divide_3 = DivideCurve(Curve=arc_3.Arc, Count=10, Kinks=False)  # -> Points, Tangents, Parameters
divide_4 = DivideCurve(Curve=arc.Arc, Count=10, Kinks=False)  # -> Points, Tangents, Parameters
divide_5 = DivideCurve(Curve=arc_4.Arc, Count=10, Kinks=False)  # -> Points, Tangents, Parameters
extr_2 = Extrude(Direction=Z)
# Or go staight from points.
# Two lists were reversed to keep the flow correct.
pt_27 = Point([divide_5.Points, pt_18, divide_4.Points, move_2.Geometry, divide_2.Points, rev_2, divide_3.Points, rev])
intcrv_2 = Interpolate(Vertices=pt_27, Degree=3, Periodic=False, KnotStyle=1)  # -> Curve, Length, Domain
extr_3 = Extrude(Base=intcrv_2.Curve, Direction=Z)
