# Grasshopper definition Parametric Wall Design v 2.0.gh (Grasshopper 1.0.7)

distance_to_layer_3 = Slider(4, range=0..10)
building_width = Slider(100, range=0..500)
building_length = Slider(148, range=0..500)
distance_to_layer_2 = Slider(2, range=0..10)
wall_height_front = Slider(31, range=0..100)
wall_height_back = Slider(20, range=0..100)
zero_zero_corner = Slider(0, range=0..100)
oter_wall_coner_radius = Slider(19, range=0..30)
multiplication = Multiplication(A=distance_to_layer_2, B=-1)
multiplication_2 = Multiplication(A=distance_to_layer_2, B=-1)
multiplication_3 = Multiplication(A=distance_to_layer_3, B=-1)
addition = Addition(A=building_width, B=multiplication)
addition_2 = Addition(A=zero_zero_corner, B=distance_to_layer_2)
addition_3 = Addition(A=building_length, B=multiplication)
addition_4 = Addition(A=addition_2, B=distance_to_layer_3)
addition_5 = Addition(A=addition, B=multiplication_3)
addition_6 = Addition(A=addition_3, B=multiplication_3)
X = UnitX(Factor=zero_zero_corner)
Y = UnitY(Factor=zero_zero_corner)
Y_2 = UnitY(Factor=building_width)
X_2 = UnitX(Factor=building_length)
Y_3 = UnitY(Factor=building_width)
X_3 = UnitX(Factor=zero_zero_corner)
X_4 = UnitX(Factor=addition_2)
X_5 = UnitX(Factor=addition_3)
Y_4 = UnitY(Factor=addition_2)
X_6 = UnitX(Factor=addition_2)
Y_5 = UnitY(Factor=addition)
Y_6 = UnitY(Factor=addition)
X_7 = UnitX(Factor=addition_4)
X_8 = UnitX(Factor=addition_6)
Y_7 = UnitY(Factor=addition_4)
X_9 = UnitX(Factor=addition_4)
Y_8 = UnitY(Factor=addition_5)
Y_9 = UnitY(Factor=addition_5)
pt = ConstructPoint(XCoordinate=X, YCoordinate=Y, ZCoordinate=0)
pt_2 = ConstructPoint(XCoordinate=X_3, YCoordinate=Y_3, ZCoordinate=0)
pt_3 = ConstructPoint(XCoordinate=X_2, YCoordinate=Y_2, ZCoordinate=0)
pt_4 = ConstructPoint(XCoordinate=X_4, YCoordinate=Y_4, ZCoordinate=0)
pt_5 = ConstructPoint(XCoordinate=X_7, YCoordinate=Y_7, ZCoordinate=0)
pt_6 = ConstructPoint(XCoordinate=X_6, YCoordinate=Y_5, ZCoordinate=0)
pt_7 = ConstructPoint(XCoordinate=X_9, YCoordinate=Y_8, ZCoordinate=0)
pt_8 = ConstructPoint(XCoordinate=X_8, YCoordinate=Y_9, ZCoordinate=0)
pt_9 = ConstructPoint(XCoordinate=zero_zero_corner, YCoordinate=zero_zero_corner, ZCoordinate=wall_height_front)
pt_10 = ConstructPoint(XCoordinate=zero_zero_corner, YCoordinate=building_width, ZCoordinate=wall_height_back)
pt_11 = ConstructPoint(XCoordinate=X_5, YCoordinate=Y_6, ZCoordinate=0)
pt_12 = ConstructPoint(XCoordinate=building_length, YCoordinate=building_width, ZCoordinate=wall_height_back)
multiplication_4 = Multiplication(A=distance_to_layer_3, B=-1)
rec_3pt = Rectangle3Pt(PointA=pt, PointB=pt_2, PointC=pt_3)  # -> Rectangle, Length
rec_3pt_2 = Rectangle3Pt(PointA=pt_4, PointB=pt_6, PointC=pt_11)  # -> Rectangle, Length
rec_3pt_3 = Rectangle3Pt(PointA=pt_5, PointB=pt_7, PointC=pt_8)  # -> Rectangle, Length
rec_3pt_4 = Rectangle3Pt(PointA=pt_9, PointB=pt_10, PointC=pt_12)  # -> Rectangle, Length
addition_7 = Addition(A=oter_wall_coner_radius, B=multiplication_2)
addition_8 = Addition(A=addition_7, B=multiplication_4)
explode = Explode(Curve=rec_3pt_4.Rectangle, Recursive=True)  # -> Segments, Vertices
fillet = Fillet(Curve=rec_3pt.Rectangle, Radius=oter_wall_coner_radius)
fillet_2 = Fillet(Curve=rec_3pt_3.Rectangle, Radius=addition_8)
item = ListItem(List=explode.Vertices, Index=0, Wrap=True)  # -> Item, Item1, Item2, Item3
srf4pt = _4PointSurface(CornerA=item.Item, CornerB=item.Item1, CornerC=item.Item2, CornerD=item.Item3)
crv = Curve([fillet_2, fillet])
number_slider = Slider(55, range=0..100)
project = Project(Curve=crv, Brep=srf4pt, Direction=Vector(0, 0, 1), UseTasks=True)  # -> flatten(Curve)
offset = OffsetCurve(Distance=1, Plane=PlaneXY(0, 0, 0), Corners=1)
# Adding points
fillet_3 = Fillet(Curve=rec_3pt_2.Rectangle, Radius=addition_7)
graft = GraftTree(Tree=crv, IncludeEmptyLists=True, IncludeNullItems=True)
graft_2 = GraftTree(Tree=project, IncludeEmptyLists=True, IncludeNullItems=True)
end = EndPoints(Curve=fillet_3)  # -> Start, End
len = Length(Curve=fillet_3)
loft = Loft(
    Curves=flatten([graft, graft_2]),
    Options={Adjust=True, Closed=False, LoftEnds=0, LoftSimp=0, LoftType=0, Rebuild=10, Refit=0.01})
divide = DivideCurve(Curve=fillet_3, Count=number_slider, Kinks=False)  # -> Points, Tangents, Parameters
cpoly = ControlPolygon(Curve=fillet_3)  # -> Polygon, Points
division = Division(A=len, B=number_slider)
num = Number(Slider(1, range=0..1))
pt_13 = Point(<point referenced from the Rhino model>)
pt_14 = Point(<point referenced from the Rhino model>)
pt_15 = Point(<point referenced from the Rhino model>)
pt_16 = Point(<point referenced from the Rhino model>)
intcrv = Interpolate(Vertices=divide.Points, Degree=3, Periodic=False, KnotStyle=1)  # -> Curve, Length, Domain
pt_17 = Point([pt_16, pt_13, pt_15, pt_14])
ext = ExtendCurve(Curve=fillet_3, Type=2, Start=30, End=10)
intcrv_2 = Interpolate(Vertices=pt_17, Degree=3, Periodic=False, KnotStyle=1)  # -> Curve, Length, Domain
join = JoinCurves(Curves=flatten([intcrv.Curve, intcrv_2.Curve]), Preserve=False)
connect = ConnectCurves(Curves=join, Continuity=2, Close=True, Bulge=1)
dist = Distance(PointA=pt_17)
