# Grasshopper definition Parametric Wall Design v 3.0 - Troubleshoot Loft.gh (Grasshopper 1.0.7)

distance_to_layer_3 = Slider(3, range=0..10)
building_width = Slider(301, range=0..960)
building_length = Slider(793, range=0..960)
distance_to_layer_2 = Slider(12, range=0..30)
wall_height_back = Slider(184, range=0..300)
wall_height_front = Slider(187, range=0..300)
zero_zero_corner = Slider(0, range=0..100)
oter_wall_coner_radius = Slider(23, range=0..50)
multiplication = Multiplication(A=distance_to_layer_2, B=-1)
multiplication_2 = Multiplication(A=distance_to_layer_2, B=-1)
multiplication_3 = Multiplication(A=distance_to_layer_3, B=-1)
addition = Addition(A=building_width, B=multiplication)
addition_2 = Addition(A=zero_zero_corner, B=distance_to_layer_2)
addition_3 = Addition(A=building_length, B=multiplication)
addition_4 = Addition(A=addition_2, B=distance_to_layer_3)
addition_5 = Addition(A=addition, B=multiplication_3)
addition_6 = Addition(A=addition_3, B=multiplication_3)
X = UnitX(Factor=zero_zero_corner)
Y = UnitY(Factor=zero_zero_corner)
Y_2 = UnitY(Factor=building_width)
X_2 = UnitX(Factor=building_length)
Y_3 = UnitY(Factor=building_width)
X_3 = UnitX(Factor=zero_zero_corner)
X_4 = UnitX(Factor=addition_2)
X_5 = UnitX(Factor=addition_3)
Y_4 = UnitY(Factor=addition_2)
X_6 = UnitX(Factor=addition_2)
Y_5 = UnitY(Factor=addition)
Y_6 = UnitY(Factor=addition)
X_7 = UnitX(Factor=addition_4)
X_8 = UnitX(Factor=addition_6)
Y_7 = UnitY(Factor=addition_4)
X_9 = UnitX(Factor=addition_4)
Y_8 = UnitY(Factor=addition_5)
Y_9 = UnitY(Factor=addition_5)
pt = ConstructPoint(XCoordinate=X, YCoordinate=Y, ZCoordinate=0)
pt_2 = ConstructPoint(XCoordinate=X_3, YCoordinate=Y_3, ZCoordinate=0)
pt_3 = ConstructPoint(XCoordinate=X_2, YCoordinate=Y_2, ZCoordinate=0)
pt_4 = ConstructPoint(XCoordinate=X_4, YCoordinate=Y_4, ZCoordinate=0)
pt_5 = ConstructPoint(XCoordinate=X_7, YCoordinate=Y_7, ZCoordinate=0)
pt_6 = ConstructPoint(XCoordinate=X_6, YCoordinate=Y_5, ZCoordinate=0)
pt_7 = ConstructPoint(XCoordinate=X_9, YCoordinate=Y_8, ZCoordinate=0)
pt_8 = ConstructPoint(XCoordinate=X_8, YCoordinate=Y_9, ZCoordinate=0)
pt_9 = ConstructPoint(XCoordinate=zero_zero_corner, YCoordinate=zero_zero_corner, ZCoordinate=wall_height_back)
pt_10 = ConstructPoint(XCoordinate=zero_zero_corner, YCoordinate=building_width, ZCoordinate=wall_height_front)
pt_11 = ConstructPoint(XCoordinate=X_5, YCoordinate=Y_6, ZCoordinate=0)
pt_12 = ConstructPoint(XCoordinate=building_length, YCoordinate=building_width, ZCoordinate=wall_height_front)
multiplication_4 = Multiplication(A=distance_to_layer_3, B=-1)
rec_3pt = Rectangle3Pt(PointA=pt, PointB=pt_2, PointC=pt_3)  # -> Rectangle, Length
rec_3pt_2 = Rectangle3Pt(PointA=pt_4, PointB=pt_6, PointC=pt_11)  # -> Rectangle, Length
rec_3pt_3 = Rectangle3Pt(PointA=pt_5, PointB=pt_7, PointC=pt_8)  # -> Rectangle, Length
rec_3pt_4 = Rectangle3Pt(PointA=pt_9, PointB=pt_10, PointC=pt_12)  # -> Rectangle, Length
addition_7 = Addition(A=oter_wall_coner_radius, B=multiplication_2)
addition_8 = Addition(A=addition_7, B=multiplication_4)
explode = Explode(Curve=rec_3pt_4.Rectangle, Recursive=True)  # -> Segments, Vertices
fillet = Fillet(Curve=rec_3pt.Rectangle, Radius=oter_wall_coner_radius)
fillet_2 = Fillet(Curve=rec_3pt_3.Rectangle, Radius=addition_8)
fillet_3 = Fillet(Curve=rec_3pt_2.Rectangle, Radius=addition_7)
item = ListItem(List=explode.Vertices, Index=0, Wrap=True)  # -> Item, Item1, Item2, Item3
srf4pt = _4PointSurface(CornerA=item.Item, CornerB=item.Item1, CornerC=item.Item2, CornerD=item.Item3)
number_fo_points_in_center_wall = Slider(1000, range=0..1000)
points_for_column = Slider(13, range=0..300)
pt_13 = Point(<point referenced from the Rhino model>)
pt_14 = Point(<point referenced from the Rhino model>)
pt_15 = Point(<point referenced from the Rhino model>)
pt_16 = Point(pt_15)
divide = DivideCurve(Curve=fillet_3, Count=number_fo_points_in_center_wall, Kinks=False)  # -> Points, Tangents, Parameters
pdecon = Deconstruct(Point=pt_16)  # -> XComponent, YComponent, ZComponent
subtraction = Subtraction(A=points_for_column, B=1)
dom = ConstructDomain(DomainStart=0, DomainEnd=points_for_column)
cps = ClosestPoints(Point=pt_16, Cloud=divide.Points, Count=points_for_column)  # -> ClosestPoint, CPIndex, Distance
dom_2 = ConstructDomain(DomainStart=0, DomainEnd=1)
range = Range(Domain=subtraction, Steps=subtraction)
panel = Panel(pdecon.YComponent)
pdecon_2 = Deconstruct(Point=cps.ClosestPoint)  # -> XComponent, YComponent, ZComponent
remap = RemapNumbers(Value=range, Source=dom, Target=dom_2)  # -> Mapped, Clipped
crv = Curve([fillet, fillet_2])
graph = GraphMapper(
    remap.Mapped,
    x0=0,
    x1=1,
    y0=0,
    y1=1,
    container_name="Bezier",
    cpx=[0, 0.3127896488, 0.2499144822, 1],
    cpy=[0.6916825771, 0.6916825771, 0.005473315716, 0])
panel_2 = Panel(graph)
project = Project(Curve=crv, Brep=srf4pt, Direction=Vector(0, 0, 1))  # -> flatten(Curve)
graft = GraftTree(Tree=crv, IncludeEmptyLists=True, IncludeNullItems=True)
graft_2 = GraftTree(Tree=project, IncludeEmptyLists=True, IncludeNullItems=True)
multiplication_5 = Multiplication(A=pdecon.YComponent, B=graph)
subtraction_2 = Subtraction(A=pdecon_2.YComponent, B=multiplication_5)
panel_3 = Panel(multiplication_5)
pt_17 = ConstructPoint(XCoordinate=pdecon_2.XComponent, YCoordinate=subtraction_2, ZCoordinate=pdecon_2.ZComponent)
loft = Loft(Curves=[graft, graft_2], Options={Adjust=True, Closed=False, LoftEnds=0, LoftSimp=0, LoftType=5, Rebuild=10, Refit=0.01})
replace = ReplaceItems(List=divide.Points, Item=pt_17, Indices=cps.CPIndex, Wrap=False)
panel_4 = Panel(graft)
nurbs = NurbsCurve(Vertices=replace, Degree=3, Periodic=False)  # -> Curve, Length, Domain
panel_5 = Panel(subtraction_2)
connect = ConnectCurves(Curves=nurbs.Curve, Continuity=2, Close=True, Bulge=1)
crv_2 = Curve(connect)
project_2 = Project(Curve=crv_2, Brep=srf4pt, Direction=Vector(0, 0, 1), UseTasks=False)  # -> flatten(Curve)
graft_3 = GraftTree(Tree=crv_2, IncludeEmptyLists=True, IncludeNullItems=True)
graft_4 = GraftTree(Tree=project_2, IncludeEmptyLists=True, IncludeNullItems=True)
loft_2 = Loft(
    Curves=simplify([graft_3, graft_4]),
    Options={Adjust=True, Closed=False, LoftEnds=0, LoftSimp=0, LoftType=0, Rebuild=10, Refit=0.01})
