# Grasshopper definition Parametric Wall Design v 4.0 - Roof and column with Depth.gh (Grasshopper 1.0.7)

distance_to_layer_3 = Slider(3, range=0..10)
building_width = Slider(301, range=0..960)
building_length = Slider(793, range=0..960)
distance_to_layer_2 = Slider(12, range=0..30)
wall_height_back = Slider(169, range=0..300)
wall_height_front = Slider(195, range=0..300)
zero_zero_corner = Slider(0, range=0..100)
oter_wall_coner_radius = Slider(23, range=0..50)
multiplication = Multiplication(A=distance_to_layer_2, B=-1)
multiplication_2 = Multiplication(A=distance_to_layer_2, B=-1)
multiplication_3 = Multiplication(A=distance_to_layer_3, B=-1)
addition = Addition(A=building_width, B=multiplication)
addition_2 = Addition(A=zero_zero_corner, B=distance_to_layer_2)
addition_3 = Addition(A=building_length, B=multiplication)
addition_4 = Addition(A=addition_2, B=distance_to_layer_3)
addition_5 = Addition(A=addition, B=multiplication_3)
addition_6 = Addition(A=addition_3, B=multiplication_3)
X = UnitX(Factor=zero_zero_corner)
Y = UnitY(Factor=zero_zero_corner)
Y_2 = UnitY(Factor=building_width)
X_2 = UnitX(Factor=building_length)
Y_3 = UnitY(Factor=building_width)
X_3 = UnitX(Factor=zero_zero_corner)
X_4 = UnitX(Factor=addition_2)
X_5 = UnitX(Factor=addition_3)
Y_4 = UnitY(Factor=addition_2)
X_6 = UnitX(Factor=addition_2)
Y_5 = UnitY(Factor=addition)
Y_6 = UnitY(Factor=addition)
X_7 = UnitX(Factor=addition_4)
X_8 = UnitX(Factor=addition_6)
Y_7 = UnitY(Factor=addition_4)
X_9 = UnitX(Factor=addition_4)
Y_8 = UnitY(Factor=addition_5)
Y_9 = UnitY(Factor=addition_5)
pt = ConstructPoint(XCoordinate=X, YCoordinate=Y, ZCoordinate=0)
pt_2 = ConstructPoint(XCoordinate=X_3, YCoordinate=Y_3, ZCoordinate=0)
pt_3 = ConstructPoint(XCoordinate=X_2, YCoordinate=Y_2, ZCoordinate=0)
pt_4 = ConstructPoint(XCoordinate=X_4, YCoordinate=Y_4, ZCoordinate=0)
pt_5 = ConstructPoint(XCoordinate=X_7, YCoordinate=Y_7, ZCoordinate=0)
pt_6 = ConstructPoint(XCoordinate=X_6, YCoordinate=Y_5, ZCoordinate=0)
pt_7 = ConstructPoint(XCoordinate=X_9, YCoordinate=Y_8, ZCoordinate=0)
pt_8 = ConstructPoint(XCoordinate=X_8, YCoordinate=Y_9, ZCoordinate=0)
pt_9 = ConstructPoint(XCoordinate=zero_zero_corner, YCoordinate=zero_zero_corner, ZCoordinate=wall_height_back)
pt_10 = ConstructPoint(XCoordinate=zero_zero_corner, YCoordinate=building_width, ZCoordinate=wall_height_front)
pt_11 = ConstructPoint(XCoordinate=X_5, YCoordinate=Y_6, ZCoordinate=0)
pt_12 = ConstructPoint(XCoordinate=building_length, YCoordinate=building_width, ZCoordinate=wall_height_front)
multiplication_4 = Multiplication(A=distance_to_layer_3, B=-1)
rec_3pt = Rectangle3Pt(PointA=pt, PointB=pt_2, PointC=pt_3)  # -> Rectangle, Length
rec_3pt_2 = Rectangle3Pt(PointA=pt_4, PointB=pt_6, PointC=pt_11)  # -> Rectangle, Length
rec_3pt_3 = Rectangle3Pt(PointA=pt_5, PointB=pt_7, PointC=pt_8)  # -> Rectangle, Length
rec_3pt_4 = Rectangle3Pt(PointA=pt_9, PointB=pt_10, PointC=pt_12)  # -> Rectangle, Length
addition_7 = Addition(A=oter_wall_coner_radius, B=multiplication_2)
addition_8 = Addition(A=addition_7, B=multiplication_4)
explode = Explode(Curve=rec_3pt_4.Rectangle, Recursive=True)  # -> Segments, Vertices
fillet = Fillet(Curve=rec_3pt.Rectangle, Radius=oter_wall_coner_radius)
fillet_2 = Fillet(Curve=rec_3pt_3.Rectangle, Radius=addition_8)
fillet_3 = Fillet(Curve=rec_3pt_2.Rectangle, Radius=addition_7)
number_fo_points_in_center_wall = Slider(1000, range=0..1000)
item = ListItem(List=explode.Vertices, Index=0, Wrap=True)  # -> Item, Item1, Item2, Item3
srf4pt = _4PointSurface(CornerA=item.Item, CornerB=item.Item1, CornerC=item.Item2, CornerD=item.Item3)
points_for_column_width = Slider(17, range=0..300)
divide = DivideCurve(Curve=fillet, Count=number_fo_points_in_center_wall, Kinks=False)  # -> Points, Tangents, Parameters
column_depth = Slider(11, range=0..20)
pt_13 = Point(<point referenced from the Rhino model>)
pt_14 = Point(<point referenced from the Rhino model>)
divide_2 = DivideCurve(Curve=fillet_3, Count=number_fo_points_in_center_wall, Kinks=False)  # -> Points, Tangents, Parameters
# TODO: Run the points to build the
# full line with columns first, then project and loft.
# Iterating with mulitple curves messes up
# the loft and creates high
# process times. -- See version 5.
number_slider = Slider(903, range=0..1000)
divide_3 = DivideCurve(Curve=fillet_2, Count=number_fo_points_in_center_wall, Kinks=False)  # -> Points, Tangents, Parameters
pt_15 = Point(pt_13)
nurbs = NurbsCurve(Vertices=divide.Points, Degree=3, Periodic=False)  # -> Curve, Length, Domain
number_slider_2 = Slider(903, range=0..1000)
nurbs_2 = NurbsCurve(Vertices=divide_3.Points, Degree=3, Periodic=False)  # -> Curve, Length, Domain
crv = Curve(nurbs.Curve)
project = Project(Curve=crv, Brep=srf4pt, Direction=Vector(0, 0, 1))  # -> flatten(Curve)
crv_2 = Curve(nurbs_2.Curve)
project_2 = Project(Curve=crv_2, Brep=srf4pt, Direction=Vector(0, 0, 1))  # -> flatten(Curve)
pdecon = Deconstruct(Point=pt_15)  # -> XComponent, YComponent, ZComponent
seam = Seam(Curve=project, Seam=number_slider)  # -> flatten(Curve)
seam_2 = Seam(Curve=crv, Seam=number_slider)
subtraction = Subtraction(A=points_for_column_width, B=1)
dom = ConstructDomain(DomainStart=0, DomainEnd=points_for_column_width)
seam_3 = Seam(Curve=project_2, Seam=number_slider_2)  # -> flatten(Curve)
seam_4 = Seam(Curve=crv_2, Seam=number_slider_2)
range = Range(Domain=subtraction, Steps=subtraction)
dom_2 = ConstructDomain(DomainStart=0, DomainEnd=1)
cps = ClosestPoints(Point=pt_15, Cloud=divide_2.Points, Count=points_for_column_width)  # -> ClosestPoint, CPIndex, Distance
end = EndPoints(Curve=seam)  # -> Start, End
end_2 = EndPoints(Curve=seam_2)  # -> Start, End
end_3 = EndPoints(Curve=seam_3)  # -> Start, End
loft = Loft(
    Curves=flatten([seam, seam_2]),
    Options={Adjust=False, Closed=False, LoftEnds=0, LoftSimp=0, LoftType=0, Rebuild=10, Refit=0.01})
end_4 = EndPoints(Curve=seam_4)  # -> Start, End
remap = RemapNumbers(Value=range, Source=dom, Target=dom_2)  # -> Mapped, Clipped
loft_2 = Loft(
    Curves=flatten([seam_3, seam_4]),
    Options={Adjust=False, Closed=False, LoftEnds=0, LoftSimp=0, LoftType=0, Rebuild=10, Refit=0.01})
graph = GraphMapper(
    remap.Mapped,
    x0=0,
    x1=1,
    y0=0,
    y1=1,
    container_name="Bezier",
    cpx=[0, 0.3127896488, 0.2499144822, 1],
    cpy=[0.6916825771, 0.6916825771, 0.005473315716, 0])
multiplication_5 = Multiplication(A=column_depth, B=graph)
multiplication_6 = Multiplication(A=multiplication_5, B=-1)
panel = Panel(pdecon.YComponent)
# Translate will be better than replace.
Y_10 = UnitY(Factor=multiplication_6)
move = Move(Geometry=cps.ClosestPoint, Motion=Y_10)  # -> Geometry, Transform
replace = ReplaceItems(List=divide_2.Points, Item=move.Geometry, Indices=cps.CPIndex, Wrap=False)
panel_2 = Panel(graph)
nurbs_3 = NurbsCurve(Vertices=replace, Degree=3, Periodic=False)  # -> Curve, Length, Domain
crv_3 = Curve(nurbs_3.Curve)
panel_3 = Panel(multiplication_5)
number_slider_3 = Slider(0, range=0..1000)
project_3 = Project(Curve=crv_3, Brep=srf4pt, Direction=Vector(0, 0, 1))  # -> flatten(Curve)
seam_5 = Seam(Curve=project_3, Seam=number_slider_3)
seam_6 = Seam(Curve=crv_3, Seam=number_slider_3)
graft = GraftTree(Tree=seam_6, IncludeEmptyLists=True, IncludeNullItems=True)
graft_2 = GraftTree(Tree=seam_5, IncludeEmptyLists=True, IncludeNullItems=True)
end_5 = EndPoints(Curve=seam_5)  # -> Start, End
end_6 = EndPoints(Curve=seam_6)  # -> Start, End
loft_3 = Loft(
    Curves=flatten([graft_2, graft]),
    Options={Adjust=False, Closed=False, LoftEnds=0, LoftSimp=0, LoftType=0, Rebuild=10, Refit=0.01})
