# Grasshopper definition Parametric Wall Design v 5.0 - Sinewave Inner Wall Strcuture.gh (Grasshopper 1.0.7)

distance_to_center_wall = Slider(3, range=0..10)
distance_to_inner_wall = Slider(4, range=0..10)
column_alignment_adjustment = Slider(-3.236, range=-10..10)
points_in_base_curves = Slider(1000, range=0..1000)
column_frequency = Slider(0.625, range=0..1)
outer_wall_coner_radius = Slider(10, range=0..30)
building_length = Slider(243, range=0..1000)
roof_height_front = Slider(104, range=0..300)
roof_height_back = Slider(81, range=0..300)
# Center Wall Front
column_amplitude = Slider(5, range=0..10)
building_depth = Slider(190, range=0..1000)
wall_height = Slider(82, range=0..300)
# Main Parmeters
zero_zero_corner = Slider(0, range=0..100)
# Center Wall Left
column_amplitude_2 = Slider(5, range=0..10)
column_frequency_2 = Slider(0.871, range=0..1)
column_alignment_adjustment_2 = Slider(-3.181, range=-10..10)
# Center Wall Corners
num = Number(outer_wall_coner_radius)
Y = UnitY(Factor=column_frequency_2)
X = UnitX(Factor=column_frequency)
multiplication = Multiplication(A=distance_to_center_wall, B=-1)
multiplication_2 = Multiplication(A=distance_to_center_wall, B=-1)
multiplication_3 = Multiplication(A=num, B=2)
addition = Addition(A=outer_wall_coner_radius, B=multiplication_2)
multiplication_4 = Multiplication(A=num, B=2)
addition_2 = Addition(A=building_depth, B=multiplication)
addition_3 = Addition(A=zero_zero_corner, B=distance_to_center_wall)
subtraction = Subtraction(A=building_depth, B=multiplication_3)
subtraction_2 = Subtraction(A=building_length, B=multiplication_4)
addition_4 = Addition(A=building_length, B=multiplication)
# Outer Wall
X_2 = UnitX(Factor=zero_zero_corner)
Y_2 = UnitY(Factor=zero_zero_corner)
Y_3 = UnitY(Factor=building_depth)
X_3 = UnitX(Factor=building_length)
Y_4 = UnitY(Factor=building_depth)
X_4 = UnitX(Factor=zero_zero_corner)
addition_5 = Addition(A=zero_zero_corner, B=num)
addition_6 = Addition(A=zero_zero_corner, B=num)
subtraction_3 = Subtraction(A=subtraction, B=distance_to_center_wall)
subtraction_4 = Subtraction(A=subtraction_2, B=distance_to_center_wall)
pt = ConstructPoint(XCoordinate=X_2, YCoordinate=Y_2, ZCoordinate=0)
pt_2 = ConstructPoint(XCoordinate=X_4, YCoordinate=Y_4, ZCoordinate=0)
pt_3 = ConstructPoint(XCoordinate=X_3, YCoordinate=Y_3, ZCoordinate=0)
division = Division(A=subtraction_3, B=column_frequency_2)
pt_4 = ConstructPoint(XCoordinate=0, YCoordinate=addition_5, ZCoordinate=0)
pt_5 = ConstructPoint(XCoordinate=addition_6, YCoordinate=0, ZCoordinate=0)
division_2 = Division(A=subtraction_4, B=column_frequency)
X_5 = UnitX(Factor=addition_3)
X_6 = UnitX(Factor=addition_4)
Y_5 = UnitY(Factor=addition_3)
X_7 = UnitX(Factor=addition_3)
Y_6 = UnitY(Factor=addition_2)
Y_7 = UnitY(Factor=addition_2)
Y_8 = UnitY(Factor=num)
X_8 = UnitX(Factor=num)
rec_3pt = Rectangle3Pt(PointA=pt, PointB=pt_2, PointC=pt_3)  # -> Rectangle, Length
arrlinear = LinearArray(Geometry=pt_4, Direction=Y, Count=division)  # -> Geometry, Transform
arrlinear_2 = LinearArray(Geometry=pt_5, Direction=X, Count=division_2)  # -> Geometry, Transform
pt_6 = ConstructPoint(XCoordinate=X_6, YCoordinate=Y_7, ZCoordinate=0)
pt_7 = ConstructPoint(XCoordinate=X_7, YCoordinate=Y_6, ZCoordinate=Y_6)
pt_8 = ConstructPoint(XCoordinate=X_6, YCoordinate=Y_5, ZCoordinate=0)
# Middle
pt_9 = ConstructPoint(XCoordinate=X_5, YCoordinate=Y_5, ZCoordinate=0)
fillet = Fillet(Curve=rec_3pt.Rectangle, Radius=outer_wall_coner_radius)
pdecon = Deconstruct(Point=arrlinear_2.Geometry)  # -> XComponent, YComponent, ZComponent
pdecon_2 = Deconstruct(Point=arrlinear.Geometry)  # -> XComponent, YComponent, ZComponent
Z = UnitZ(Factor=wall_height)
divide = DivideCurve(Curve=fillet, Count=points_in_base_curves, Kinks=False)  # -> Points, Tangents, Parameters
subtraction_5 = Subtraction(A=Y_6, B=Y_8)
subtraction_6 = Subtraction(A=X_6, B=X_8)
graph = GraphMapper(
    pdecon_2.YComponent,
    x0=0,
    x1=1,
    y0=0,
    y1=1,
    container_name="Sine",
    Equation_px=[0.392413944, 0.8028169274],
    Equation_py=[0.3522580862, 0.7801799774])
graph_2 = GraphMapper(
    pdecon.XComponent,
    x0=0,
    x1=1,
    y0=0,
    y1=1,
    container_name="Sine",
    Equation_px=[0.701164782, 1],
    Equation_py=[0.3378564715, 0.6785891056])
intcrv = Interpolate(Vertices=divide.Points, Degree=3, Periodic=False, KnotStyle=1)  # -> flatten(Curve), Length, Domain
pt_10 = ConstructPoint(XCoordinate=subtraction_6, YCoordinate=Y_7, ZCoordinate=0)
# First
pt_11 = ConstructPoint(XCoordinate=X_8, YCoordinate=Y_5, ZCoordinate=0)
pt_12 = ConstructPoint(XCoordinate=X_7, YCoordinate=subtraction_5, ZCoordinate=0)
pt_13 = ConstructPoint(XCoordinate=X_6, YCoordinate=num, ZCoordinate=0)
multiplication_5 = Multiplication(A=graph_2, B=column_amplitude)
multiplication_6 = Multiplication(A=graph, B=column_amplitude_2)
subtraction_7 = Subtraction(A=Y_7, B=Y_8)
subtraction_8 = Subtraction(A=X_6, B=X_8)
addition_7 = Addition(A=multiplication_5, B=addition_3)
addition_8 = Addition(A=multiplication_6, B=addition_3)
# Build Center Wall Corners
# Order of points is important - we'll go clockwise.
# 
# TODO: align sinewave end points better.
# Last
pt_14 = ConstructPoint(XCoordinate=X_5, YCoordinate=Y_8, ZCoordinate=0)
pt_15 = ConstructPoint(XCoordinate=num, YCoordinate=Y_6, ZCoordinate=0)
pt_16 = ConstructPoint(XCoordinate=X_6, YCoordinate=subtraction_7, ZCoordinate=0)
pt_17 = ConstructPoint(XCoordinate=subtraction_8, YCoordinate=Y_5, ZCoordinate=0)
addition_9 = Addition(A=addition_7, B=column_alignment_adjustment)
pt_18 = ConstructPoint(XCoordinate=pdecon.XComponent, YCoordinate=addition_9, ZCoordinate=pdecon.ZComponent)
rev = ReverseList(List=pt_18)
addition_10 = Addition(A=addition_8, B=column_alignment_adjustment_2)
pt_19 = ConstructPoint(XCoordinate=addition_10, YCoordinate=pdecon_2.YComponent, ZCoordinate=pdecon_2.ZComponent)
extr = Extrude(Base=intcrv.Curve, Direction=Z)
X_9 = UnitX(Factor=Slider(1, range=-20..20))
Y_9 = UnitY(Factor=Slider(1, range=-20..20))
Y_10 = UnitY(Factor=Slider(-1, range=-20..20))
X_10 = UnitX(Factor=Slider(-1, range=-20..20))
# Center Wall Right
subtraction_9 = Subtraction(A=addition_4, B=addition_3)
# Center Wall Back
subtraction_10 = Subtraction(A=addition_2, B=addition_3)
multiplication_7 = Multiplication(A=distance_to_inner_wall, B=-1)
X_11 = UnitX(Factor=subtraction_9)
arc = ArcSED(Start=pt_11, End=pt_14, Direction=X_10)  # -> Arc, Plane, Radius
arc_2 = ArcSED(Start=pt_12, End=pt_15, Direction=Y_9)  # -> Arc, Plane, Radius
arc_3 = ArcSED(Start=pt_10, End=pt_16, Direction=X_9)  # -> Arc, Plane, Radius
arc_4 = ArcSED(Start=pt_13, End=pt_17, Direction=Y_10)  # -> Arc, Plane, Radius
Y_11 = UnitY(Factor=subtraction_10)
# Roof - a bit bigger than the outer wall
addition_11 = Addition(A=addition_4, B=multiplication_7)
# Inner Wall
addition_12 = Addition(A=addition_3, B=distance_to_inner_wall)
addition_13 = Addition(A=building_depth, B=1)
addition_14 = Addition(A=building_length, B=1)
addition_15 = Addition(A=addition_2, B=multiplication_7)
move = Move(Geometry=pt_19, Motion=X_11)  # -> Geometry, Transform
move_2 = Move(Geometry=pt_18, Motion=Y_11)  # -> Geometry, Transform
divide_2 = DivideCurve(Curve=arc.Arc, Count=10, Kinks=False)  # -> Points, Tangents, Parameters
divide_3 = DivideCurve(Curve=arc_2.Arc, Count=10, Kinks=False)  # -> Points, Tangents, Parameters
divide_4 = DivideCurve(Curve=arc_4.Arc, Count=10, Kinks=False)  # -> Points, Tangents, Parameters
divide_5 = DivideCurve(Curve=arc_3.Arc, Count=10, Kinks=False)  # -> Points, Tangents, Parameters
Z_2 = UnitZ(Factor=roof_height_front)
Y_12 = UnitY(Factor=addition_13)
Z_3 = UnitZ(Factor=roof_height_back)
X_12 = UnitX(Factor=addition_14)
X_13 = UnitX(Factor=addition_12)
X_14 = UnitX(Factor=addition_11)
Y_13 = UnitY(Factor=addition_12)
X_15 = UnitX(Factor=addition_12)
Y_14 = UnitY(Factor=addition_15)
Y_15 = UnitY(Factor=addition_15)
rev_2 = ReverseList(List=move.Geometry)
pt_20 = ConstructPoint(XCoordinate=X_13, YCoordinate=Y_13, ZCoordinate=0)
pt_21 = ConstructPoint(XCoordinate=X_15, YCoordinate=Y_14, ZCoordinate=0)
pt_22 = ConstructPoint(XCoordinate=X_14, YCoordinate=Y_15, ZCoordinate=0)
pt_23 = ConstructPoint(XCoordinate=-1, YCoordinate=Y_12, ZCoordinate=Z_3)
pt_24 = ConstructPoint(XCoordinate=-1, YCoordinate=-1, ZCoordinate=Z_2)
# Build wall staight from points.
# Two lists were reversed to keep the flow correct.
pt_25 = ConstructPoint(XCoordinate=X_12, YCoordinate=Y_12, ZCoordinate=Z_3)
multiplication_8 = Multiplication(A=distance_to_inner_wall, B=-1)
rec_3pt_2 = Rectangle3Pt(PointA=pt_20, PointB=pt_21, PointC=pt_22)  # -> Rectangle, Length
rec_3pt_3 = Rectangle3Pt(PointA=pt_24, PointB=pt_23, PointC=pt_25)  # -> Rectangle, Length
addition_16 = Addition(A=addition, B=multiplication_8)
pt_26 = Point([divide_2.Points, pt_19, divide_3.Points, move_2.Geometry, divide_5.Points, rev_2, divide_4.Points, rev])
explode = Explode(Curve=rec_3pt_3.Rectangle, Recursive=True)  # -> Segments, Vertices
fillet_2 = Fillet(Curve=rec_3pt_2.Rectangle, Radius=addition_16)
intcrv_2 = Interpolate(Vertices=pt_26, Degree=3, Periodic=False, KnotStyle=1)  # -> flatten(Curve), Length, Domain
item = ListItem(List=explode.Vertices, Index=0, Wrap=True)  # -> Item, Item1, Item2, Item3
divide_6 = DivideCurve(Curve=fillet_2, Count=points_in_base_curves, Kinks=False)  # -> Points, Tangents, Parameters
connect = ConnectCurves(Curves=intcrv_2.Curve, Continuity=2, Close=True, Bulge=1)  # -> flatten(Curve)
srf4pt = _4PointSurface(CornerA=item.Item, CornerB=item.Item1, CornerC=item.Item2, CornerD=item.Item3)
project = Project(Curve=intcrv.Curve, Brep=srf4pt, Direction=Vector(0, 0, 1))  # -> flatten(Curve)
loft = Loft(
    Curves=flatten([project, intcrv.Curve]),
    Options={Adjust=True, Closed=False, LoftEnds=0, LoftSimp=0, LoftType=0, Rebuild=10, Refit=0.01})
intcrv_3 = Interpolate(Vertices=divide_6.Points, Degree=3, Periodic=False, KnotStyle=1)  # -> flatten(Curve), Length, Domain
project_2 = Project(Curve=connect, Brep=srf4pt, Direction=Vector(0, 0, 1))  # -> flatten(Curve)
project_3 = Project(Curve=intcrv_3.Curve, Brep=srf4pt, Direction=Vector(0, 0, 1))  # -> flatten(Curve)
# Its better to preview work with Extrude,
# and then if needed switch to loft for
# the top angle on the walls etc.
extr_2 = Extrude(Base=connect, Direction=Z)
loft_2 = Loft(
    Curves=[project_2, connect],
    Options={Adjust=False, Closed=False, LoftEnds=0, LoftSimp=0, LoftType=0, Rebuild=10, Refit=0.01})
extr_3 = Extrude(Base=intcrv_3.Curve, Direction=Z)
loft_3 = Loft(
    Curves=flatten([project_3, intcrv_3.Curve]),
    Options={Adjust=True, Closed=False, LoftEnds=0, LoftSimp=0, LoftType=0, Rebuild=10, Refit=0.01})
