# Grasshopper definition Parametric Wall Design.gh (Grasshopper 1.0.7)

distance_to_layer_2 = Slider(2, range=0..10)
distance_to_layer_3 = Slider(4, range=0..10)
wall_height = Slider(15, range=0..100)
zero_zero_corner = Slider(0, range=0..100)
oter_wall_coner_radius = Slider(19, range=0..30)
building_width = Slider(63, range=0..100)
building_length = Slider(65, range=0..100)
multiplication = Multiplication(A=distance_to_layer_2, B=-1)
multiplication_2 = Multiplication(A=distance_to_layer_2, B=-1)
multiplication_3 = Multiplication(A=distance_to_layer_3, B=-1)
addition = Addition(A=building_width, B=multiplication)
addition_2 = Addition(A=zero_zero_corner, B=distance_to_layer_2)
addition_3 = Addition(A=building_length, B=multiplication)
addition_4 = Addition(A=addition_2, B=distance_to_layer_3)
addition_5 = Addition(A=addition, B=multiplication_3)
addition_6 = Addition(A=addition_3, B=multiplication_3)
X = UnitX(Factor=zero_zero_corner)
Y = UnitY(Factor=zero_zero_corner)
Y_2 = UnitY(Factor=building_width)
X_2 = UnitX(Factor=building_length)
Y_3 = UnitY(Factor=building_width)
X_3 = UnitX(Factor=zero_zero_corner)
X_4 = UnitX(Factor=addition_2)
X_5 = UnitX(Factor=addition_3)
Y_4 = UnitY(Factor=addition_2)
X_6 = UnitX(Factor=addition_2)
Y_5 = UnitY(Factor=addition)
Y_6 = UnitY(Factor=addition)
X_7 = UnitX(Factor=addition_4)
X_8 = UnitX(Factor=addition_6)
Y_7 = UnitY(Factor=addition_4)
X_9 = UnitX(Factor=addition_4)
Y_8 = UnitY(Factor=addition_5)
Y_9 = UnitY(Factor=addition_5)
pt = ConstructPoint(XCoordinate=X, YCoordinate=Y, ZCoordinate=0)
pt_2 = ConstructPoint(XCoordinate=X_3, YCoordinate=Y_3, ZCoordinate=0)
pt_3 = ConstructPoint(XCoordinate=X_2, YCoordinate=Y_2, ZCoordinate=0)
pt_4 = ConstructPoint(XCoordinate=X_4, YCoordinate=Y_4, ZCoordinate=0)
pt_5 = ConstructPoint(XCoordinate=X_7, YCoordinate=Y_7, ZCoordinate=0)
pt_6 = ConstructPoint(XCoordinate=X_6, YCoordinate=Y_5, ZCoordinate=0)
pt_7 = ConstructPoint(XCoordinate=X_9, YCoordinate=Y_8, ZCoordinate=0)
pt_8 = ConstructPoint(XCoordinate=X_5, YCoordinate=Y_6, ZCoordinate=0)
pt_9 = ConstructPoint(XCoordinate=X_8, YCoordinate=Y_9, ZCoordinate=0)
multiplication_4 = Multiplication(A=distance_to_layer_3, B=-1)
rec_3pt = Rectangle3Pt(PointA=pt, PointB=pt_2, PointC=pt_3)  # -> Rectangle, Length
rec_3pt_2 = Rectangle3Pt(PointA=pt_4, PointB=pt_6, PointC=pt_8)  # -> Rectangle, Length
rec_3pt_3 = Rectangle3Pt(PointA=pt_5, PointB=pt_7, PointC=pt_9)  # -> Rectangle, Length
addition_7 = Addition(A=oter_wall_coner_radius, B=multiplication_2)
addition_8 = Addition(A=addition_7, B=multiplication_4)
fillet = Fillet(Curve=rec_3pt.Rectangle, Radius=oter_wall_coner_radius)
fillet_2 = Fillet(Curve=rec_3pt_2.Rectangle, Radius=addition_7)
fillet_3 = Fillet(Curve=rec_3pt_3.Rectangle, Radius=addition_8)
Z = UnitZ(Factor=wall_height)
extr = Extrude(Base=fillet, Direction=Z)
extr_2 = Extrude(Base=fillet_2, Direction=Z)
extr_3 = Extrude(Base=fillet_3, Direction=Z)
