# Grasshopper definition Single_Wall_Column_Design.gh (Grasshopper 1.0.7)

# Add a curve into wherever you break
# another curve
# First define the column curve you want
# So start with inner column width
inner_column_width = Slider(101.6, range=0..1000)
inner_column_distance_from_wall = Slider(50, range=0..1000)
curve_start_point_offset = Slider(12.049, range=0..200)
inner_stem_spacing = Slider(10.432, range=0..50)
stem_start_from_outer_wall = Slider(2.8, range=0..25)
stem_length = Slider(64.219, range=0..1000)
point = Point(<point referenced from the Rhino model>)
inner_wyth_offset = Slider(-50, range=-100..100)
point_2 = Point(<point referenced from the Rhino model>)  # disabled
extrusion_path_offset = Slider(-25, range=-100..100)
curve = Curve(<curve referenced from the Rhino model>)
outside_corner_radius = Slider(50, range=0..50)
deconstruct = Deconstruct(Point=[point, point_2])  # -> XComponent, YComponent, ZComponent
number_slider = Slider(0.25, range=0..1)
number_slider_2 = Slider(4.842, range=0..20)
radians = Radians(Degrees=inner_column_width)
vector = Vector()
unit_z = UnitZ(Factor=Slider(17.162, range=0..20))
addition = Addition(A=stem_start_from_outer_wall, B=deconstruct.XComponent)
fillet = Fillet(Curve=curve, Radius=outside_corner_radius)
arc = Arc(Plane=PlaneXY(0, 0, 0), Radius=1, Angle=radians)  # -> Arc, Length
addition_2 = Addition(A=inner_column_width, B=addition)
circular_arc = CircularArc(arc.Arc)
subtraction = Subtraction(A=addition_2, B=addition)
point_charge = PointCharge(Point=<geometry referenced from the Rhino model>, Charge=Slider(-832, range=-1000..1000), Decay=2)
subtraction_2 = Subtraction(A=deconstruct.YComponent, B=curve_start_point_offset)
# Make sub-function
addition_3 = Addition(A=deconstruct.YComponent, B=curve_start_point_offset)
division = Division(A=subtraction, B=2)
bend_deform = BendDeform(Geometry=curve, BendingArc=circular_arc)  # disabled
addition_4 = Addition(A=deconstruct.XComponent, B=inner_column_distance_from_wall)
point_deform = PointDeform(Geometry=curve, Points=Point(305.7056952, -1.273048975, 0), Motion=unit_z)  # disabled
field_line = FieldLine(Field=point_charge, Point=<geometry referenced from the Rhino model>, Steps=1000, Accuracy=0.1, Method=3)
addition_5 = Addition(A=division, B=inner_column_distance_from_wall)
addition_6 = Addition()
subtraction_3 = Subtraction(A=deconstruct.YComponent, B=division)
addition_7 = Addition(A=deconstruct.YComponent, B=division)
addition_8 = Addition(A=inner_column_width, B=addition_4)
# inner column center
construct_point = ConstructPoint(XCoordinate=addition_5, YCoordinate=deconstruct.YComponent, ZCoordinate=deconstruct.ZComponent)
subtraction_4 = Subtraction(A=deconstruct.YComponent, B=inner_stem_spacing)
addition_9 = Addition(A=addition, B=stem_length)
addition_10 = Addition(A=deconstruct.YComponent, B=inner_stem_spacing)
# inner stem start
construct_point_2 = ConstructPoint(XCoordinate=addition, YCoordinate=addition_10, ZCoordinate=deconstruct.ZComponent)
# curve start
construct_point_3 = ConstructPoint(XCoordinate=deconstruct.XComponent, YCoordinate=addition_3, ZCoordinate=deconstruct.ZComponent)
# inner column sides
construct_point_4 = ConstructPoint(XCoordinate=addition_5, YCoordinate=addition_7, ZCoordinate=deconstruct.ZComponent)
# inner column start
construct_point_5 = ConstructPoint(XCoordinate=addition_9, YCoordinate=addition_10, ZCoordinate=deconstruct.ZComponent)
# inner column vertex
construct_point_6 = ConstructPoint(XCoordinate=addition_8, YCoordinate=deconstruct.YComponent, ZCoordinate=deconstruct.ZComponent)
# inner column sides
construct_point_7 = ConstructPoint(XCoordinate=addition_5, YCoordinate=subtraction_3, ZCoordinate=deconstruct.ZComponent)
# inner column end
construct_point_8 = ConstructPoint(XCoordinate=addition_9, YCoordinate=subtraction_4, ZCoordinate=deconstruct.ZComponent)
# curve end
construct_point_9 = ConstructPoint(XCoordinate=deconstruct.XComponent, YCoordinate=subtraction_2, ZCoordinate=deconstruct.ZComponent)
# inner stem end
construct_point_10 = ConstructPoint(XCoordinate=addition, YCoordinate=subtraction_4, ZCoordinate=deconstruct.ZComponent)
merge = Merge(
    Data1=construct_point_3,
    Data2=construct_point_2,
    Data3=construct_point_5,
    Data4=construct_point_4,
    Data5=construct_point_6,
    Data6=construct_point_7,
    Data7=construct_point_8,
    Data8=construct_point_10,
    Data9=construct_point_9)
curve_closest_point = CurveClosestPoint(Point=[construct_point_9, construct_point_3], Curve=fillet)  # -> Point, flatten(Parameter), Distance
number_slider_3 = Slider(3, range=0..10)
interpolate = Interpolate(Vertices=merge, Degree=3, Periodic=False, KnotStyle=1)  # -> Curve, Length, Domain
number_slider_4 = Slider(36, range=0..150)
number_slider_5 = Slider(769, range=0..1500)
# Build domains from start and stop
# of each column, etc.
number_slider_6 = Slider(0, range=0..1500)
list_item = ListItem(List=curve_closest_point.Parameter, Index=0, Wrap=True)
list_item_2 = ListItem(List=curve_closest_point.Parameter, Index=1, Wrap=True)
stem_length_2 = Slider(0, range=0..3153)
construct_domain = ConstructDomain(DomainStart=[number_slider_6, list_item_2], DomainEnd=[list_item, Slider(5066, range=-1..10000)])
sub_curve = SubCurve(BaseCurve=fillet, Domain=construct_domain)
list_item_3 = ListItem(List=sub_curve, Index=1, Wrap=True)
list_item_4 = ListItem(List=sub_curve, Index=0, Wrap=True)
merge_2 = Merge(Data1=list_item_4, Data2=interpolate.Curve, Data3=list_item_3)
# Add the domain then insert column, add next
# domain, next column, etc.
# Join Works!
join_curves = JoinCurves(Curves=merge_2, Preserve=False)
offset_curve = OffsetCurve(Curve=join_curves, Distance=inner_wyth_offset, Corners=1)
offset_curve_2 = OffsetCurve(Curve=join_curves, Distance=extrusion_path_offset, Corners=1)
