# Grasshopper definition Six Striaght Test Walls joined 2 in bead Squish4.gh (Grasshopper 1.0.7)
# plug-ins: Silkworm

bead_width = Slider(25, range=0..100)
# Two straight Walls With Double Wyth
# (two 1" beads to make a 2" thick inner and
#  outter wall) - the bridge between the two
#  should be cut
# First Wall Parmeters
farthest_left = Slider(-47, range=-100..101)
start_point_x = Slider(0, range=-10..100)
start_point_y = Slider(0, range=-10..100)
wyth_offset = Slider(25, range=0..100)
# segment length of 16 was too jerky
# segment length of 4 was smooth with 38 radius
# - but was bad with 60  (Yoff 80, X off 38)
# - changing to length of 8 - better (Y off 68, X off 32)
# - changing to length of 10 and radius of 50 (Y off y 35, X off by 6)
# - changing to length of 12 and radius of 45 (Y off y 30, X off by 27)
# --- 4-16-22 with new motor settings we can do fine points again.
# (Better for no path planning issues)
#        - length of 6 and radius of 70
length_of_curve_segments = Slider(6, range=0..20)
building_length = Slider(1153, range=0..2000)
outer_wall_coner_radius = Slider(22, range=0..100)
wall_height = Slider(25, range=0..5000)
building_depth = Slider(200, range=0..1000)
print_speed = Slider(2873, range=0..5000)
wall_thickness = Slider(200, range=0..300)
bridge_location4 = Slider(50, range=-100..101)
# Bridge Between Walls
bridge_location = Slider(-50, range=-100..101)
bridge_location2 = Slider(-55, range=-100..101)
bridge_location3 = Slider(0, range=-100..101)
inverse = Slider(-1, range=-1..1)
ramp_adjust_height = Slider(5, range=0..100)
ramp_adjust_x = Slider(-6, range=-100..101)
layer_height = Slider(25, range=0..100)
inverse_2 = Slider(-1, range=-1..1)
division = Division(A=wall_height, B=layer_height)
# Farthest Left
# plus Offset
# Start Y
# plus Offset
multiplication = Multiplication(A=wyth_offset, B=inverse)
Y = UnitY(Factor=start_point_y)
Y_2 = UnitY(Factor=building_depth)
X = UnitX(Factor=building_length)
series = Series(Start=0, Step=1, Count=division)
multiplication_2 = Multiplication(B=inverse_2)
addition = Addition(A=start_point_y, B=wall_thickness)
addition_2 = Addition(A=farthest_left, B=wall_thickness)
multiplication_3 = Multiplication(A=series, B=layer_height)
addition_3 = Addition(A=start_point_y, B=wyth_offset)
addition_4 = Addition(A=farthest_left, B=wyth_offset)
# Wall Thickness
# minus Offset
addition_5 = Addition(A=wall_thickness, B=multiplication)
# Inside Corner
# minus Offset
addition_6 = Addition(A=addition_2, B=multiplication)
# Bulding Depth
# minus Offset
addition_7 = Addition(A=building_depth, B=multiplication)
# Bulding Length
# minus Offset
addition_8 = Addition(A=building_length, B=multiplication)
# Inside Corner
# Top Left Corner
# Bottom Left Corner
# Back to the first point
# Inner Wyth Points
# Inside Corner
# minus Offset
addition_9 = Addition(B=multiplication_2)
# Start Y
# plus Offset
addition_10 = Addition()
# Farthest Left
# plus Offset
addition_11 = Addition()
# Wall Thickness
# minus Offset
addition_12 = Addition(B=multiplication_2)
# Bulding Depth
# minus Offset
addition_13 = Addition(B=multiplication_2)
# Bulding Length
# minus Offset
addition_14 = Addition(B=multiplication_2)
# Up to next layer
# Corner Wall Points
# Start Point
# Gradually Rise from 0 Z
# Start Material Flow once moving
# Bottom Right Corner
addition_15 = Addition(B=layer_height)
# Inside Corner
pt = ConstructPoint(XCoordinate=bridge_location3, YCoordinate=addition, ZCoordinate=0)
# Bottom Left Corner
pt_2 = ConstructPoint(XCoordinate=farthest_left, YCoordinate=Y, ZCoordinate=0)
pt_3 = ConstructPoint(XCoordinate=start_point_x, YCoordinate=Y, ZCoordinate=0)
# Corner Wall Points
pt_4 = ConstructPoint(XCoordinate=start_point_x, YCoordinate=Y, ZCoordinate=0)
pt_5 = ConstructPoint(XCoordinate=X, YCoordinate=Y, ZCoordinate=0)
pt_6 = ConstructPoint(XCoordinate=X, YCoordinate=addition, ZCoordinate=0)
# Back to the first point
# Inner Wyth Points
pt_7 = ConstructPoint(XCoordinate=start_point_y, YCoordinate=Y, ZCoordinate=layer_height)
number_slider = Slider(300, range=0..5000)
number_slider_2 = Slider(6, range=0..20)
multiplication_4 = Multiplication(A=number_slider, B=number_slider_2)
subtraction = Subtraction(A=multiplication_4, B=number_slider)
merge = Merge(Data1=pt_4, Data2=pt_5, Data3=pt_6, Data4=pt)
addition_16 = Addition(A=subtraction, B=building_depth)
# Top Left Corner
pt_8 = ConstructPoint(XCoordinate=farthest_left, YCoordinate=addition_16, ZCoordinate=0)
series_2 = Series(Start=Slider(0, range=0..1), Step=1, Count=number_slider_2)
multiplication_5 = Multiplication(A=series_2, B=number_slider)
unit_y = UnitY(Factor=multiplication_5)
move = Move(Geometry=flatten(merge), Motion=graft(unit_y))  # -> flatten(Geometry), Transform
merge_2 = Merge(Data2=move.Geometry, Data3=pt_8, Data4=pt_2, Data5=pt_7)  # -> flatten(Result)
pline = PolyLine(Vertices=merge_2, Closed=False)
list_item = ListItem(List=merge_2, Index=Slider(0, range=0..100), Wrap=True)
# Bottom Right Corner
Z = UnitZ(Factor=multiplication_3)
point = Point(list_item)
# Round
# Corners
# Add points in
# order of path
# Copy for a series of z vectors
move_2 = Move(Geometry=pline, Motion=Z)  # -> Geometry, Transform
# Start Point
# Gradually Rise from 0 Z
# Start Material Flow once moving
Z_2 = UnitZ(Factor=wall_height)
fillet = Fillet(Curve=move_2.Geometry, Radius=outer_wall_coner_radius)
# Break the curves
# into segments of
# specified length
# Optimizing to
# Remove extra points
# in straight lines can cause the
# issue of the printer not doing
# the points in order
divlength = DivideLength(Curve=fillet, Length=length_of_curve_segments)  # -> Points, Tangents, Parameters
pline_2 = PolyLine(Vertices=divlength.Points, Closed=False)
explode = Explode(Curve=pline_2, Recursive=True)  # -> Segments, Vertices
extrusion = SilkwormExtrusionPath(MovementLines=simplify(graft(explode.Vertices)), SpeedParameter=print_speed, FlowRatio=0.35)
silkworm = SilkwormCompiler(SilkwormMovements=flatten(extrusion))  # -> GCode, SilkwormModel
panel = Panel(silkworm.GCode)
