# Grasshopper definition Striaght Test Wall Double Wyth Segments Full Height.gh (Grasshopper 1.0.7)
# plug-ins: Silkworm

bead_width = Slider(25, range=0..100)
# Main Parmeters
farthest_left = Slider(-100, range=-100..101)
start_point_x = Slider(0, range=-10..100)
start_point_y = Slider(0, range=-10..100)
wyth_offset = Slider(25, range=0..100)
# segment length of 16 was too jerky
# segment length of 4 was smooth with 38 radius
# - but was bad with 60  (Yoff 80, X off 38)
# - changing to length of 8 - better (Y off 68, X off 32)
# - changing to length of 10 and radius of 50 (Y off y 35, X off by 6)
# - changing to length of 12 and radius of 45 (Y off y 30, X off by 27)
# --- 4-16-22 with new motor settings we can do fine points again.
# (Better for no path planning issues)
#        - length of 6 and radius of 70
length_of_curve_segments = Slider(6, range=0..20)
building_length = Slider(1094, range=0..2000)
wall_height = Slider(1219, range=0..5000)
print_speed = Slider(2873, range=0..5000)
outer_wall_coner_radius = Slider(38, range=0..100)
wall_thickness = Slider(178, range=0..300)
inverse = Slider(-1, range=-1..1)
building_depth = Slider(178, range=0..1000)
layer_height = Slider(10, range=0..100)
division = Division(A=wall_height, B=layer_height)
# Farthest Left
# plus Offset
# Start Y
# plus Offset
multiplication = Multiplication(A=wyth_offset, B=inverse)
Y = UnitY(Factor=start_point_y)
Y_2 = UnitY(Factor=building_depth)
X = UnitX(Factor=building_length)
series = Series(Start=0, Step=1, Count=division)
addition = Addition(A=farthest_left, B=wall_thickness)
addition_2 = Addition(A=start_point_y, B=wall_thickness)
multiplication_2 = Multiplication(A=series, B=layer_height)
# Inside Corner
# minus Offset
addition_3 = Addition(A=addition, B=multiplication)
addition_4 = Addition(A=start_point_y, B=wyth_offset)
addition_5 = Addition(A=farthest_left, B=wyth_offset)
# Wall Thickness
# minus Offset
addition_6 = Addition(A=wall_thickness, B=multiplication)
# Bulding Depth
# minus Offset
addition_7 = Addition(A=building_depth, B=multiplication)
# Bulding Length
# minus Offset
addition_8 = Addition(A=building_length, B=multiplication)
pt = ConstructPoint(XCoordinate=X, YCoordinate=addition_2, ZCoordinate=0)
# Corner Wall Points
pt_2 = ConstructPoint(XCoordinate=start_point_x, YCoordinate=Y, ZCoordinate=0)
pt_3 = ConstructPoint(XCoordinate=X, YCoordinate=Y, ZCoordinate=0)
# Inside Corner
pt_4 = ConstructPoint(XCoordinate=addition, YCoordinate=addition_2, ZCoordinate=0)
pt_5 = ConstructPoint(XCoordinate=addition, YCoordinate=Y_2, ZCoordinate=0)
# Top Left Corner
pt_6 = ConstructPoint(XCoordinate=farthest_left, YCoordinate=Y_2, ZCoordinate=0)
# Bottom Left Corner
pt_7 = ConstructPoint(XCoordinate=farthest_left, YCoordinate=Y, ZCoordinate=0)
# Back to the first point
pt_8 = ConstructPoint(XCoordinate=start_point_x, YCoordinate=Y, ZCoordinate=0)
addition_9 = Addition(B=layer_height)
# Inner Wyth Points
pt_9 = ConstructPoint(XCoordinate=start_point_x, YCoordinate=addition_4, ZCoordinate=0)
pt_10 = ConstructPoint(XCoordinate=addition_8, YCoordinate=addition_4, ZCoordinate=0)
pt_11 = ConstructPoint(XCoordinate=addition_8, YCoordinate=addition_6, ZCoordinate=0)
pt_12 = ConstructPoint(XCoordinate=addition_3, YCoordinate=addition_6, ZCoordinate=0)
pt_13 = ConstructPoint(XCoordinate=addition_3, YCoordinate=addition_7, ZCoordinate=0)
pt_14 = ConstructPoint(XCoordinate=addition_5, YCoordinate=addition_7, ZCoordinate=0)
# Up to next layer
pt_15 = ConstructPoint(XCoordinate=start_point_y, YCoordinate=Y, ZCoordinate=addition_9)
pt_16 = ConstructPoint(XCoordinate=addition_5, YCoordinate=addition_4, ZCoordinate=0)
pt_17 = ConstructPoint(XCoordinate=start_point_x, YCoordinate=addition_4, ZCoordinate=0)
# Bottom Right Corner
merge = Merge(
    Data1=pt_2,
    Data2=pt_3,
    Data3=pt,
    Data4=pt_4,
    Data5=pt_5,
    Data6=pt_6,
    Data7=pt_7,
    Data8=pt_8,
    Data9=pt_9,
    Data10=pt_10,
    Data11=pt_11,
    Data12=pt_12,
    Data13=pt_13,
    Data14=pt_14,
    Data15=pt_16,
    Data16=pt_17,
    Data17=pt_15)
pline = PolyLine(Vertices=merge, Closed=False)
Z = UnitZ(Factor=multiplication_2)
# Add points in
# order of path
# Copy for a series of z vectors
# To Do, create a lead-in to the Start Point
# Gradually Rise from 0 Z
# Start Material Flow once moving
move = Move(Geometry=pline, Motion=Z)  # -> Geometry, Transform
# Round
# Corners
fillet = Fillet(Curve=move.Geometry, Radius=outer_wall_coner_radius)
# Break the curves
# into segments of
# specified length
divlength = DivideLength(Curve=fillet, Length=length_of_curve_segments)  # -> Points, Tangents, Parameters
pline_2 = PolyLine(Vertices=divlength.Points, Closed=False)
# Optimizing to
# Remove extra points
# in straight lines can cause the
# issue of the printer not doing
# the points in order
explode = Explode(Curve=pline_2, Recursive=True)  # -> Segments, Vertices
extrusion = SilkwormExtrusionPath(MovementLines=simplify(graft(explode.Vertices)), SpeedParameter=print_speed, FlowRatio=0.35)
silkworm = SilkwormCompiler(SilkwormMovements=flatten(extrusion))  # -> GCode, SilkwormModel
panel = Panel(silkworm.GCode)
