# Grasshopper definition Two Striaght Test Walls U Shape Double Wyth Full Height.gh (Grasshopper 1.0.7)
# plug-ins: Silkworm

bead_width = Slider(25, range=0..100)
# Two straight Walls With Double Wyth
# (two 1" beads to make a 2" thick inner and
#  outter wall) - the bridge between the two
#  should be cut
# First Wall Parmeters
farthest_left = Slider(-100, range=-100..101)
start_point_x = Slider(0, range=-10..100)
start_point_y = Slider(0, range=-10..100)
wyth_offset = Slider(24, range=0..100)
# segment length of 16 was too jerky
# segment length of 4 was smooth with 38 radius
# - but was bad with 60  (Yoff 80, X off 38)
# - changing to length of 8 - better (Y off 68, X off 32)
# - changing to length of 10 and radius of 50 (Y off y 35, X off by 6)
# - changing to length of 12 and radius of 45 (Y off y 30, X off by 27)
# --- 4-16-22 with new motor settings we can do fine points again.
# (Better for no path planning issues)
#        - length of 6 and radius of 70
length_of_curve_segments = Slider(6, range=0..20)
building_length = Slider(1144, range=0..2000)
outer_wall_coner_radius = Slider(22, range=0..100)
wall_height = Slider(1219, range=0..5000)
print_speed = Slider(2873, range=0..5000)
wall_thickness = Slider(228, range=0..300)
bridge_location4 = Slider(-100, range=-100..101)
# Bridge Between Walls
bridge_location = Slider(-76, range=-100..101)
bridge_location2 = Slider(-55, range=-100..101)
bridge_location3 = Slider(-28, range=-100..101)
inverse = Slider(-1, range=-1..1)
ramp_adjust_height = Slider(5, range=0..100)
ramp_adjust_x = Slider(-6, range=-100..101)
layer_height = Slider(10, range=0..100)
bead_width_2 = Slider(25, range=0..100)
# Main Parmeters
farthest_left_2 = Slider(-100, range=-100..101)
start_point_x_2 = Slider(0, range=-10..100)
building_depth = Slider(228, range=0..1000)
start_point_y_2 = Slider(0, range=-10..1000)
wyth_offset_2 = Slider(25, range=0..100)
building_length_2 = Slider(1144, range=0..2000)
length_of_curve_segments_2 = Slider(6, range=0..20)
print_speed_2 = Slider(2873, range=0..5000)
outer_wall_coner_radius_2 = Slider(38, range=0..100)
wall_height_2 = Slider(1219, range=0..5000)
wall_thickness_2 = Slider(228, range=0..300)
inverse_2 = Slider(-1, range=-1..1)
building_depth_2 = Slider(228, range=0..1000)
# Second Wall Parmeters
y_offset = Slider(270, range=-10..1000)
division = Division(A=wall_height, B=layer_height)
# Farthest Left
# plus Offset
# Start Y
# plus Offset
multiplication = Multiplication(A=wyth_offset, B=inverse)
Y = UnitY(Factor=start_point_y)
Y_2 = UnitY(Factor=building_depth)
X = UnitX(Factor=building_length)
series = Series(Start=0, Step=1, Count=division)
multiplication_2 = Multiplication(A=wyth_offset_2, B=inverse_2)
X_2 = UnitX(Factor=building_length_2)
Y_3 = UnitY(Factor=start_point_y_2)
addition = Addition(A=y_offset, B=start_point_y_2)
addition_2 = Addition(A=start_point_y, B=wall_thickness)
addition_3 = Addition(A=y_offset, B=building_depth_2)
Y_4 = UnitY(Factor=addition_3)
addition_4 = Addition(A=farthest_left, B=wall_thickness)
addition_5 = Addition(A=farthest_left_2, B=wall_thickness_2)
multiplication_3 = Multiplication(A=series, B=layer_height)
addition_6 = Addition(A=start_point_y_2, B=wall_thickness_2)
addition_7 = Addition(A=start_point_y, B=wyth_offset)
addition_8 = Addition(A=farthest_left, B=wyth_offset)
# Wall Thickness
# minus Offset
addition_9 = Addition(A=wall_thickness, B=multiplication)
# Inside Corner
# minus Offset
addition_10 = Addition(A=addition_4, B=multiplication)
# Bulding Depth
# minus Offset
addition_11 = Addition(A=building_depth, B=multiplication)
# Bulding Length
# minus Offset
addition_12 = Addition(A=building_length, B=multiplication)
# Inside Corner
# minus Offset
addition_13 = Addition(A=addition_5, B=multiplication_2)
# Start Y
# plus Offset
addition_14 = Addition(A=addition, B=wyth_offset_2)
# Farthest Left
# plus Offset
addition_15 = Addition(A=farthest_left_2, B=wyth_offset_2)
# Wall Thickness
# minus Offset
addition_16 = Addition(A=addition_3, B=multiplication_2)
# Bulding Depth
# minus Offset
addition_17 = Addition(A=addition_3, B=multiplication_2)
# Bulding Length
# minus Offset
addition_18 = Addition(A=building_length_2, B=multiplication_2)
addition_19 = Addition(B=layer_height)
pt = ConstructPoint(XCoordinate=X, YCoordinate=addition_2, ZCoordinate=0)
# Corner Wall Points
pt_2 = ConstructPoint(XCoordinate=start_point_x, YCoordinate=Y, ZCoordinate=0)
pt_3 = ConstructPoint(XCoordinate=X, YCoordinate=Y, ZCoordinate=0)
pt_4 = ConstructPoint(XCoordinate=bridge_location, YCoordinate=addition_11, ZCoordinate=0)
# Inside Corner
pt_5 = ConstructPoint(XCoordinate=bridge_location3, YCoordinate=addition_2, ZCoordinate=0)
# Top Left Corner
pt_6 = ConstructPoint(XCoordinate=farthest_left, YCoordinate=Y_2, ZCoordinate=0)
# Bottom Left Corner
pt_7 = ConstructPoint(XCoordinate=farthest_left, YCoordinate=Y, ZCoordinate=0)
# Back to the first point
pt_8 = ConstructPoint(XCoordinate=start_point_x, YCoordinate=Y, ZCoordinate=0)
pt_9 = ConstructPoint(XCoordinate=X_2, YCoordinate=addition_3, ZCoordinate=0)
# Corner Wall Points
pt_10 = ConstructPoint(XCoordinate=bridge_location3, YCoordinate=addition, ZCoordinate=0)
# Bottom Right Corner
pt_11 = ConstructPoint(XCoordinate=X_2, YCoordinate=addition, ZCoordinate=0)
# Inside Corner
pt_12 = ConstructPoint(XCoordinate=addition_5, YCoordinate=Y_4, ZCoordinate=0)
# Top Left Corner
pt_13 = ConstructPoint(XCoordinate=farthest_left_2, YCoordinate=Y_4, ZCoordinate=0)
# Bottom Left Corner
pt_14 = ConstructPoint(XCoordinate=farthest_left_2, YCoordinate=addition, ZCoordinate=0)
# Back to the first point
pt_15 = ConstructPoint(XCoordinate=bridge_location4, YCoordinate=addition, ZCoordinate=0)
# Inner Wyth Points
pt_16 = ConstructPoint(XCoordinate=start_point_x, YCoordinate=addition_7, ZCoordinate=0)
pt_17 = ConstructPoint(XCoordinate=addition_12, YCoordinate=addition_7, ZCoordinate=0)
pt_18 = ConstructPoint(XCoordinate=addition_12, YCoordinate=addition_9, ZCoordinate=0)
pt_19 = ConstructPoint(XCoordinate=bridge_location2, YCoordinate=addition_11, ZCoordinate=0)
pt_20 = ConstructPoint(XCoordinate=addition_10, YCoordinate=addition_11, ZCoordinate=0)
pt_21 = ConstructPoint(XCoordinate=addition_8, YCoordinate=addition_11, ZCoordinate=0)
# Up to next layer
# Start Point
# Gradually Rise from 0 Z
# Start Material Flow once moving
pt_22 = ConstructPoint(XCoordinate=start_point_y, YCoordinate=Y, ZCoordinate=layer_height)
pt_23 = ConstructPoint(XCoordinate=addition_8, YCoordinate=addition_7, ZCoordinate=0)
pt_24 = ConstructPoint(XCoordinate=ramp_adjust_x, YCoordinate=addition_7, ZCoordinate=ramp_adjust_height)
pt_25 = ConstructPoint(XCoordinate=bridge_location4, YCoordinate=Y_2, ZCoordinate=0)
# Inner Wyth Points
pt_26 = ConstructPoint(XCoordinate=bridge_location2, YCoordinate=addition_14, ZCoordinate=0)
pt_27 = ConstructPoint(XCoordinate=addition_18, YCoordinate=addition_14, ZCoordinate=0)
pt_28 = ConstructPoint(XCoordinate=addition_18, YCoordinate=addition_16, ZCoordinate=0)
pt_29 = ConstructPoint(XCoordinate=addition_13, YCoordinate=addition_16, ZCoordinate=0)
pt_30 = ConstructPoint(XCoordinate=addition_13, YCoordinate=addition_17, ZCoordinate=0)
pt_31 = ConstructPoint(XCoordinate=addition_15, YCoordinate=addition_17, ZCoordinate=0)
pt_32 = ConstructPoint(XCoordinate=addition_15, YCoordinate=addition_14, ZCoordinate=0)
pt_33 = ConstructPoint(XCoordinate=bridge_location, YCoordinate=addition_14, ZCoordinate=0)
# Start Point
# Gradually Rise from 0 Z
# Start Material Flow once moving
merge = Merge(
    Data1=pt_2,
    Data2=pt_3,
    Data3=pt,
    Data4=pt_5,
    Data5=pt_10,
    Data6=pt_11,
    Data7=pt_9,
    Data8=pt_13,
    Data9=pt_14,
    Data10=pt_15,
    Data11=pt_25,
    Data12=pt_6,
    Data13=pt_7,
    Data14=pt_8,
    Data15=pt_16,
    Data16=pt_17,
    Data17=pt_18,
    Data18=pt_19,
    Data19=pt_26,
    Data20=pt_27,
    Data21=pt_28,
    Data22=pt_31,
    Data23=pt_32,
    Data24=pt_33,
    Data25=pt_4,
    Data26=pt_21,
    Data27=pt_23,
    Data28=pt_24,
    Data29=pt_22)
# Bottom Right Corner
pline = PolyLine(Vertices=merge, Closed=False)
Z = UnitZ(Factor=multiplication_3)
# Round
# Corners
# Add points in
# order of path
# Copy for a series of z vectors
move = Move(Geometry=pline, Motion=Z)  # -> Geometry, Transform
Z_2 = UnitZ(Factor=wall_height)
fillet = Fillet(Curve=move.Geometry, Radius=outer_wall_coner_radius)
# Break the curves
# into segments of
# specified length
# Optimizing to
# Remove extra points
# in straight lines can cause the
# issue of the printer not doing
# the points in order
divlength = DivideLength(Curve=fillet, Length=length_of_curve_segments)  # -> Points, Tangents, Parameters
pline_2 = PolyLine(Vertices=divlength.Points, Closed=False)
explode = Explode(Curve=pline_2, Recursive=True)  # -> Segments, Vertices
extrusion = SilkwormExtrusionPath(MovementLines=simplify(graft(explode.Vertices)), SpeedParameter=print_speed, FlowRatio=0.35)
silkworm = SilkwormCompiler(SilkwormMovements=flatten(extrusion))  # -> GCode, SilkwormModel
panel = Panel(silkworm.GCode)
