# Grasshopper definition Woven_Pattern_for_Porch.gh (Grasshopper 1.0.7)

unit_x = UnitX(Factor=1)
construct_point = ConstructPoint(XCoordinate=0, YCoordinate=0, ZCoordinate=0)
weave_spacing = Slider(10, range=0..20)
weave_height = Slider(1.35, range=0..3)
strip_edge_radius = Slider(0.391, range=0..2)
strip_height = Slider(1.017, range=0..3)
iterations_y = Slider(4, range=0..100)
iterations_x = Slider(4, range=0..100)
strip_width = Slider(9.3, range=0..100)
line_sdl = LineSDL(Start=construct_point, Direction=unit_x, Length=weave_spacing)
unit_z = UnitZ(Factor=weave_height)
end_points = EndPoints(Curve=line_sdl)  # -> Start, End
point_on_curve = PointOnCurve(line_sdl, parameter=0.5)
multiplication = Multiplication(A=weave_spacing, B="2")
move = Move(Geometry=point_on_curve, Motion=unit_z)  # -> Geometry, Transform
division = Division(A=strip_width, B="-2")
yz_plane = YZPlane(Origin=Point(0, 0, 0))
unit_y = UnitY(Factor=division)
yz_plane_2 = YZPlane(Origin=end_points.End)
rectangle = Rectangle(Plane=yz_plane, XSize=strip_width, YSize=strip_height, Radius=0)  # -> Rectangle, Length
interpolate = Interpolate(Vertices=[end_points.Start, move.Geometry, end_points.End], Degree=3, Periodic=False, KnotStyle=1)  # -> Curve, Length, Domain
mirror = Mirror(Geometry=interpolate.Curve, Plane=yz_plane_2)  # -> Geometry, Transform
fillet = Fillet(Curve=rectangle.Rectangle, Radius=strip_edge_radius)
xy_plane = XYPlane(Origin=Point(0, 0, 0))
mirror_2 = Mirror(Geometry=mirror.Geometry, Plane=xy_plane)  # -> Geometry, Transform
mirror_3 = Mirror(Geometry=point_on_curve, Plane=yz_plane_2)  # -> Geometry, Transform
unit_y_2 = UnitY(Factor=weave_spacing)
join_curves = JoinCurves(Curves=[interpolate.Curve, mirror_2.Geometry], Preserve=False)
point_on_curve_2 = PointOnCurve(join_curves, parameter=0.5)
yz_plane_3 = YZPlane(Origin=point_on_curve_2)
# not following 100%
sweep1 = Sweep1(Rail=join_curves, Sections=fillet, Miter="0")
move_2 = Move(Geometry=sweep1, Motion=unit_y)  # -> Geometry, Transform
move_3 = Move(Geometry=move_2.Geometry, Motion=unit_y_2)  # -> Geometry, Transform
unit_x_2 = UnitX(Factor="-1")
unit_y_3 = UnitY(Factor=1)
unit_y_4 = UnitY(Factor="-1")
unit_x_3 = UnitX(Factor=1)
orient_direction = OrientDirection(Geometry=move_2.Geometry, PointA=mirror_3.Geometry, DirectionA=unit_x_2, PointB=point_on_curve, DirectionB=unit_y_3)  # -> Geometry, Transform
orient_direction_2 = OrientDirection(Geometry=move_2.Geometry, PointA=point_on_curve, DirectionA=unit_y_4, PointB=mirror_3.Geometry, DirectionB=unit_x_3)  # -> Geometry, Transform
mirror_4 = Mirror(Geometry=move_3.Geometry, Plane=yz_plane_3)  # -> Geometry, Transform
xy_plane_2 = XYPlane(Origin=Point(0, 0, 0))
rectangle_2 = Rectangle(Plane=xy_plane_2, XSize=multiplication, YSize=multiplication, Radius=0)  # -> Rectangle, Length
rectangular_array = RectangularArray(
    Geometry=[mirror_4.Geometry, orient_direction.Geometry, orient_direction_2.Geometry, move_2.Geometry],
    Cell=rectangle_2.Rectangle,
    XCount=iterations_x,
    YCount=iterations_y)  # -> Geometry, Transform
pi = Pi(Factor="-0.25")
unit_y_5 = UnitY(Factor=1)
rotate = Rotate(Geometry=rectangular_array.Geometry, Angle=pi, Plane=PlaneXY(0, 0, 0))  # -> Geometry, Transform
vector = Vector(unit_y_5)
line_sdl_2 = LineSDL(Start=construct_point, Direction=vector, Length=weave_spacing)
xy_plane_3 = XYPlane(Origin=Point(0, 0, 0))
scale_nu = ScaleNU(Geometry=rotate.Geometry, Plane=xy_plane_3, ScaleX=1, ScaleY="2", ScaleZ=1)  # -> Geometry, Transform
