# Grasshopper definition Woven_Pattern_for_Porch_more_rounded_strips_around corner.gh (Grasshopper 1.0.7)

wall_hieght = Slider(120, range=0..200)
unit_x = UnitX(Factor=1)
construct_point = ConstructPoint(XCoordinate=0, YCoordinate=0, ZCoordinate=0)
w_wrap_thickness = Slider(5, range=0..10)
wall_corner_radius = Slider(22, range=0..800)
weave_spacing = Slider(10.5, range=0..20)
weave_height = Slider(1.55, range=0..3)
v_wrap_length = Slider(140, range=0..800)
cell_size_adjustment = Slider(1, range=0..2)
strip_edge_radius = Slider(0.55, range=0..2)
u_wrap_height = Slider(209, range=0..800)
strip_height = Slider(1.72, range=0..3)
iterations_y = Slider(4, range=0..100)
# Grid Array - watch processing time
iterations_x = Slider(4, range=0..100)
# Define Strips to Weave
strip_width = Slider(9.2, range=0..100)
# Define Corner Wall
wall_length = Slider(65, range=0..800)
wall_depth = Slider(125, range=0..800)
line_sdl = LineSDL(Start=construct_point, Direction=unit_x, Length=weave_spacing)
unit_z = UnitZ(Factor=weave_height)
end_points = EndPoints(Curve=line_sdl)  # -> Start, End
point_on_curve = PointOnCurve(line_sdl, parameter=0.5)
multiplication = Multiplication(A=weave_spacing, B="2")
move = Move(Geometry=point_on_curve, Motion=unit_z)  # -> Geometry, Transform
division = Division(A=strip_width, B="-2")
yz_plane = YZPlane(Origin=Point(0, 0, 0))
multiplication_2 = Multiplication(A=weave_spacing, B="2")
unit_x_2 = UnitX(Factor=wall_depth)
construct_point_2 = ConstructPoint(XCoordinate=0, YCoordinate=0, ZCoordinate=0)
unit_z_2 = UnitZ(Factor=wall_hieght)
multiplication_3 = Multiplication(A=multiplication, B=cell_size_adjustment)
unit_y = UnitY(Factor=division)
unit_y_2 = UnitY(Factor=wall_depth)
unit_x_3 = UnitX(Factor=multiplication_2)
rectangle = Rectangle(Plane=yz_plane, XSize=strip_width, YSize=strip_height, Radius=0)  # -> Rectangle, Length
yz_plane_2 = YZPlane(Origin=end_points.End)
interpolate = Interpolate(Vertices=[end_points.Start, move.Geometry, end_points.End], Degree=3, Periodic=False, KnotStyle=1)  # -> Curve, Length, Domain
line_sdl_2 = LineSDL(Start=construct_point, Direction=unit_x_2, Length=wall_length)
move_2 = Move(Geometry=interpolate.Curve, Motion=unit_x_3)  # -> Geometry, Transform
mirror = Mirror(Geometry=interpolate.Curve, Plane=yz_plane_2)  # -> Geometry, Transform
fillet = Fillet(Curve=rectangle.Rectangle, Radius=strip_edge_radius)
# Make the corner to wrap around
end_points_2 = EndPoints(Curve=line_sdl_2)  # -> Start, End
point_on_curve_2 = PointOnCurve(line_sdl_2, parameter=1)
xy_plane = XYPlane(Origin=Point(0, 0, 0))
move_3 = Move(Geometry=point_on_curve_2, Motion=unit_y_2)  # -> Geometry, Transform
# add one more bit of the top curve
panel = Panel("0.1")
divide_distance = DivideDistance(Curve=move_2.Geometry, Distance=panel)  # -> Points, Tangents, Parameters
mirror_2 = Mirror(Geometry=mirror.Geometry, Plane=xy_plane)  # -> Geometry, Transform
mirror_3 = Mirror(Geometry=point_on_curve, Plane=yz_plane_2)  # -> Geometry, Transform
polyline = PolyLine(Vertices=[end_points_2.Start, end_points_2.End, move_3.Geometry], Closed=False)
point = Point(divide_distance.Points)
split_list = SplitList(List=point, Index="4")  # -> ListA, ListB
panel_2 = Panel("0.002")
fillet_2 = Fillet(Curve=polyline, Radius=wall_corner_radius)
move_4 = Move(Geometry=fillet_2, Motion=unit_z_2)  # -> Geometry, Transform
polyline_2 = PolyLine(Vertices=split_list.ListA, Closed=False)  # -> flatten(Polyline)
curve = Curve(polyline_2)
# added top curve
# bottom curve and one more
# bit of the top
join_curves = JoinCurves(Curves=[interpolate.Curve, mirror_2.Geometry, curve], Preserve=False)
loft = Loft(
    Curves=[fillet_2, move_4.Geometry],
    Options={Adjust=False, Closed=False, LoftEnds=0, LoftSimp=0, LoftType=0, Rebuild=10, Refit=0.01})
# not following 100%
# so we added a bit f the top curve
sweep1 = Sweep1(Rail=join_curves, Sections=fillet, Miter="0")
unit_y_3 = UnitY(Factor=weave_spacing)
# center on 0,0 for rotation
move_5 = Move(Geometry=sweep1, Motion=unit_y)  # -> Geometry, Transform
point_on_curve_3 = PointOnCurve(join_curves, parameter=0.5)
unit_x_4 = UnitX(Factor="-1")
unit_y_4 = UnitY(Factor=1)
move_6 = Move(Geometry=move_5.Geometry, Motion=unit_y_3)  # -> Geometry, Transform
unit_y_5 = UnitY(Factor="-1")
unit_x_5 = UnitX(Factor=1)
yz_plane_3 = YZPlane(Origin=point_on_curve_3)
orient_direction = OrientDirection(Geometry=move_5.Geometry, PointA=mirror_3.Geometry, DirectionA=unit_x_4, PointB=point_on_curve, DirectionB=unit_y_4)  # -> Geometry, Transform
orient_direction_2 = OrientDirection(Geometry=move_5.Geometry, PointA=point_on_curve, DirectionA=unit_y_5, PointB=mirror_3.Geometry, DirectionB=unit_x_5)  # -> Geometry, Transform
# Flip and rotate to make one weave cell
mirror_4 = Mirror(Geometry=move_6.Geometry, Plane=yz_plane_3)  # -> Geometry, Transform
xy_plane_2 = XYPlane(Origin=Point(0, 0, 0))
# define cell size
rectangle_2 = Rectangle(Plane=xy_plane_2, XSize=multiplication_3, YSize=multiplication_3, Radius=0)  # -> Rectangle, Length
# Create Grid
# Flatten or sucessive
# tasks will run multiple times
rectangular_array = RectangularArray(
    Geometry=[mirror_4.Geometry, orient_direction.Geometry, orient_direction_2.Geometry, move_5.Geometry],
    Cell=rectangle_2.Rectangle,
    XCount=iterations_x,
    YCount=iterations_y)  # -> flatten(Geometry), Transform
pi = Pi(Factor="-0.25")
# turning by 45 degrees
rotate = Rotate(Geometry=rectangular_array.Geometry, Angle=pi, Plane=PlaneXY(0, 0, 0))  # -> Geometry, Transform
xy_plane_3 = XYPlane(Origin=Point(0, 0, 0))
# stretch it - this gets lost
# when wrapping
# to a surface
scale_nu = ScaleNU(Geometry=rotate.Geometry, Plane=xy_plane_3, ScaleX="3", ScaleY=1, ScaleZ=1)  # -> Geometry, Transform; disabled
bounding_box = BoundingBox(Content=flatten(rotate.Geometry), Plane=PlaneXY(0, 0, 0), UnionBox=True)  # -> Box, Box_2
# now wrap it around a corner
# watch processing time when truning this on
# Skip the rail for testing
# stretch it by manipulating U and V
surface_morph = SurfaceMorph(
    Geometry=rotate.Geometry,
    Reference=bounding_box.Box,
    Surface=loft,
    UDomain=u_wrap_height,
    VDomain=v_wrap_length,
    WDomain=w_wrap_thickness)  # disabled
