# Grasshopper definition Z_Beam_Side_Diagonal_cut_Right-Side.gh (Grasshopper 1.0.7)
# plug-ins: Silkworm

element_to_remove = Slider(6, range=0..100)

# ---- group: Arrange Parts
# Take the Triangles
# and put it onto the last of the diamonds.
panel = Panel("1")

# ----
unit_x = UnitX(Factor="-1")

# ----
# X-Brace Beam
# Inputs
# 144 in = 3657.6 mm
# 6 in = 152.4 mm
# Percent of Beam Remaining
# Even number of Sections leaves a
# Center Diamond to leave solid
# Change of Offsets
# Opening Offset (Half of the Bracing Width))
# 0.171 in = 4.343 mm
# 6 in = 152.4 mm
beam_origin_x = Slider(0, range=0..500)
box_origin_y = Slider(0, range=0..500)
beam_length_mm = Slider(558, range=0..8000)
beam_height_mm = Slider(152, range=0..500)
starting_opening_offset = Slider(-10.5, range=-25..0)
y_offset = Slider(0, range=-50..50)
solid_edge_middle_point = Slider(200, range=0..2000)
solid_edge_width_start = Slider(12, range=0..90)
number_of_sections = Slider(5, range=0..50)
ending_opening_offset = Slider(-10.5, range=-25..0)
corner_radius = Slider(4.343, range=0..5)
x_offset = Slider(0, range=-300..295)
solid_end_length = Slider(-75, range=-300..300)
solid_edge_width_middle = Slider(12, range=0..90)
solid_edge_width_end = Slider(9, range=0..90)
subtraction = Subtraction(A=starting_opening_offset, B=ending_opening_offset)

# ----
# Beam Bottom Corner
# Define
# Full Beam
# Full Rectangle
# Full Beam
# Beam Bottom Far Corner
# Beam Far Top Corner
addition = Addition(A=beam_origin_x, B=beam_length_mm)
addition_2 = Addition(A=box_origin_y, B=beam_height_mm)
construct_point = ConstructPoint(XCoordinate=beam_origin_x, YCoordinate=box_origin_y, ZCoordinate=0)
construct_point_2 = ConstructPoint(XCoordinate=addition, YCoordinate=beam_origin_x, ZCoordinate=0)
construct_point_3 = ConstructPoint(XCoordinate=addition, YCoordinate=addition_2, ZCoordinate=0)
rectangle_3pt = Rectangle3Pt(PointA=construct_point_2, PointB=construct_point, PointC=construct_point_3)  # -> Rectangle, Length

# ----
# Define
# Inner Rectangle
# Center Line Start
# Center Height
# Inner Triangle
# Gets Smaller as we drop one
# point from the rectangle.
# Top Inner Line
# Center Line End
# Bottom Right
# Top Right
# Bottom Left
# Center Line
# of Inner Rectangle
# Top Left
# Edge Middle Top
# Bottom Inner Line
# Beam Height Minus
# Edge Offset Middle
# Edge Middle Bottom
panel_2 = Panel("2")
division = Division(A=beam_height_mm, B=panel_2)
subtraction_2 = Subtraction(A=beam_length_mm, B=solid_end_length)
unit_x_2 = UnitX(Factor=solid_end_length)
unit_y = UnitY(Factor=solid_edge_width_start)
unit_y_2 = UnitY(Factor=beam_height_mm)
unit_y_3 = UnitY(Factor=solid_edge_width_end)
subtraction_3 = Subtraction(A=beam_height_mm, B=solid_edge_width_middle)
construct_point_4 = ConstructPoint(XCoordinate=subtraction_2, YCoordinate=division, ZCoordinate=0)
construct_point_5 = ConstructPoint(XCoordinate=solid_end_length, YCoordinate=division, ZCoordinate=0)
subtraction_4 = Subtraction(A=construct_point_2, B=unit_x_2)
subtraction_5 = Subtraction(A=construct_point_3, B=unit_x_2)
addition_3 = Addition(A=construct_point, B=unit_x_2)
addition_4 = Addition(A=addition_3, B=unit_y_2)
addition_5 = Addition(A=subtraction_4, B=unit_y_3)
subtraction_6 = Subtraction(A=subtraction_5, B=unit_y_3)
addition_6 = Addition(A=addition_3, B=unit_y)
subtraction_7 = Subtraction(A=addition_4, B=unit_y)
construct_point_6 = ConstructPoint(XCoordinate=solid_edge_middle_point, YCoordinate=subtraction_3, ZCoordinate=0)
construct_point_7 = ConstructPoint(XCoordinate=solid_edge_middle_point, YCoordinate=solid_edge_width_middle, ZCoordinate=0)
point = Point([subtraction_7, addition_6, construct_point_7, subtraction_6])
polyline = PolyLine(Vertices=point, Closed="1")
boundary_surfaces = BoundarySurfaces(Edges=polyline)
polyline_2 = PolyLine(Vertices=[addition_6, addition_5], Closed=False)
polyline_3 = PolyLine(Vertices=[construct_point_5, construct_point_4], Closed=False)
polyline_4 = PolyLine(Vertices=[subtraction_7, subtraction_6], Closed=False)

# ---- group: Define Diamonds
# Tops of Diamonds
# Series Sections
# Defining the Diamonds is the only necessary
# part because the edge
# triangles are formed by the cuts with the
# inner rectangle.
# Diamond top
# Series Offset by 1
# Series Shortened by 1
# Diamond left
# Double the number of sections
#  and then take every other one.
# Diamond Right
# Offset Series Shortened by 1
# Diamond bottom
# Bottoms of Diamonds
panel_3 = Panel("2")
multiplication = Multiplication(A=number_of_sections, B=panel_3)
series = Series(Start=0, Step=1, Count=number_of_sections)
divide = DivideCurve(Curve=polyline_3, Count=multiplication, Kinks=False)  # -> flatten(Points), Tangents, Parameters
dispatch = Dispatch(List=divide.Points, DispatchPattern=[True, False])  # -> ListA, ListB
divide_2 = DivideCurve(Curve=polyline_4, Count=number_of_sections, Kinks=False)  # -> flatten(Points), Tangents, Parameters
addition_7 = Addition(A=series, B="1")
divide_3 = DivideCurve(Curve=polyline_2, Count=number_of_sections, Kinks=False)  # -> flatten(Points), Tangents, Parameters
point_2 = Point(dispatch.ListB)
cull_index = CullIndex(List=series, Indices="-1", Wrap=True)
cull_index_2 = CullIndex(List=addition_7, Indices="-1", Wrap=True)
list_item = ListItem(List=point_2, Index=cull_index, Wrap=True)
list_item_2 = ListItem(List=divide_2.Points, Index=cull_index_2, Wrap=True)
list_item_3 = ListItem(List=divide_3.Points, Index=cull_index_2, Wrap=True)
list_item_4 = ListItem(List=point_2, Index=cull_index_2, Wrap=True)
_4point_surface = _4PointSurface(CornerA=list_item_2, CornerB=list_item, CornerC=list_item_3, CornerD=list_item_4)
curve = Curve(_4point_surface)

# ---- group: Cut Shapes
# Divide Height change into
# parts for each section
# Limit Bracing To Inner Rectangle
# Cutting full Rectangle
# Cutting Inner Rectangle
# Offset for Bracing Width
# Round Corners
# Y Offset of Bracing
# X Offset of Bracing
# Select shapes
split_brep_multiple = SplitBrepMultiple(Brep=rectangle_3pt.Rectangle, Cutters=flatten(curve))  # -> flatten(Result)
split_brep_multiple_2 = SplitBrepMultiple(Brep=boundary_surfaces, Cutters=flatten(split_brep_multiple))  # -> flatten(Result)
list_length = ListLength(List=split_brep_multiple)
division_2 = Division(A=subtraction, B=list_length)
multiplication_2 = Multiplication(A=division_2, B=-1)
series_2 = Series(Start=starting_opening_offset, Step=multiplication_2, Count=list_length)
offset_curve = OffsetCurve(Curve=flatten(split_brep_multiple_2), Distance=series_2, Corners=1)
fillet = Fillet(Curve=offset_curve, Radius=corner_radius)
list_item_5 = ListItem(List=flatten(fillet), Index=Slider(47, range=0..225), Wrap=True)
unit_y_4 = UnitY(Factor=y_offset)
boundary_surfaces_2 = BoundarySurfaces(Edges=flatten(fillet))
move = Move(Geometry=boundary_surfaces_2, Motion=unit_y_4)  # -> Geometry, Transform
unit_x_3 = UnitX(Factor=x_offset)
move_2 = Move(Geometry=move.Geometry, Motion=unit_x_3)  # -> Geometry, Transform

# ----
# Analysis for Percent of Beam Cut out
# Trim from Rectangle
# Get the outer
# remaining part
# Compare area to a full rectangle
split_brep_multiple_3 = SplitBrepMultiple(Brep=rectangle_3pt.Rectangle, Cutters=move_2.Geometry)
list_item_6 = ListItem(List=split_brep_multiple_3, Index="-1", Wrap=True)  # -> flatten(Item)
surface = Surface(list_item_6)
area = Area(Geometry=surface)  # -> Area, Centroid
area_2 = Area(Geometry=rectangle_3pt.Rectangle)  # -> Area, Centroid
panel_4 = Panel(area_2.Area)
panel_5 = Panel(area.Area)
division_3 = Division(A=panel_5, B=panel_4)

panel_6 = Panel(division_3)

# ---- group: Arrange Parts
# Remove the Rectangle
#  at the start
# Remove the Rectangle
#  at the end
# Join all the points to make
#  paths for each shape
# Break curves into
# small parts
# Break the paths into separate
# segment collections
# We need to reverse the points of the triangles
#  after they are totally processed, therefore split
# all the shapes into two groups at this point.
# Length of curves
# (Resolution)
# Add the shape twice before the
# connecting line, to have it
# retrace before moving on.
# Reverse to start cutting
# the triangles at the end
# of the diamonds
# Flip to fix the normals
# so we have the
# same direction of cutting.
# (counter clockwise)
# Remove the Rectangle
# ** May need to adjust this based
# on the number of sections.
# Adjust for Split between Diamond and
#  Triagle shapes for setting tracing direction.
# ** May need to adjust this based
# on the number of sections and Inner Rectangle.
list_length_2 = ListLength(List=curve)
element_to_remove_2 = Slider(15, range=0..100)
addition_8 = Addition(A=list_length_2, B="2")
split_list = SplitList(List=move_2.Geometry, Index=addition_8)  # -> ListA, ListB
cull_index_3 = CullIndex(List=split_list.ListA, Indices=element_to_remove_2, Wrap=True)
cull_index_4 = CullIndex(List=split_list.ListB, Indices=element_to_remove, Wrap=True)
duplicate_data = DuplicateData(Data=cull_index_4, Number="1", Order="0")
duplicate_data_2 = DuplicateData(Data=cull_index_3, Number=panel, Order="0")
reverse_list = ReverseList(List=duplicate_data)
panel_7 = Panel("1")

# ----
flip_curve = FlipCurve(Curve=reverse_list)  # -> Curve, Flag
# Adjusting for some printer slop!
# Nudging top triangles back
dispatch_2 = Dispatch(List=flip_curve.Curve, DispatchPattern=[True, False])  # -> ListA, ListB
move_3 = Move(Geometry=dispatch_2.ListB, Motion=unit_x)  # -> Geometry, Transform

# ---- group: Follow Path
# Follow the path of points
number_slider = Slider(1320, range=-1..50000)

# ---- group: Arrange Parts (continued)
curve_2 = Curve([dispatch_2.ListA, move_3.Geometry])

# ----
insert_items = InsertItems(List=duplicate_data_2, Item=curve_2, Indices=-1, Wrap=True)

# ----
# Move the first point
# towards the center.
# Create te move vector
# from the point
# towards the center.
# Partition List to get
# the center of each
# shape separately!!
# Get the centroid
# for each shape.
# Set the move distance
# to be 6 mm.
# Replace the first point
# with the moved point.
# Get all points.
# Get first point of each shape.
curve_3 = Curve(insert_items)
list_length_3 = ListLength(List=curve_3)
series_3 = Series(Start=list_length_3, Step=-1, Count=list_length_3)
list_item_7 = ListItem(List=curve_3, Index=series_3, Wrap=True)
area_3 = Area(Geometry=list_item_7)  # -> Area, Centroid
divlength = DivideLength(Curve=list_item_7, Length=panel_7)  # -> Points, Tangents, Parameters
# Add a plunge point to start cut inside shape.
partition_list = PartitionList(List=area_3.Centroid, Size=1)
list_item_8 = ListItem(List=divlength.Points, Index=0, Wrap=True)
vector_2pt = Vector2Pt(PointA=list_item_8, PointB=partition_list, Unitize=True)  # -> Vector, Length
amplitude = Amplitude(Vector=vector_2pt.Vector, Amplitude=6)
move_4 = Move(Geometry=list_item_8, Motion=amplitude)  # -> Geometry, Transform

# ----
# Add first items a second time.
insert_items_2 = InsertItems(List=divlength.Points, Item=list_item_8, Indices=0, Wrap=True)

replace_items = ReplaceItems(List=insert_items_2, Item=move_4.Geometry, Indices=0, Wrap=False)

# ---- group: Arrange Parts (continued)
divlength_2 = DivideLength(Curve=insert_items, Length=panel_7)  # -> Points, Tangents, Parameters
pline = PolyLine(Vertices=replace_items, Closed=False)
explode = Explode(Curve=pline, Recursive=True)  # -> Segments, Vertices
line = Line(explode.Segments)
point_3 = Point(explode.Vertices)

# ---- group: Follow Path (continued)
list_item_9 = ListItem(List=flatten(point_3), Index=flatten(number_slider), Wrap=True)
line_2 = Line(list_item_9)
point_4 = Point(list_item_9)
curve_4 = Curve(list_item_9)

# ---- group: Silkworm
# With the Delimiter, we now have
# non-extuding moves!  Just keep the
# Line collections separate when sending them in
# and silkworm will add the moves between..
# How high to raise for travel
# How fast to raise
# How much negative extrusiuon
# How far to come back down
# How fast to come down
# How much to extrude to get flow again
# Travel speed
# E-1.135  Will be what I want to signal
# Turning off the Plasma Cutter
# And E1.136 will be to turn it on.
# I'll replace for my M Code in the Gcode.
# Very slow speeds for plasma cutting!
# We travel even slower to let the tip cool
# and keep a lower duty cycle.
panel_8 = Panel("4")
unit_z = UnitZ(Factor=panel_8)
multiplication_3 = Multiplication(A=unit_z, B=-1)
silkworm_movement_delimiter = SilkwormMovementDelimiter(
    DelimitingStartVectors=multiplication_3,
    StartVectorDelimitingSpeed=360,
    StartVectorDelimitingPressure=1.136,
    DelimitingEndVectors=unit_z,
    EndVectorDelimitingSpeed=360,
    EndVectoreDelimitingPressure=-1.135,
    TravelSpeed="312")
extrusion = SilkwormExtrusionPath(MovementLines=line, SpeedParameter="351", FlowRatio=0, Delimiter=silkworm_movement_delimiter)
silkworm = SilkwormCompiler(SilkwormMovements=extrusion)  # -> GCode, SilkwormModel

# ----
# Gcode Output
# F0's and G92's are a problem we need to remove.
# We also need to be able to turn off extrusion
panel_9 = Panel(silkworm.GCode)
