# Grasshopper definition a spiral.gh (Grasshopper 0.9.14)
# plug-ins: Silkworm

inner_loop_radius = Slider(50, range=0..100)
outer_loop_radius = Slider(48, range=0..100)

ratio_of_filament_to_nozzle = Slider(0.03, range=0..0.1)
lift_height = Slider(0.3, range=0..1)
squashed_cross_section_ratio = Slider(0.66, range=0..1)
diameter_of_blob = Slider(25, range=0..25)
travel_speed = Slider(5600, range=0..10000)
start_pi = Slider(0, range=0..1)
start_radius = Slider(0, range=0..1)
end_radius = Slider(40.4, range=0..100)
# Point Blobs
pt = Point(Point(98.65713603, 98.86313918, 0))
steps = Slider(100, range=0..100)
end_pi = Slider(5, range=0..10)
speeds = Slider(5, range=0..1000)

start_speed = Slider(10, range=0..1000)
end_speed = Slider(100, range=0..10000)
start_pi_2 = Slider(0, range=0..1)
start_radius_2 = Slider(0, range=0..1)
end_radius_2 = Slider(40.4, range=0..100)
steps_2 = Slider(100, range=0..100)
# www.projectsilkworm.com/about
# info@projectsilkworm.com
# Extruded Lines
pt_2 = Point(Point(98.65713603, 98.86313918, 0))
end_pi_2 = Slider(5, range=0..10)
start_flow = Slider(0.01, range=0..0.1)
end_flow = Slider(0.05, range=0..1)

inner_loop_radius_2 = Slider(50, range=0..100)
outer_loop_radius_2 = Slider(48, range=0..100)

dom = Domain(DomainStart=start_pi_2, DomainEnd=end_pi_2)
dom_2 = Domain(DomainStart=start_radius_2, DomainEnd=end_radius_2)
# Create Spiral
range = Range(Domain=dom, Steps=expr("N-1", steps_2))
range_2 = Range(Domain=dom_2, Steps=expr("N-1", steps_2))
pi = Pi(Factor=range)
pt_3 = PointCylindrical(BasePlane=pt_2, Angle=pi, Radius=range_2, Elevation=0)

# ----
# EXAMPLE - SPIRAL
# 
# Create a spiral with a range of speeds and flow values.
loadsettings = LoadSettings(String=["acceleration = 0", "bed_size = 200,200", "bed_temperature = 0", "bottom_layer_speed_ratio = 0.3", "bridge_fan_speed = 100", "bridge_flow_ratio = 1.4", "bridge_speed = 5", "cooling = 0", "disable_fan_first_layers = 1", "duplicate = 1"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])

dom_3 = Domain(DomainStart=start_pi, DomainEnd=end_pi)
dom_4 = Domain(DomainStart=start_radius, DomainEnd=end_radius)
# Create Spiral
range_3 = Range(Domain=dom_3, Steps=expr("N-1", steps))
range_4 = Range(Domain=dom_4, Steps=expr("N-1", steps))
pi_2 = Pi(Factor=range_3)
pt_4 = PointCylindrical(BasePlane=pt, Angle=pi_2, Radius=range_4, Elevation=0)

loadsettings_2 = LoadSettings(String=["acceleration = 0", "bed_size = 200,200", "bed_temperature = 0", "bottom_layer_speed_ratio = 0.3", "bridge_fan_speed = 100", "bridge_flow_ratio = 1.4", "bridge_speed = 5", "cooling = 0", "disable_fan_first_layers = 1", "duplicate = 1"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])
pline = PolyLine(Vertices=pt_3, Closed=False)

# ----
# Create Perimeter to get Plastic Flowing
cir = Circle(Plane=pt_2, Radius=outer_loop_radius)
cir_2 = Circle(Plane=pt_2, Radius=inner_loop_radius)
planar = PlanarSrf(Edges=[cir_2, cir])
# Adjust Speed and Flow of Movement
filler = SilkwormFiller(SettingsDictionary=loadsettings, PlanarBreps=planar, InfillType=Slider(0, range=0..100))

# ----
# Create Perimeter to get Plastic Flowing
cir_3 = Circle(Plane=pt, Radius=outer_loop_radius_2)
cir_4 = Circle(Plane=pt, Radius=inner_loop_radius_2)
planar_2 = PlanarSrf(Edges=[cir_4, cir_3])
# Adjust Speed and Flow of Movement
filler_2 = SilkwormFiller(SettingsDictionary=loadsettings_2, PlanarBreps=planar_2, InfillType=Slider(0, range=0..100))

pline_2 = PolyLine(Vertices=pt_4, Closed=False)

# ----
# Adjust End Pressure to Start Blobs
panel = Panel("0")
delimiter = SilkwormMovementDelimiter(StartVec=Vector(0, 0, -1), StartSpd=360, StartPrs=1.1, EndVec=Vector(0, 0, 1), EndSpd=360, EndPrs=panel, Travel=7200)

movement = SilkwormMovement(MovementGeometry=filler_2, Delimiter=delimiter)
delimiter_2 = SilkwormMovementDelimiter(StartVec=Vector(0, 0, -1), StartSpd=360, StartPrs=1.1, EndVec=Vector(0, 0, 1), EndSpd=360, EndPrs=-1, Travel=7200)

explode = Explode(Curve=pline, Recursive=True)  # -> Segments, Vertices
line = Line(explode.Segments)
dom_5 = Domain(DomainStart=start_speed, DomainEnd=end_speed)
lng = ListLength(List=line)
dom_6 = Domain(DomainStart=start_flow, DomainEnd=end_flow)
lng_2 = ListLength(List=line)
range_5 = Range(Domain=dom_5, Steps=expr("N-1", lng))
range_6 = Range(Domain=dom_6, Steps=expr("N-1", lng_2))
movement_2 = SilkwormMovement(MovementGeometry=line, SpeedParameter=range_5, FlowParameter=range_6, Delimiter=delimiter_2)

sort_option = Slider(3, range=0..10)
merge = Merge(Data1=flatten(filler), Data2=flatten(movement_2))
silkworm = SilkwormGenerator(SettingsDictionary=loadsettings, Geometry=flatten(merge), Sort=sort_option)  # -> GCode, SilkwormModel
panel_2 = Panel(silkworm.GCode)
silkworm_viewer = SilkwormViewer(SilkwormModel=silkworm.SilkwormModel, DisplayValues=False)

explode_2 = Explode(Curve=pline_2, Recursive=True)  # -> Segments, Vertices
line_2 = Line(simplify(graft(explode_2.Segments)))
len = Length(Curve=line_2)
division = Division(A=len, B=2)
division_2 = Division(A=division, B=flatten(squashed_cross_section_ratio))
Z = UnitZ(Factor=lift_height)
rev = Reverse(Vector=Z)
multiplication = Multiplication(A=ratio_of_filament_to_nozzle, B=division_2)
curvepoint = PointOnCurve(line_2, parameter=1)

max = Maximum(A=multiplication, B=ratio_of_filament_to_nozzle)

delimiter_3 = SilkwormMovementDelimiter(StartVec=rev, StartSpd=speeds, StartPrs=max, EndVec=Z, EndSpd=speeds, EndPrs=0, Travel=travel_speed)  # -> simplify(Delimiters)
movement_3 = SilkwormMovement(MovementGeometry=curvepoint, Delimiter=delimiter_3)

merge_2 = Merge(Data1=flatten(movement), Data2=flatten(movement_3))
silkworm_2 = SilkwormGenerator(SettingsDictionary=loadsettings_2, Geometry=flatten(merge_2), Sort=Slider(3, range=0..10))  # -> GCode, SilkwormModel
silkworm_viewer_2 = SilkwormViewer(
    SilkwormModel=silkworm_2.SilkwormModel,
    LayerStart=Slider(0, range=0..1),
    LayerEnd=Slider(1, range=0..1),
    DisplayValues=Toggle(True))
panel_3 = Panel(silkworm_2.GCode)
