# Grasshopper definition grid_separation.gh (Grasshopper 1.0.7)

number_slider = Slider(55, range=0..500)
number_slider_2 = Slider(15, range=0..500)
number_slider_3 = Slider(15, range=0..500)
rectangle = Rectangle(Plane=PlaneXY(0, 0, 0), XSize=number_slider, YSize=number_slider, Radius=0)  # -> Rectangle, Length
srf = Surface(rectangle.Rectangle)
number_slider_4 = Slider(5, range=0..500)
divide = DivideDomain²(Domain=srf, UCount=number_slider_2, VCount=number_slider_2)
number_slider_5 = Slider(0, range=0..500)
number_slider_6 = Slider(223, range=0..500)
number_slider_7 = Slider(34, range=0..500)
subsrf = Isotrim(Surface=srf, Domain=divide)
number_slider_8 = Slider(49, range=-500..500)
number_slider_9 = Slider(1, range=0..500)
number_slider_10 = Slider(14, range=0..500)
area = Area(Geometry=subsrf)  # -> Area, Centroid
rectangle_2 = Rectangle(Plane=PlaneXY(0, 0, 0), XSize=number_slider_7, YSize=number_slider_7, Radius=0)  # -> Rectangle, Length
series = Series(Start=number_slider_2, Step=number_slider_2, Count=number_slider_2)
partition = PartitionList(List=area.Centroid, Size=number_slider_2)
number_slider_11 = Slider(14, range=0..500)
number_slider_12 = Slider(397, range=0..500)
pline = PolyLine(Vertices=partition, Closed=False)
divide_2 = DivideCurve(Curve=rectangle_2.Rectangle, Count=Slider(26, range=0..500), Kinks=False)  # -> Points, Tangents, Parameters
pline_2 = PolyLine(Closed=False)
